vi "802.11 AP Host.gvi"   [LabVIEW Communications System Design Suite 2.0.1]
panel controls:
  "Trigger TX": bool  # A Boolean control to trigger a single TX packet.
  "Clear events": bool  # Boolean control to clear the events history from the front panel. The default register size of the events history is 10,000.
  "Primary Channel Selector": UFXP(2.0) = 1  # Numeric control to determine which subband is used as the primary channel. The PHY covers 80 MHz bandwidth, which can be divided into four subbands {0,…,3} of 20 MHz bandwidth for the non-high throughput (non-HT) signal. For wider bandwidths the subbands get combined. Visit ni.com/info and enter the Info Code 80211AppFWManual to access the LabVIEW Communications 802.11 Application Framework Manual for more information about channelization.
  "Transmit IP Address": string = "127.0.0.1"  # Destination IP address for the UDP output stream.
  "Transmit Port": u16 = 13000  # Target UDP port for UDP output stream, usually between 1,025 and 65,535.
  "Tab": i32
  "Power Level [dBm]": f64  # Output power level considering the transmission of a continuous wave (CW) signal that has full digital to analog converter (DAC) range. The high peak-to-average power ratio of OFDM means that the output power of transmitted 802.11 frames is usually 9 dB to 12 dB below the adjusted power level.
  "Primary Channel Center Frequency [Hz]": f64 = 2437000000  # It is the primary channel center frequency of the transmitter in Hz. Valid values depend on the device the station is running on.
  "TX RF Port": enum{"TX1/RF 0", "TX1/RF 1"} = "TX1/RF 0"  # The RF port used for TX (applicable only for USRP RIO devices).
  "RX RF Port": T1 = "RX2/RF 1"  # The RF port used for RX (applicable only for USRP RIO devices).
  "AGC": bool = TRUE  # If enabled, the optimum gain setting is chosen depending on the received signal power strength. The RX gain value is taken from Manual RX Gain if the AGC has been disabled.
  "Manual RX gain [dB]": f64 = 37.5  # Manual RX gain value. Applied if AGC is disabled.
  "PN Data Packet Size": i32 = 1024  # Packet size in bytes (range is limited to 4061, which is a single A-MPDU reduced by MAC overhead)
  "Subcarrier Format": "802.11 Subcarrier Format.gtype" = "20 MHz (IEEE 802.11 a)"  # Allows you to switch between IEEE 802.11 standard formats. The supported formats are the following: 802.11a with 20 MHz Bandwidth 802.11ac with 20 MHz Bandwidth 802.11ac with 40 MHz Bandwidth 802.11ac with 80 MHz Bandwidth (supported MCS up to 4)
  "Stop": bool  # Boolean control to stop the station.
  "RIO Device": string = "RIO0"  # The RIO address of the RF hardware device.
  "Enable Station": bool
  "reset TX staistics": bool  # A Boolean control to reset all counters of MAC TX Statistics cluster.
  "reset RX staistics": bool  # A Boolean control to reset all counters of MAC RX Statistics cluster.
  "PN Packets per Second": u32 = 1000  # Average number of packets to transmit per second (limited to 10,000. The achievable throughput might be less depending on the configuration of the station).
  "Backoff": i32 = -1  # Backoff value that is applied before a frame is transmitted. The backoff is counted in number of slots of 9 µs duration. Based on the backoff value, the backoff counting for the Backoff procedure could be fixed or random: If the backoff value is larger than or equal zero, a fixed backoff is used. If the backoff value is negative, a random backoff counting is used.
  "All": bool  # Boolean control to enable the events tracking of the above FPGA events.
  "None": bool  # Boolean control to disable the events tracking of the above FPGA events.
  "CCA Energy Detection Threshold [dBm]": FXP(10.3) = -50  # If the energy of the received signal is above the threshold, the station qualifies the medium as busy and interrupts its Backoff procedure, if any. Set the CCA Energy Detection Threshold [dBm] control to a value which is higher than the minimal value of the current curve in the RF Input Power graph.
  "MCS": UFXP(4.0) = 4  # Modulation and coding scheme index used to encode data frames. ACK frames are always sent with MCS 0. Be aware that not all MCS values are applicable for all subcarrier formats and the meaning of the MCS changes with the subcarrier format. The text field next to the MCS field shows the modulation scheme and coding rate for the current MCS and Subcarrier Format.
  "session": "802.11 Host Session.gtype"
  "Data Source Options": i32 = 1
    # Each tab shows the options for the corresponding data sources.
    # UDP Tab—A free UDP port to retrieve data for the transmitter is derived inherently based on the station number.
    # PN Tab - PN Data Packet Size—Packet size in bytes (range is limited to 4061, which is a single A-MPDU reduced by MAC overhead)
    # PN Tab - PN Packets per Second—Average number of packets to transmit per second (limited to 10,000. The achievable throughput might be less depending on the configuration of the station).
    # Manual Tab – Trigger TX—A Boolean control to trigger a single TX packet.
  "Data Sink Option": i32  # It has the following required configurations for the UDP data sink option: · Transmit IP Address—Destination IP address for the UDP output stream. Transmit Port—Target UDP port for UDP output stream, usually between 1,025 and 65,535.
  "Data Source": T7 = "External"
    # Determines the source of MAC frames send from the host to the target.
    # Off— This method is useful to disable transmitting TX data while the TX chain is active to trigger ACK packets.
    # UDP—This method is useful for showing demos, such as when using an external video streaming application, or for using external network testing tool, such as Iperf. In this method, input data arrives at or is generated from the 802.11 station using user datagram protocol (UDP).
    # PN Data—This method sends random bits and is useful for functional tests. Packet size and rate can be easily adapted.
    # Manual—This method is useful to trigger single packets for debugging purposes.
    # External—Allow a potential external upper MAC realization or other external applications to use the MAC & PHY functionalities provided by the 802.11 Application Framework.
  "Data Sink": enum{"Off", "UDP"} = "Off"  # It has the following options: Off—Data is discarded. UDP—If enabled, received frames are forwarded to the configured UDP address and port (see below).
  "Reference Clock": string = "Internal"
    # Configures the reference for the device clocks. The reference frequency must be 10 MHz. You can choose from the following sources:
    # Internal—Uses the internal reference clock.
    # REF IN / ClkIn—The reference is taken from the REF IN port (USRP-294xR, and USRP-295XR) or the ClkIn port (NI 5791).
    # GPS—The reference is taken from the GPS module. Only applicable for the USRP-2950/2952/2953 devices.
    # PXI_CLK—The reference is taken from the PXI chassis. Only applicable for PXIe-7975/7976 targets with NI-5791 adapter modules.
  "dot11RTSThreshold": u32 = 2000
    # Semi-static parameter used by frame sequence selection to decide whether RTS|CTS is allowed or not.
    # If the PSDU length, i.e. PN Data Packet Size, is larger than dot11RTSThreshold, the {RTS | CTS | DATA | ACK} frame sequence is used.
    # If the PSDU length, i.e. PN Data Packet Size, is less than or equal to the dot11RTSThreshold, the {DATA | ACK} frame sequence is used.
    # This mechanism allows stations to be configured to initiate RTS/CTS either always, never, or only on frames longer than a specified length.
  "dot11ShortRetryLimit": u16 = 7  # Semi-static parameter—Maximum number of retries applied for short MPDU type (sequences without RTS|CTS). If the number of retry limits is reached, discards MPDUs and associated MPDU configuration and TX vector.
  "dot11LongRetryLimit": u16 = 4  # Semi-static parameter—Maximum number of retries applied for long MPDU type (sequences including RTS|CTS). If the number of retry limits is reached, discards MPDUs and associated MPDU configuration and TX vector.
  "control frame TX vector configuration": T8  # Applies the configured MCS values in TX vectors for RTS, CTS or ACK frames. The default control frame configuration of those frames is Non-HT-OFDM and 20 MHz bandwidth while the MCS can be configured from the host.
  "FPGA events to track": "802.11 Events Enable Mask.gtype"  # It has a set of Boolean controls; each control is used to enable or disable the tracking of the corresponding FPGA event. Those events are as follows: PHY TX start request PHY TX end indication PHY RX start indication PHY RX end indication PHY CCA timing indication PHY RX gain change indication DCF state indication MAC MPDU RX indication MAC MPDU TX request
  "Device MAC Address": string = "46:6F:4B:75:6D:61"  # MAC address associated with the station. The Boolean Indicator shows if the given MAC address is valid or not. The MAC address validation is done in the dynamic mode.
  "Destination MAC Address": string = "46:6F:4B:75:6D:62"  # MAC address of the destination to which packets should be sent. The Boolean indicator shows if the given MAC address is valid or not. If running in RF loopback mode, the Destination MAC Address and the Device MAC Address should be similar.
  "log file prefix": string = "events.txt"  # Name a text file to write the FPGA events data that have been read from the Event DMA FIFO. They presented above in the FPGA events to track. Each event consists of a time stamp and the event data. The text file is created locally in the project folder. Only the selected events in the FPGA events to track above will be written in the text file.
  "write to file": bool  # Boolean control to enable or disable the writing process of the selected FPGA events to the text file.
  "AGC target signal power [dBFS]": FXP(10.3) = -20  # Target RX power in digital base band used if the AGC is enabled. The optimal value depends on the peak to average power ratio (PAPR) of the received signal. Set the AGC target signal power to a value larger than that presented in the Baseband RX Power graph.
  "Station Number": u16 = 1  # Numerical control to set the station number. Each running station should have a different number. It can be up to 10. If the user would like to increase the number of running stations, the cache of MSDU Sequence Number assignment and Duplicate Detection should be increased to the required value, since the default value is 10.
  "values per second": bool  # A Boolean control to show the MAC TX Statistics and MAC RX Statistics either the accumulated values since the last reset or the values per second.
  "RF loop back demo mode": bool
    # Boolean control to switch between the operation modes:
    # RF Multi-Station (Boolean is false): At least two stations are required in the setup, where each station acts as a single 802.11 device.
    # RF Loopback (Boolean is true):  A single device is required. This setup is useful for small demos using a single station. However, the implemented MAC features have some limitations in RF Loopback mode. The ACK packets are lost while the MAC TX is waiting for them; the DCF state machine on FPGA of MAC prevents this mode. Therefore, the MAC TX always reports a transmission failed. Hence, the reported TX packet error rate and the TX block error rate on the graphical indication of TX Error Rates are ones.
panel indicators:
  "Events": string
  "Baseband RX Power": f64[][]  # Graphical indication displays the baseband signal power at packet start. The numerical indicator shows the actual receiver's baseband power. When the AGC is enabled, the 802.11 Application Framework attempts to keep this value at the given AGC target signal power in Advanced tab by changing the RX gain accordingly.
  "Coerced LO frequency TX [Hz]": f64  # Actual used TX frequency on target.
  "Coerced LO frequency RX [Hz]": f64  # Actual used RX frequency on target.
  "Channel Estimation": cluster{"Element 1": i32[], "Element 2": f64[]}[]  # Graphical indication shows the amplitude and phase of the estimated channel (based on L-LTF and VHT-LTF).
  "TX Error Rates": f64[][]  # Graphical indication shows the TX packet error rate and TX block error rate. The TX packet error rate is calculated as a ratio of successful MPDU transmitted to the number of transmission tries. The TX block error rate is calculated as a ratio of successful MPDU transmitted to the total number of transmission. The most recent values are displayed on the upper right of the graph.
  "Coerced Power Level [dBm]": f64  # Power level of a continuous wave of 0 dBFS that provides for the current device settings. The average output power of 802.11 signals is approximately 10 dB below this level. Indicates the actual power level considering RF frequency and device-specific calibration values from the EEPROM.
  "RX Throughput": f64  # Graphical indication shows the data rate of successful received and decoded frames matching the Device MAC Address.
  "Applied RX Gain [dB]": f64  # A numerical indicator shows RX gain value currently applied. This value is the Manual RX Gain when the AGC is disabled, or the calculated RX gain when AGC is enabled. In both cases, the gain value is coerced by the capabilities of the device.
  "RX Throughput [bits/s]": f64  # Numerical indication shows the data rate of successful received and decoded frames matching the Device MAC Address.
  "current TX packet error rate": f64
  "RF Frequency [Hz]": f64  # The RF center frequency after the adjustment based on the Primary Channel Selector control and the operating bandwidth.
  "Station Active": bool  # Boolean indicator shows if the station RF is active after enabling the station by setting the Enable Station control to On.
  "Device Ready": bool  # Boolean indicator shows if the device is ready. If you receive an error, try one of the following: Ensure your RIO device is connected properly. Check the configuration of RIO Device. Check the station number. It should be different if more than one station is running on the same host.
  "Baseband RX Power [dBFS]": f64
  "RX Constellation": c128[]  # Graphical indication shows the constellation of RX I/Q samples of the received data field.
  "RX Power Spectrum": T2  # A snapshot of the current baseband spectrum from the RX.
  "TX Power Spectrum": T2  # A snapshot of the current baseband spectrum from the TX.
  "Data Transfer": bool  # Indicates that the packets are successfully read from the given port. Look to video streaming for more details.
  "FIFO Full": bool  # Indicates that the socket buffer of the UDP reader is small to read the given data, so packets are dropped. Increase the socket buffer size.
  "FIFO Full": bool  # Indicates that the socket buffer of the UDP sender is small to receive the payload from the RX Data direct memory access (DMA) FIFO, so packets are dropped. Increase the socket buffer size.
  "Data Transfer": bool  # Indicates that the packets are successfully read from the DMA FIFO and forwarded to the given UDP port.
  "Compensated CFO [Hz]": f64  # Carrier frequency offset detected by coarse frequency estimation unit. For FlexRIO/FlexRIO adapter module, set the reference clock to PXI_CLK or REF IN/ClkIn.
  "modulation and coding rate": string
  "Target FIFO Overflow": bool  # Boolean indicator that lights if there is an overflow in the target to host (T2H) first-in-first-out memory buffers (FIFOs). If one of the T2H FIFOs overflows, its information is no longer reliable. Those FIFOs are as follows: T2H RX Data overflow T2H Constellation overflow T2H RX Power Spectrum overflow T2H Channel Estimation overflow TX to RF FIFO overflow
  "RF Input Power": f64[][]  # Displays the current RF input power in dBm regardless of the type of incoming signal if an 802.11 packet has been detected. This indicator displays the RF input power, in dBm, currently being measured, as well as at the most recent packet start.
  "MAC RX statistics": "802.11 MAC RX Statistics.gtype"
    # Numerical indication shows the values of the following counters related to MAC RX. The presented values could be the accumulated values since the last reset or the values per second based on the status of the Boolean control values per second.
    # preamble detected (by the synchronization)
    # PHY service data units (PSDUs) received (frames with valid physical layer convergence procedure (PLCP) header, frames without format violations)
    # MPDU CRC OK (the frame check sequence (FCS) check passes)
    # RTS detected
    # CTS detected
    # Data detected
    # ACK detected
  "MAC TX statistics": "802.11 MAC TX Statistics.gtype"  # Numerical indication shows the values of the following counters related to MAC TX. The presented values could be the accumulated values since the last reset or the values per second based on the status of the Boolean control values per second. RTS Triggered CTS Triggered Data Triggered ACK Triggered
  "Averaged Retransmissions per Packet": f64  # Graphical indication shows the average number of transmission tries. The recent value is displayed on the upper right of the graph.
  "valid": bool  # Boolean indicator shows if the given Device MAC Address associated with the device station is valid.
  "valid": bool  # Boolean indicator shows if the given Destination MAC Address associated with the device station is valid.
  "Channelization": cluster{"x": f64, "y": f64}[][]  # Graphical indication shows which sub-band is used as the primary channel based on the Primary Channel Selector. The PHY covers 80 MHz bandwidth, which can be divided into four sub-bands {0,…,3} of 20 MHz bandwidth for the non-HT signal. For wider bandwidths (40 MHz or 80 MHz), the sub-bands get combined. Visit ni.com/info and enter the Info Code 80211AppFWManual to access the LabVIEW Communications 802.11 Application Framework Manual for more information about channelization.
  "Averaged Retransmissions p. Packet": f64
  "current TX block error rate": f64
  "Receive Port": u16  # Source UDP port of UDP input stream.
  "num packets source": u32  # Numerical indicator shows the number of packets that have been received from the data source (UDP, PN Data, or Manual).
  "transfer source": bool  # Boolean indicator shows that a data is receiving from the data source (the number of received packets is not zero).
  "num packets sink": u32  # Number of received packets at data sink from MAC high.
  "transfer sink": bool  # Boolean indicator shows that a data is receiving from the MAC high.
  "TX Indications Middle MAC": u32  # Numerical indicator shows the number of MAC TX Status Indications reported from MAC Middle to MAC high using the assigned UDP port located above it.
  "TX Requests to PHY": u32  # Numerical indicator shows the number of MAC MSDU TX requests written to the DMA FIFO.
  "RX Indications from PHY": u32  # : Numerical indicator shows the number of MAC MSDU RX indications read from the DMA FIFO.
  "RX Indications High MAC": u32  # Numerical indicator shows the number of MAC MSDU RX indications with valid MSDU data received at MAC high.
  "RX Indications Middle MAC": u32  # Numerical indicator shows the number of MAC MSDU RX indications that have been decoded correctly and reported to the MAC high using the assigned UDP port located above it.
  "TX Indications from PHY": u32  # Numerical indicator shows the number of MAC MSDU TX end indications read from the DMA FIFO.
  "TX Request High MAC": cluster{"Config": u32, "Payload": u32}  # Numerical indicators show the number of MAC TX Configuration and Payload request messages generated by the MAC high abstraction layer and written to the corresponding UDP port that is located under them.
  "TX Request Middle MAC": cluster{"Config": u32, "Payload": u32}  # Numerical indicators show the number of MAC TX Configuration and Payload request messages received from the MAC high abstraction layer and read from the corresponding UDP port that is located above them. Before transfer both messages to the lower layers, the given configurations are checked if they are supported or not, in addition, the MAC TX Configuration request and MAC TX Payload request are checked if they are consistence.
  "TX Confirmation Middle MAC": cluster{"Config": u32, "Payload": u32}  # Numerical indicators show the number of confirmation messages that have been generated by the MAC middle for the MAC TX Configuration and MAC TX Payload messages and written to the assigned UDP port located above them.
  "TX Indication Overflow Count": u16  # Numerical indicator shows the number of overflows that occurred during the FIFO writing by TX End indications.
  "TX Indication Overflow": bool
  "RX Indication Overflow Count": u16  # Numerical indicator shows the number of overflows that occurred during the FIFO writing by MAC MSDU RX indications.
  "RX Indication Overflow": bool
  "TX requests": u16  # Reference to the UDP socket used to send or receive the TX requests.
  "local TX confirmations": u16  # Reference to the UDP socket used to send or receive the TX confirmations.
  "local RX indications": u16  # Reference to the UDP socket used to send or receive the RX indications.
  "local TX indications": u16  # Reference to the UDP socket used to send or receive the TX indications.
  "Packets dropped count": u32  # Numerical indicator shows the number of MAC MSDU TX requests written to the DMA FIFO.
  "Packets dropped": bool
types:
  T1 = enum{"RX1/RF 0", "RX2/RF 0", "RX1/RF 1", "RX2/RF 1"}
  "802.11 Subcarrier Format.gtype" = enum{"20 MHz (IEEE 802.11 a)", "20 MHz (IEEE 802.11 ac)", "40 MHz (IEEE 802.11 ac)", "80 MHz (IEEE 802.11 ac)"}
  T2 = cluster{"f0": f64, "df": f64, "magnitude": f64[]}
  T3 = cluster{"Timestamp": u32, "Transferred Bytes": u32}
  T4 = cluster{"fpga ref": any, "bus instance": u32, "instruction FIFO depth": u32, "executing on FPGA target": bool, "show error call chain": bool}
  T5 = cluster{"Actual Gain [dB]": f64, "Attenuation Table Index": i32}
  T6 = cluster{"Attenuation Table [dB]": f64[][], "Frequencies [Hz]": f64[], "IQ Imbalance Table": "niUsrpRio Config v1 Host.lvlib__IQ Imbalance.gtype"[], "Gain Table": T5[][]}
  "niInstr Register Bus v0 Host.lvlib__Register Bus Session.gtype" = Queue<"niInstr Register Bus v0 Host.lvlib__Session Data.gtype">
  "Semaphore RefNum.gtype" = i32
  "niUsrpRio Config v1 Host.lvlib__DB Queue Reference.gtype" = Queue<"niUsrpRio Config v1 Host.lvlib__Daughterboard Data.gtype">
  "niUsrpRio Config v1 Host.lvlib__niUsrpRio Session.gtype" = cluster{"FPGA Interface": any, "RIO Interface Number": u32, "Data Clock Rate": u32, "FPGA Data Clock Rate": u32, "Global Settings Register Bus": "niInstr Register Bus v0 Host.lvlib__Register Bus Session.gtype", "Radio 0 Settings Register Bus": "niInstr Register Bus v0 Host.lvlib__Register Bus Session.gtype", "Radio 1 Settings Register Bus": "niInstr Register Bus v0 Host.lvlib__Register Bus Session.gtype", "Radio Settings Bus Semaphore": "Semaphore RefNum.gtype", "DB Queues": "niUsrpRio Config v1 Host.lvlib__DB Queue Reference.gtype"[], "Characterization Data Valid?": bool, "EEPROM Header": "niUsrpRio Config v1 Host.lvlib__EEPROM Header.gtype", "Device Data Header": "niUsrpRio Config v1 Host.lvlib__EEPROM Device Data Header.gtype", "EEPROM Characterization Header": "niUsrpRio Config v1 Host.lvlib__EEPROM Characterization Header.gtype", "Characterization Data": "niUsrpRio Config v1 Host.lvlib__Characterization Data.gtype"[], "FPGA Current Version": u32, "FPGA Oldest Compatible Version": u32, "Fixed Logic Current Version": u32, "Fixed Logic Oldest Compatible Version": u32, "FPGA Radio Settings Bus Current Version": u32, "FPGA Radio Settings Bus Oldest Compatible Version": u32, "FPGA Board Config Current Version": u32, "FPGA Board Config Oldest Compatible Version": u32, "Daughterboard Clock Rate": u32}
  "802.11 Host Session.gtype" = cluster{"station number": u16, "FPGA interface": "802.11 FGPA Reference.gtype", "MAC High Requests": Queue<u8[]>, "MAC High Confirmations": Queue<u8[]>, "Triggered TX Requests": Queue<"802.11 TX Request Confirmation Reference Parameters.gtype">, "receive queue": Queue<u8[]>, "receive throughput queue": Queue<T3>, "UDP Receiver": UdpNetworkConnectionRefnum, "PN packet": u8[], "FlexRIO session": Queue<T4>, "FlexRIO TX Characterization Data": T6, "FlexRIO RX Characterization Data": T6, "USRP session": "niUsrpRio Config v1 Host.lvlib__niUsrpRio Session.gtype", "RF loop clock frequency": f64, "UDP Receiver TX Request": UdpNetworkConnectionRefnum, "UDP Receiver TX Confirmation": UdpNetworkConnectionRefnum, "UDP Receiver RX Indication": UdpNetworkConnectionRefnum, "UDP Sender": UdpNetworkConnectionRefnum}
  T7 = enum{"Off", "UDP", "PN Data", "Manual", "External"}
  T8 = cluster{"RTS MCS": UFXP(4.0), "CTS MCS": UFXP(4.0), "ACK MCS": UFXP(4.0)}
  "802.11 MAC RX Statistics.gtype" = cluster{"preamble detected": u32, "PSDUs received": u32, "MPDU CRC OK": u32, "RTS detected": u32, "CTS detected": u32, "Data detected": u32, "ACK detected": u32}
  "802.11 MAC TX Statistics.gtype" = cluster{"RTS triggered": u32, "CTS triggered": u32, "Data triggered": u32, "ACK triggered": u32}
  "802.11 Events Enable Mask.gtype" = cluster{"PHY TX start request": bool, "PHY TX end indication": bool, "PHY RX start indication": bool, "PHY RX end indication": bool, "PHY CCA timing indication": bool, "PHY RX gain change indication": bool, "DCF state indication": bool, "MAC MPDU RX indication": bool, "MAC MPDU TX request": bool}
  "Log Level.gtype" = enum{"Trace", "Debug", "Info", "Warn", "Error", "Fatal"}
  "Log Configuration.gtype" = cluster{"enabled": bool, "max log level": "Log Level.gtype"}
  "802.11 TX Status.gtype" = enum{"MPDU transmitted", "MPDU discarded"}
  "802.11 MAC TX End Indication.gtype" = cluster{"TX status": "802.11 TX Status.gtype", "number of transmission tries": u16, "valid": bool}
diagram:
  w1 = ["MAC High Stub", "MAC Middle SAP"]  # Timed Loop Names
  sequence {
    frame 0 {
      $Events <- EmptyString
      $"Device Ready" <- FALSE
      $"Station Active" <- FALSE
      $"Enable Station" <- FALSE
      $"Target FIFO Overflow" <- FALSE
      $"RX Constellation" <- c128[] []
      $"RX Power Spectrum" <- T2 {all zero or empty}
      $"TX Power Spectrum" <- T2 {all zero or empty}
      $"Channel Estimation" <- cluster{"Element 1": i32[], "Element 2": f64[]}[] []
      $"current TX packet error rate" <- 0
      $"current TX block error rate" <- 0
      $"RX Throughput [bits/s]" <- 0
      $"Compensated CFO [Hz]" <- 0
      $"Averaged Retransmissions p. Packet" <- 0
      for (N = 51) {
        $"RX Throughput" <- NaN
        $"Averaged Retransmissions per Packet" <- NaN
      }
      Initialize Array(element=NaN, size=51, size=2) -> w2
      $"RF Input Power" <- w2
      $"Baseband RX Power" <- w2
      $"TX Error Rates" <- w2
      $"MAC RX statistics" <- "802.11 MAC RX Statistics.gtype" {all zero or empty}
      $"MAC TX statistics" <- "802.11 MAC TX Statistics.gtype" {all zero or empty}
    }
  }
  call "Create Stop Notifier.gvi"(error in=no error) -> (error out=w3)
  call "802.11 Host Init.gvi"(device=$"RIO Device", error in=w3, reference clock=$"Reference Clock") -> (session out=w4, error out=w5)
  case (w5) {
    frame Error {
      w6 = w5
    }
    frame No Error {
      $"Device Ready" <- TRUE
      $session <- w4
      w6 = w5
    }
  }
  Property Node(instance in="Log Configuration.gtype" {all zero or empty}, "enabled"=TRUE, "max log level"="Info") -> (instance out=w7)
  call "Change Log Configuration.gvi"(notification=w7, error in=w6) -> (error out=w8)
  s1 = w8  # shift register
  while {
    Feedback Node(input=$"Enable Station") -> w9
    Logical Exclusive Or($"Enable Station", w9) -> w10
    case (w10) {
      frame False, Default {
        w11 = s1
      }
      frame True {
        case ($"Enable Station") {
          frame False, Default {
            Property Node(instance in=$session) -> ("UDP Receiver"=w12, "FPGA interface"=w13, instance out=w14)
            sequence {
              frame 0 {
                $"Station Active" <- FALSE
              }
            }
            Property Node(instance in=w13, "station active"=FALSE, error in=s1) -> (error out=w15, instance out=w16)
            call "802.11 Mute TX RF Frontend.gvi"(session=w14, error in=w15) -> (session dup=w17, error out=w18)
            call "802.11 Abort RF Streams.gvi"(session in=w17, error in=w18, abort tx streams=FALSE, abort rx streams=TRUE) -> (session out=w19, error out=w20)
            Property Node(instance in=w16, "produce silent samples"=TRUE, "RX data source"="BB Data From Host", error in=w20) -> (error out=w21)
            sequence {
              frame 0 {
                Wait(time to wait=100)
              }
            }
            call "802.11 Abort RF Streams.gvi"(session in=w19, error in=w21, abort tx streams=TRUE, abort rx streams=FALSE) -> (error out=w22)
            Udp Close(connection ID=w12, error in=w22) -> (error out=w23)
            call "Clear Errors.gvi"(specific error code to clear=1, error in=w23) -> (error out=w11)
          }
          frame True {
            w24 = $"Station Number"
            Is Equal(x=$"Data Source", y="External") -> w25
            case ($"RF loop back demo mode") {
              frame True {
                w26 = 1
                w27 = 1
                w28 = "RF Loopback"
                w29 = 0x5000
              }
              frame False {
                w26 = $dot11LongRetryLimit
                w27 = $dot11ShortRetryLimit
                w28 = "RF Multi Station"
                w29 = $dot11RTSThreshold
              }
            }
            Property Node(instance in=$session, "station number"=w24) -> (instance out=w30)
            call "802.11 FPGA Target Configuration.gvi"(session=w30, error in=s1) -> (error out=w31, session dup=w32, TX advance=w33)
            call "802.11 Reset Statistics.gvi"(session in=w32, error in=w31, reset RX statistics=TRUE, reset TX statistics=TRUE) -> (error out=w34, session dup=w35)
            call "802.11 Configure Static Parameters.gvi"(session in=w35, error in=w34, primary channel selector=$"Primary Channel Selector", operation mode=w28, TX advance=w33) -> (session dup=w36, error out=w37)
            call "802.11 Configure MAC Parameters.gvi"(session in=w36, error in=w37, MAC address=$"Device MAC Address", dot11LongRetryLimit=w26, dot11ShortRetryLimit=w27, control frame TX vector configuration=$"control frame TX vector configuration", dot11RTSThreshold=w29) -> (session dup=w38, error out=w39)
            call "802.11 Configure RF.gvi"(error in=w39, session=w38, TX Port=$"TX RF Port", RX port=$"RX RF Port", primary channel selector=$"Primary Channel Selector", TX power level=$"Power Level [dBm]", primary channel center frequency=$"Primary Channel Center Frequency [Hz]") -> (session dup=w40, error out=w41, coerced RX LO frequency=w42, coerced TX LO frequency=w43, coerced RX gain=w44, coerced TX power level=w45, RF center frequency=w46)
            call "802.11 Channelization Visualization.gvi"(session=w40, error in=w41, primary channel selector=$"Primary Channel Selector", primary channel center frequency=$"Primary Channel Center Frequency [Hz]") -> (session dup=w47, error out=w48, channelization=w49)
            call "802.11 Configure AGC Registers.gvi"(TX Port=$"TX RF Port", session=w47, RX port=$"RX RF Port", error in=w48) -> (error out=w50, session dup=w51)
            call "802.11 Set Power Calibration Offset.gvi"(session=w51, frequency=$"Primary Channel Center Frequency [Hz]", error in=w50, RX port=$"RX RF Port") -> (session dup=w52, error out=w53)
            call "802.11 Configure RF Streams.gvi"(TX port=$"TX RF Port", RX port=$"RX RF Port", session=w52, error in=w53) -> (session dup=w54, error out=w55)
            call "802.11 Configure Data Source.gvi"(error in=w55, external mode=w25, session in=w54) -> (error out=w11, session out=w56, success?=w57)
            sequence {
              frame 0 {
                $session <- w56
                call "802.11 UDP Port Assignment.gvi"(station number=w24, external mode=w25) -> (UDP data=w58, TX requests=w59, local TX confirmations=w60, local RX indications=w61, local TX indications=w62)
              }
              frame 1 {
                $"Enable Station" <- w57
                $"Station Active" <- w57
                $"Receive Port" <- w58
                $"TX requests" <- w59
                $"local TX confirmations" <- w60
                $"local TX indications" <- w62
                $"local RX indications" <- w61
              }
            }
            $Channelization <- w49
            $"Coerced Power Level [dBm]" <- w45
            $"Applied RX Gain [dB]" <- w44
            $"Coerced LO frequency TX [Hz]" <- w43
            $"Coerced LO frequency RX [Hz]" <- w42
            $"RF Frequency [Hz]" <- w46
          }
        }
      }
    }
    # configuration
    Feedback Node(input=$"Station Active") -> w63
    case ($"Station Active") {
      frame False, Default {
        w64 = s1
      }
      frame True {
        Is Not Equal(x=$"Station Active", y=w63) -> w65
        Property Node(instance in=$session) -> ("FPGA interface"=w66, instance out=w67)
        Select(s=$"RF loop back demo mode", t=0, f=$Backoff) -> w68
        To Double Precision Float(number=$"AGC target signal power [dBFS]") -> w69
        call "802.11 Configure Dynamic Parameters.gvi"(FPGA interface=w66, error in=s1, event enable mask=$"FPGA events to track", backoff=w68, AGC target signal power=w69, CCA energy detection threshold=$"CCA Energy Detection Threshold [dBm]") -> (error out=w70)
        call "802.11 FPGA AGC Control.gvi"(session=w67, error in=w70, AGC=$AGC, RX Port (USRP only)=$"RX RF Port", initialize=w65) -> (session dup=w71, error out=w72, force host AGC update=w73)
        call "802.11 Gain Control.gvi"(initialize=w65, RX Port (USRP only)=$"RX RF Port", session=w71, AGC=$AGC, error in=w72, Manual RX gain [dB]=$"Manual RX gain [dB]", force update=w73) -> (Applied RX Gain [dB]=w74, error out=w64)
        $"Applied RX Gain [dB]" <- w74
      }
    }
    call "802.11 Reset Statistics.gvi"(session in=$session, error in=s1, reset RX statistics=$"reset RX staistics", reset TX statistics=$"reset TX staistics") -> (error out=w75)
    call "802.11 Subcarrier Format to Configuration.gvi"(MCS=$MCS, Subcarrier Format=$"Subcarrier Format", error in=w75) -> (modulation and coding rate=w76, error out=w77)
    call "802.11 MAC Address from String to Byte Array.gvi"(error in=w77, MAC address in=$"Device MAC Address") -> (error out=w78, MAC address valid=w79)
    call "802.11 MAC Address from String to Byte Array.gvi"(error in=w78, MAC address in=$"Destination MAC Address") -> (error out=w80, MAC address valid=w81)
    Merge Errors(w64, w11, w80) -> (error out=w82)
    # disable station in last loop run and assert stop
    Feedback Node(input=$Stop) -> w83
    call "Create Stop.gvi"(error in=w82, stop in=w83, timed loop name array=w1) -> (error out=w84)
    call "Check Stop.gvi"(error in=w84) -> (error out=w85, stop=w86)
    case ($Stop) {
      frame False, Default { }
      frame True {
        $"Enable Station" <- FALSE
      }
    }
    Wait Until Next Multiple(multiple to wait=100)
    $valid <- w79
    $valid <- w81
    $"modulation and coding rate" <- w76
    next s1 = w85
    stop if w86
  }
  call "Stop On Error.gvi"(error in=s1) -> (error out=w87)
  s2 = w8  # shift register
  while {
    # data source and sink
    # (UDP send and receive)
    case ($"Station Active") {
      frame False, Default {
        w88 = s2
      }
      frame True {
        Property Node(instance in=$session) -> ("UDP Receiver"=w89, "MAC High Requests"=w90, "PN packet"=w91, "UDP Sender"=w92, "receive queue"=w93)
        Array Subset(array=w91, length0=$"PN Data Packet Size") -> w94
        case ($"Data Source") {
          frame "Off", "External" {
            w95 = s2
            w96 = FALSE
            w97 = FALSE
            w98 = 0
          }
          frame "UDP" {
            # UDP
            call "802.11 Receive UDP Data.gvi"(UDP receiver=w89, send queue=w90, error in=s2) -> (data transfer=w96, error out=w95, FIFO full=w97, num packets=w98)
          }
          frame "PN Data" {
            # PN data
            call "802.11 Send PN Data.gvi"(PN packets per second=$"PN Packets per Second", send queue=w90, PN data=w94, error in=s2) -> (data transfer=w96, error out=w95, FIFO full=w97, num packets=w98)
          }
          frame "Manual" {
            # Manual
            case ($"Trigger TX") {
              frame False, Default {
                w95 = s2
                w96 = $"Trigger TX"
                w97 = default
                w98 = default
              }
              frame True {
                Enqueue Element(element=w94, error in=s2, queue=w90, timeout in ms=0) -> (error out=w95, queue out=w99, timed out?=w97)
                w96 = $"Trigger TX"
                w98 = 1
              }
            }
          }
        }
        $"Data Transfer" <- w96
        $"FIFO Full" <- w97
        Is Not Equal To 0(x=w98) -> w100
        $"transfer source" <- w100
        Feedback Node(input=w101) -> w102
        Add(w98, w102) -> w101
        $"num packets source" <- w101
        Is Equal(x=$"Data Sink", y="UDP") -> w103
        call "802.11 Send UDP Data.gvi"(target port=$"Transmit Port", target IP address=$"Transmit IP Address", receive queue=w93, UDP sender=w92, enable=w103, error in=s2) -> (DNS resolve failed=w104, FIFO full=w105, error out=w106, data transfer=w107, num packets=w108)
        $"Data Transfer" <- w107
        $"FIFO Full" <- w105
        Is Not Equal To 0(x=w108) -> w109
        $"transfer sink" <- w109
        Merge Errors(w95, w106) -> (error out=w88)
        Feedback Node(input=w110) -> w111
        Add(w108, w111) -> w110
        $"num packets sink" <- w110
        case (w104) {
          frame False, Default { }
          frame True {
            $"Data Sink" <- "Off"
            w112 = "DNS resolve of Transmit IP Address failed, disabled Data Sink"
            One Button Dialog(message=w112)
          }
        }
      }
    }
    call "Check Stop.gvi"(error in=w88) -> (error out=w113, stop=w114)
    Wait(time to wait=5)
    next s2 = w113
    stop if w114
  }
  call "Stop On Error.gvi"(error in=s2) -> (error out=w115)
  s3 = w8  # shift register
  s4 = string[] []  # shift register
  s5 = uninitialised  # shift register
  while (iteration -> i1) {
    Property Node(instance in=$session) -> ("FPGA interface"=w116)
    Quotient And Remainder(x=i1, y=5) -> (x-y*floor(x/y)=w117)
    # update plots and indicators (slow)
    case (w117) {
      frame 0, Default {
        call "802.11 Prepare Constellation.gvi"(FPGA interface=w116, error in=s3, maximal number of subcarriers=4800) -> (error out=w118, data field constellation=w121, update constellation=w122)
        Logical And($"Station Active", w122) -> w123
        case (w123) {
          frame False { }
          frame True {
            $"RX Constellation" <- w121
          }
        }
        w119 = s4
        w120 = s5
      }
      frame 1 {
        call "802.11 Prepare RX Power Spectrum.gvi"(FPGA interface=w116, error in=s3) -> (error out=w118, RX power spectrum=w124, update power spectrum=w125)
        Logical And($"Station Active", w125) -> w126
        case (w126) {
          frame False, Default { }
          frame True {
            $"RX Power Spectrum" <- w124
          }
        }
        w119 = s4
        w120 = s5
      }
      frame 2 {
        call "802.11 Prepare TX Power Spectrum.gvi"(FPGA interface=w116, error in=s3) -> (error out=w118, TX power spectrum=w127, update power spectrum=w128)
        Logical And($"Station Active", w128) -> w129
        case (w129) {
          frame False, Default { }
          frame True {
            $"TX Power Spectrum" <- w127
          }
        }
        w119 = s4
        w120 = s5
      }
      frame 3 {
        call "802.11 Prepare Channel Estimation.gvi"(FPGA interface=w116, error in=s3) -> (error out=w118, channel estimation=w130, update power spectrum=w131)
        Logical And($"Station Active", w131) -> w132
        case (w132) {
          frame False, Default { }
          frame True {
            $"Channel Estimation" <- w130
          }
        }
        w119 = s4
        w120 = s5
      }
      frame 4 {
        call "802.11 Read T2H Overflows.gvi"(FPGA interface=w116, error in=s3) -> (error out=w133, TX end indication overflow count=w134, T2H RX Data overflow=w135)
        $"TX Indication Overflow Count" <- w134
        Is Not Equal To 0(x=w134) -> w136
        $"TX Indication Overflow" <- w136
        $"RX Indication Overflow Count" <- w135
        Is Not Equal To 0(x=w135) -> w137
        $"RX Indication Overflow" <- w137
        call "802.11 Read Target Registers.gvi"(FPGA interface=w116, error in=s3, station active=$"Station Active") -> (error out=w138, target FIFO overflow=w139, compensated CFO=w140, RF input power=w141, MAC RX statistics=w142, MAC TX statistics=w143, baseband signal power=w144)
        w145 = 10000  # max log entries
        call "802.11 Read Event FIFO.gvi"(FPGA interface=w116, error in=s3) -> (raw events=w146, FPGA interface dup=w147, error out=w148)
        call "802.11 Log Events.gvi"(raw event data=w146, error in=w148, FPGA reference=w147, maximal number of log entries=w145) -> (error out=w149, dropped events=w150)
        call "Log Formatter.gvi"(error in=w149) -> (error out=w151, log entries=w152)
        Feedback Node(input=$"write to file") -> w153
        Is Not Equal(x=$"write to file", y=w153) -> w154
        case (w154) {
          frame False, Default {
            w155 = s5
            w156 = s3
          }
          frame True {
            case ($"write to file") {
              frame False, Default {
                Close File(error in=s3, refnum=s5) -> (error out=w156)
                w155 = default
              }
              frame True {
                Get Component Directory() -> (Path=w157)
                Get Current Time() -> (current time=w158)
                Format Date Time String(time format string (%c)="_%Y-%m-%d_%H-%M-%S", time stamp=w158) -> (date/time string=w159)
                Concatenate Strings($"log file prefix", w159, ".txt") -> w160
                Build Path(base path=w157, name or relative path=w160) -> (appended path=w161)
                # reopen file if file name changed
                Open Or Create Or Replace File(access (0:read/write)="write-only", error in=s3, file path (use dialog)=w161, operation (0:open)="replace or create") -> (error out=w156, refnum out=w155)
              }
            }
          }
        }
        case (w150) {
          frame False, Default {
            w162 = w152
          }
          frame True {
            Array Subset(array=w152, index0=1) -> w163
            Build Array[ConcatenateInputs=True]("(...)\n", w163) -> w162
          }
        }
        case ($"write to file") {
          frame False, Default {
            w120 = w155
            w164 = w156
          }
          frame True {
            Concatenate Strings(w162) -> w165
            Write To Text File(error in=w156, file (use dialog)=w155, text=w165) -> (error out=w164, refnum out=w120)
          }
        }
        Merge Errors(w133, w138, w151, w164) -> (error out=w118)
        $"Target FIFO Overflow" <- w139
        $"Compensated CFO [Hz]" <- w140
        $"RF Input Power" <- w141
        $"Baseband RX Power" <- w144
        Array Index(array=w144) -> (out0[0, 1]=w166)
        $"Baseband RX Power [dBFS]" <- w166
        Quotient And Remainder(x=i1, y=20) -> (x-y*floor(x/y)=w167)
        Is Equal To 0(x=w167) -> w168
        call "802.11 Prepare MAC TX and RX Statistics.gvi"(MAC RX statistics in=w142, MAC TX statistics in=w143, values per second=$"values per second", 1s passed=w168) -> (MAC RX statistics out=w169, MAC TX statistics out=w170)
        $"MAC RX statistics" <- w169
        $"MAC TX statistics" <- w170
        Build Array[ConcatenateInputs=True](s4, w162) -> w171
        Array Size(array=w171) -> (size(s)=w172)
        Is Greater(x=w172, y=w145) -> w173
        case (w173) {
          frame False, Default {
            w174 = w171
          }
          frame True {
            Decrement(x=w145) -> w175
            Delete From Array(inArray=w171, length (1)=w175) -> (deleted=w176)
            case (w150) {
              frame True {
                w174 = w176
              }
              frame False {
                Build Array[ConcatenateInputs=True]("(...)\n", w176) -> w174
              }
            }
          }
        }
        Select(s=$"Clear events", t=string[] [], f=w174) -> w119
        Concatenate Strings(w174) -> w177
        $Events <- w177
        Select(s=$None, t="802.11 Events Enable Mask.gtype" {all zero or empty}, f=$"FPGA events to track") -> w178
        w179 = "802.11 Events Enable Mask.gtype" {"PHY TX start request"=TRUE, "PHY TX end indication"=TRUE, "PHY RX start indication"=TRUE, "PHY RX end indication"=TRUE, "PHY CCA timing indication"=TRUE, "PHY RX gain change indication"=TRUE, "DCF state indication"=TRUE, "MAC MPDU RX indication"=TRUE, "MAC MPDU TX request"=TRUE}
        Select(s=$All, t=w179, f=w178) -> w180
        $"FPGA events to track" <- w180
      }
    }
    call "Check Stop.gvi"(error in=w118) -> (error out=w181, stop=w182)
    Wait(time to wait=50)
    next s3 = w181
    next s4 = w119
    next s5 = w120
    stop if w182
  }
  Is Not A Number Or Path Or Refnum(number=s5) -> w183
  # close file if the reference still exists
  case (w183) {
    frame True {
      w184 = s3
    }
    frame False {
      Close File(error in=s3, refnum=s5) -> (error out=w184)
    }
  }
  call "Stop On Error.gvi"(error in=w184) -> (error out=w185)
  Obtain Queue(element data type="802.11 MAC TX End Indication.gtype" {all zero or empty}, error in=w8) -> (error out=w186, queue out=w187)
  s6 = w186  # shift register
  while {
    Feedback Node(input=$"Station Active") -> w188
    Is Not Equal(x=$"Station Active", y=w188) -> w189
    # update plots and indicators (fast)
    case ($"Station Active") {
      frame False, Default {
        w190 = s6
      }
      frame True {
        Property Node(instance in=$session) -> ("FPGA interface"=w191, "receive throughput queue"=w192)
        call "802.11 Prepare Throughput Measurements.gvi"(reset=w189, FPGA interface=w191, receive throughput queue=w192, error in=s6, timing granularity=100) -> (error out=w193, RX throughput=w194)
        Flush Queue(error in=w193, queue=w187) -> (error out=w190, remaining elements=w195)
        call "802.11 Prepare TX Block Error Rate Measurements.gvi"(TX Status and retransmission data=w195) -> (current TX block error rate=w196, current TX packet error rate=w197, averaged retransmissions per packet=w198, TX Error Rates=w199)
        $"current TX packet error rate" <- w197
        $"current TX block error rate" <- w196
        $"TX Error Rates" <- w199
        $"Averaged Retransmissions per Packet" <- w198
        $"Averaged Retransmissions p. Packet" <- w198
        $"RX Throughput [bits/s]" <- w194
        Divide(x=w194, y=1000000) -> w200
        $"RX Throughput" <- w200
      }
    }
    call "Check Stop.gvi"(error in=w190) -> (error out=w201, stop=w202)
    Wait(time to wait=100)
    next s6 = w201
    stop if w202
  }
  call "Stop On Error.gvi"(error in=s6) -> (error out=w203)
  Array Index(array=w1) -> (out0[_]=w204, out1[_]=w205)
  disable {
    frame TARGET_TYPE == "RT" {
      # NI API CHANGE
      timed loop forever {
        Left Execution System Border Node(priority_in=75, processor_in=2)
        Left Timing Statistics Border Node()
        Left Timing Source Border Node[AlarmName=L, DefaultTimingSourceName="1 kHz", DefaultTimingSourceType=1](period_in=1, structure_in=w204)
        Left Timing Error Border Node(error_in=w8) -> (error_out=w208)
        # MAC High Stub
        Is Not Equal(x=$"Data Source", y="External") -> w209
        Logical And(w209, $"Station Active") -> w210
        case (w210) {
          frame False, Default {
            w211 = w208
          }
          frame True {
            w212 = $session
            Property Node(instance in=w212) -> ("MAC High Requests"=w213)
            Flush Queue(error in=w208, queue=w213) -> (error out=w214, remaining elements=w215)
            Array Subset(array=w215, length0=20) -> w216
            s7 = w214  # shift register
            for (iteration -> i2) {
              w217 = each element of w216
              Property Node(instance in=w212) -> ("station number"=w218, "UDP Sender"=w219)
              Property Node(instance in=w217) -> ("Element 0"=w220)
              Select(s=$"RF loop back demo mode", t=$"Device MAC Address", f=$"Destination MAC Address") -> w221
              call "802.11 Prepare MAC SAP TX Request.gvi"(payload=w220, MCS=$MCS, device MAC address=$"Device MAC Address", destination MAC address=w221, error in=s7, subcarrier format=$"Subcarrier Format") -> (MSDU TX parameters=w222, PHY TX parameters=w223, MSDU TX payload=w224, error out=w225)
              To Unsigned Byte Integer(number=w218) -> w226
              call "802.11 MAC TX Request Confirm Abstraction.gvi"(MSDU TX parameters=w222, PHY TX parameters=w223, MSDU TX payload=w224, error in=w225, UDP connection ID in=w219, instance ID=w226) -> (error out=w227)
              Increment(x=i2) -> w228
              To Unsigned Long Integer(number=w228) -> w229
              Property Node(instance in=cluster{"Config": u32, "Payload": u32} {all zero or empty}, "Config"=w229, "Payload"=w229) -> (instance out=w230)
              next s7 = w227
            }
            Property Node(instance in=w212) -> ("receive queue"=w231, "UDP Receiver RX Indication"=w232, "FPGA interface"=w233)
            Property Node(instance in=w233, error in=w208) -> ("device bandwidth"=w234, error out=w235)
            s8 = w235  # shift register
            while {
              call "802.11 Receive MAC RX Indications.gvi"(UDP interface in=w232, error in=s8, device bandwidth=w234) -> (MSDU data=w237, MSDU data valid=w238, timeout=w239, error out=w240)
              case (w238) {
                frame False, Default {
                  w241 = w240
                }
                frame True {
                  Enqueue Element(element=w237, error in=w240, queue=w231, timeout in ms=-1) -> (error out=w241)
                }
              }
              call "802.11 Clear and Log MAC Middle SAP errors.gvi"(error in=w241) -> (error out=w242)
              append TRUE to w236 if w238
              next s8 = w242
              stop if w239
            }
            Merge Errors(s7, s8) -> (error out=w211)
            Feedback Node(input=w243) -> w244
            Add(w230, w244) -> w243
            $"TX Request High MAC" <- w243
            Array Size(array=w236) -> (size(s)=w245)
            To Unsigned Long Integer(number=w245) -> w246
            Feedback Node(input=w247) -> w248
            Add(w246, w248) -> w247
            $"RX Indications High MAC" <- w247
          }
        }
        Right Timing Error Border Node(error_in=w211) -> (error_out=w249)
      }
      call "Filter Error Code.gvi"(code to clear=-816, error in=w249) -> (error out=w206)
      # NI API CHANGE
      timed loop forever {
        Left Execution System Border Node(priority_in=75, processor_in=3)
        Left Timing Statistics Border Node()
        Left Timing Source Border Node[AlarmName=L, DefaultTimingSourceName="1 kHz", DefaultTimingSourceType=1](period_in=1, structure_in=w205)
        Left Timing Error Border Node(error_in=w8) -> (error_out=w250)
        # Middle MAC SAP
        case ($"Station Active") {
          frame False, Default {
            w251 = w250
          }
          frame True {
            Property Node(instance in=$session) -> ("station number"=w252, "FPGA interface"=w253, "UDP Receiver TX Request"=w254, "UDP Sender"=w255, "Triggered TX Requests"=w256, "receive throughput queue"=w257)
            Is Equal(x=$"Data Source", y="External") -> w258
            To Unsigned Byte Integer(number=w252) -> w259
            call "802.11 MAC SAP TX Request Confirmation Handler.gvi"(FPGA interface=w253, UDP connection TX request=w254, UDP send connection=w255, error in=w250, TX request confirmation reference queue in=w256, external mode=w258, instance ID=w259) -> (error out=w260, num packets to FPGA=w261, num TX Request=w262, num TX Confirmation=w263, num packets dropped=w264)
            $"TX Request Middle MAC" <- w262
            $"TX Confirmation Middle MAC" <- w263
            $"TX Requests to PHY" <- w261
            $"Packets dropped count" <- w264
            Feedback Node(input=w264) -> w265
            Is Not Equal(x=w264, y=w265) -> w266
            $"Packets dropped" <- w266
            call "802.11 Generate MAC SAP TX Status Indication.gvi"(FPGA interface=w253, TX request confirmation reference queue in=w256, instance ID=w259, error in=w250, TX status and retransmission queue=w187, external mode=w258, UDP send connection=w255) -> (num indications received=w267, error out=w268, num indications triggered=w269)
            call "802.11 Generate MAC SAP RX Indication.gvi"(FPGA interface=w253, receive throughput queue=w257, error in=w250, instance ID=w259, UDP send connection=w255, external mode=w258) -> (error out=w270, num indications received=w271, num indications triggered=w272)
            Merge Errors(w260, w268, w270) -> (error out=w251)
            $"TX Indications from PHY" <- w267
            $"TX Indications Middle MAC" <- w269
            $"RX Indications from PHY" <- w271
            $"RX Indications Middle MAC" <- w272
          }
        }
        Right Timing Error Border Node(error_in=w251) -> (error_out=w273)
      }
      call "Filter Error Code.gvi"(code to clear=-816, error in=w273) -> (error out=w207)
    }
    frame TARGET_TYPE != "RT", Default {
      s9 = w8  # shift register
      while {
        # MAC High Stub
        Is Not Equal(x=$"Data Source", y="External") -> w274
        Logical And(w274, $"Station Active") -> w275
        case (w275) {
          frame False, Default {
            w276 = s9
          }
          frame True {
            w277 = $session
            Property Node(instance in=w277) -> ("MAC High Requests"=w278)
            Flush Queue(error in=s9, queue=w278) -> (error out=w279, remaining elements=w280)
            Array Subset(array=w280, length0=200) -> w281
            s10 = w279  # shift register
            for (iteration -> i3) {
              w282 = each element of w281
              Property Node(instance in=w277) -> ("station number"=w283, "UDP Sender"=w284)
              Property Node(instance in=w282) -> ("Element 0"=w285)
              Select(s=$"RF loop back demo mode", t=$"Device MAC Address", f=$"Destination MAC Address") -> w286
              call "802.11 Prepare MAC SAP TX Request.gvi"(payload=w285, MCS=$MCS, device MAC address=$"Device MAC Address", destination MAC address=w286, error in=s10, subcarrier format=$"Subcarrier Format") -> (MSDU TX parameters=w287, PHY TX parameters=w288, MSDU TX payload=w289, error out=w290)
              To Unsigned Byte Integer(number=w283) -> w291
              call "802.11 MAC TX Request Confirm Abstraction.gvi"(MSDU TX parameters=w287, PHY TX parameters=w288, MSDU TX payload=w289, error in=w290, UDP connection ID in=w284, instance ID=w291) -> (error out=w292)
              Increment(x=i3) -> w293
              To Unsigned Long Integer(number=w293) -> w294
              Property Node(instance in=cluster{"Config": u32, "Payload": u32} {all zero or empty}, "Config"=w294, "Payload"=w294) -> (instance out=w295)
              next s10 = w292
            }
            Property Node(instance in=w277) -> ("receive queue"=w296, "UDP Receiver RX Indication"=w297, "FPGA interface"=w298)
            Property Node(instance in=w298, error in=s9) -> ("device bandwidth"=w299, error out=w300)
            s11 = w300  # shift register
            for (N = 200) {
              call "802.11 Receive MAC RX Indications.gvi"(UDP interface in=w297, error in=s11, device bandwidth=w299) -> (MSDU data=w302, MSDU data valid=w303, timeout=w304, error out=w305)
              case (w303) {
                frame False, Default {
                  w306 = w305
                }
                frame True {
                  Enqueue Element(element=w302, error in=w305, queue=w296, timeout in ms=-1) -> (error out=w306)
                }
              }
              call "802.11 Clear and Log MAC Middle SAP errors.gvi"(error in=w306) -> (error out=w307)
              append TRUE to w301 if w303
              next s11 = w307
              stop if w304
            }
            Merge Errors(s10, s11) -> (error out=w276)
            Feedback Node(input=w308) -> w309
            Add(w295, w309) -> w308
            $"TX Request High MAC" <- w308
            Array Size(array=w301) -> (size(s)=w310)
            To Unsigned Long Integer(number=w310) -> w311
            Feedback Node(input=w312) -> w313
            Add(w311, w313) -> w312
            $"RX Indications High MAC" <- w312
          }
        }
        call "Check Stop.gvi"(error in=w276) -> (error out=w314, stop=w315)
        Wait(time to wait=10)
        next s9 = w314
        stop if w315
      }
      s12 = w8  # shift register
      while {
        Wait(time to wait=10)
        # Middle MAC SAP
        case ($"Station Active") {
          frame False, Default {
            w316 = s12
          }
          frame True {
            Property Node(instance in=$session) -> ("station number"=w317, "FPGA interface"=w318, "UDP Receiver TX Request"=w319, "UDP Sender"=w320, "Triggered TX Requests"=w321, "receive throughput queue"=w322)
            Is Equal(x=$"Data Source", y="External") -> w323
            To Unsigned Byte Integer(number=w317) -> w324
            call "802.11 MAC SAP TX Request Confirmation Handler.gvi"(FPGA interface=w318, UDP connection TX request=w319, UDP send connection=w320, error in=s12, TX request confirmation reference queue in=w321, external mode=w323, instance ID=w324) -> (error out=w325, num packets to FPGA=w326, num TX Request=w327, num TX Confirmation=w328, num packets dropped=w329)
            $"TX Request Middle MAC" <- w327
            $"TX Confirmation Middle MAC" <- w328
            $"TX Requests to PHY" <- w326
            $"Packets dropped count" <- w329
            Feedback Node(input=w329) -> w330
            Is Not Equal(x=w329, y=w330) -> w331
            $"Packets dropped" <- w331
            call "802.11 Generate MAC SAP TX Status Indication.gvi"(FPGA interface=w318, TX request confirmation reference queue in=w321, instance ID=w324, error in=s12, TX status and retransmission queue=w187, external mode=w323, UDP send connection=w320) -> (num indications received=w332, error out=w333, num indications triggered=w334)
            call "802.11 Generate MAC SAP RX Indication.gvi"(FPGA interface=w318, receive throughput queue=w322, error in=s12, instance ID=w324, UDP send connection=w320, external mode=w323) -> (error out=w335, num indications received=w336, num indications triggered=w337)
            Merge Errors(w325, w333, w335) -> (error out=w316)
            $"TX Indications from PHY" <- w332
            $"TX Indications Middle MAC" <- w334
            $"RX Indications from PHY" <- w336
            $"RX Indications Middle MAC" <- w337
          }
        }
        call "Check Stop.gvi"(error in=w316) -> (error out=w338, stop=w339)
        next s12 = w338
        stop if w339
      }
      call "Stop On Error.gvi"(error in=s12) -> (error out=w207)
      w206 = s9
    }
  }
  call "Stop On Error.gvi"(error in=w206) -> (error out=w340)
  call "Stop On Error.gvi"(error in=w207) -> (error out=w341)
  Merge Errors(w87, w115, w185, w203, w340, w341) -> (error out=w342)
  sequence {
    frame 0 {
      w343 = $session
    }
  }
  call "802.11 Host Release.gvi"(session=w343, error in=w342) -> (error out=w344)
  call "Simple Error Handler.gvi"(type of dialog="OK message", error in=w344)
