vi "RT Select CPU Core.gvi"   [LabVIEW Communications System Design Suite 2.0.1]
inputs:
  "processor in": i32
  "error in": error
outputs:
  "processor out": i32
  "error out": error
diagram:
  # core auto assignment
  call "RT Get Number of CPUs.gvi"(error in=$"error in") -> (# of CPUs=w1, error out=w2)
  w3 = FALSE  # Multi RAT
  Select(s=w3, t=$"processor in", f=-2) -> w4
  # For Multi-RAT project we use specific CPU core assignments.
  # For the standalone LTE/WIFI projects we use automatic CPU Core assignment.
  case (w1) {
    frame 4, Default {
      w5 = w4
    }
    frame 8 {
      w5 = -2
    }
  }
  $"processor out" <- w5
  $"error out" <- w2
