vi "LTE Host UE.gvi"   [LabVIEW Communications System Design Suite 2.0.1]
# Enqueue an element into the stop notifier if error in indicates an error. Call after each loop on host top level to synchronize host shut down in case of any error.
panel controls:
  "RIO Device": string = "RIO0"  # The RIO address of the RF hardware device
  "UE Transmitter": bool  # Enables or disables the transmitter using the current configuration.
  "UE RX Frequency [Hz]": f64 = 2000000000  # DL RX center frequency, allowed range depends on used RF device.
  "UE Manual Gain [dB]": f64  # Controls the analog RX gain in case UE AGC is switched off.
  "Transmit IP Address": string = "127.0.0.1"  # The IP address the UDP packets received from PDSCH shall be sent to.
  "UDP Transmit Port": u16 = 60001  # The UDP port the UDP packets received from PDSCH shall be sent to.
  "UE AGC": bool = TRUE  # Enables or disables the automated gain control on the receiver side. If enabled the analog RX gain of the RF device will be automatically configured within its valid range to meet a target range for the baseband receive power.
  "stop": bool
  "Reference Clock Source": string = "Internal"  # Configures the Reference Clock source used for the transceiver chain. Internal: Device internal clock REF IN / ClkIn: Clock input at the RF device (i.e. rear connector pane at USRP RIO, front connector pane for NI 579x) PXI_CLK: Backplane clock from the PXI Chassis (NI 579x only) GPS: GPS module (NI USRP RIO 295x only)
  "UE Receiver": bool  # Enables or disables the receiver using the current configuration.
  "UE RX RF Port (USRP)": enum{"RX2/RF0", "RX2/RF1"} = "RX2/RF1"  # Selects the HW RF port the DL RX will be received from (USRP RIO only).
  "symbol number for PDSCH constellation": u8 = 4  # The OFDM symbol number (counting from 0 with symbol 0 being occupied by the PDCCH) used for displaying constellation data for PDSCH IQ samples.
  "throughput select": T2 = "PDSCH (CRC ok)"  # Selects the used values for throughput calculation: PDSCH (overall): the total throughput scheduled by the eNodeB TX regardless of CRC result. PDSCH (CRC ok): the really achieved physical layer throughput, which could be decoded successfully. User data (to UDP): the higher layer throughput (from/to UDP stream) after removing the padding.
  "UE TX Frequency [Hz]": f64 = 1800000000  # UL TX center frequency, allowed range depends on used RF device.
  "UE Max RF TX Power [dBm]": f64 = 10  # Maximum RF transmit output power (upper bound - achievable for a full scale complex sine wave (CW) signal) Note: The actual time-domain RF transmit power depends on the configured resource allocation and is typically at least 15dB lower to allow for the OFDM PAPR backoff.
  "UE TX RF Port (USRP)": enum{"TX1/RF0", "TX1/RF1"} = "TX1/RF0"  # Selects the HW RF port the UL TX will be transmitted on (USRP RIO only).
  "UE TX UE Context": cluster{"RNTI": u16, "SRS Configuration": T3} = {1, TRUE, "0x200", TRUE}
    # UE-specific parameters for UL transmission.
    # RNTI: The radio network temporary identifier used for PUSCH scrambling.
    # SRS Configuration: The configuration used for transmitting sounding reference signal.
    # SRS Enabled: If TRUE, SRS location is reserved as last symbol in each UL subframe (FDD, TDD) and last 2 symbols in each special subframe (TDD) (according to 3GPP TS 36.211 §5.5.3.3: FDD: srs-SubframeConfig = 0, TDD: srs-SubframeConfig = 7).
    # SRS Subframe Allocation: Bitmap determining the subframes actually used for SRS transmission. Periodicity of 10, leftmost bit represents subframe 0.
    # Transmission Comb: Parameter transmissionComb k_TC determining if even (0) or odd (1) subcarriers are used for SRS transmission/reception. See also 3GPP TS 36.211 §5.5.3.2.
  "Timing Advance [samples]": u32  # The applied UL timing advance, i.e. the number of samples the UL TX is started earlier than the DL RX. Given in 30.72 MS/s domain.
  "UE TX Frame Structure": enum{"FDD", "TDD 5 5"} = "FDD"  # Select between FDD (frequency division duplex) and TDD (time division duplex) using subframe configuration 5 and special subframe configuration 5 (3GPP TS 36.211 §4).
  "UE RX Frame Structure": enum{"FDD", "TDD 5 5"} = "FDD"  # Select between FDD (frequency division duplex) and TDD (time division duplex) using subframe configuration 5 and special subframe configuration 5 (3GPP TS 36.211 §4).
  "UE TX Cell ID": u16  # Physical cell ID used for PUSCH scrambling.
  "UE RX Cell ID": u16  # Physical cell ID used for PSS, CRS, UERS sequence generation and PDCCH/PDSCH scrambling. [0…511].
  "UE TX DCI": T6 = {"Active"=TRUE, "MCS"="MCS 9 (QPSK, rate ~0.66)", "Resource Block Allocation (4 PRB/bit)"=33554431}  # Parameters for transmission of PUSCH. MCS: Modulation and coding scheme used for PUSCH transmission according to 3GPP TS 36.213 §7.1.7. Active: Enables or disabled the transmission of the PUSCH. Resource Block Allocation: Resource allocation for PUSCH given as bitmap with each bit representing 4 physical resource blocks (DL resource allocation type 0, 3GPP TS 36.312 §7.1.6.1). Leftmost bit represents lowest resource block index.
  "session": "LTE Host Session.gtype"
  "UE RX UE Context": T12 = {"RNTI"=1, "Use UERS"=FALSE, "Antenna Port"=7, "CCE Offset"=0}
    # UE specific parameters for DL reception.
    # Use UERS: If enabled the DL receiver will use UE specific reference signals for equalizing PDSCH assigned I/Q samples. The usage of UERS is closely related to Transmission Mode 9 defined in the LTE standard 3GPP TS 36.213 §7.1.
    # RNTI: The radio network temporary identifier used for PDSCH scrambling and PDCCH CRC mask check.
    # Antenna Port: The antenna port used for generating UERS for channel estimation, Range: 7…14 according to 3GPP TS 36.213 §7.1.
    # CCE Offset: First control channel element to be used for PDCCH reception. According to 3GPP TS 36.211 §6.8.1/.2.
  "Command": string = "ns3.26-ni-5g-lte-wifi-interworking-optimized"  # Command to execute for external MAC.
  "External MAC": bool = TRUE  # When enabled a program is executed on the RT described by command line and arguments. This switch applies for RT only. When disabled an internal basic MAX will be executed.
  "Tab": i32
  "Stop on API Confirmation Errors": bool
  "Start Extern": bool  # When enabled a program is executed on the RT described by command line and arguments. This switch applies for RT only. When disabled an internal basic MAC will be executed.
  "Show Received Confirmations with external MAC enabled": bool = TRUE
  "Arguments": string[] = ["--numPackets=1000000 --interval=500 --simTime=86400 --transmTime=20 --niApiDevMode=\"NIAPI_MTS\" --niApiWifiEnabled=\"true\" --niApiLteEnabled=\"true\" --niApiEnableLogging=\"true\" --niApiEnableTapBridge=\"false\" --fdDeviceName=\"eth0\" --daliDualConnectivityEnabled=\"true\" --niRemoteControlEnable=\"false\"", "--numPackets=1000000 --interval=500 --simTime=86400 --transmTime=20 --niApiDevMode=\"NIAPI_MTS\" --niApiWifiEnabled=\"true\" --niApiLteEnabled=\"true\" --niApiEnableLogging=\"false\" --niApiEnableTapBridge=\"true\" --fdDeviceName=\"eth0\" --daliDualConnectivityEnabled=\"true\" --niRemoteControlEnable=\"true\""]
  "Cfg Select": i32
panel indicators:
  "FPGA Ready": bool  # Signals that the FPGA bitfile has been downloaded and that the device has been initialized and is ready for configuration. (Initialization can take up to 20 seconds).
  "UE RX Active": bool  # Signals that all UE RX control configurations have been applied and the receiver is running.
  "UE Coerced Gain [dB]": f64  # The actual used analog RX RF gain either set by AGC, if enabled, or by UE Manual Gain Value [dB].
  "UE ADC Values Clipped": bool  # Indicates a numeric overflow at the ADC output (i.e. analog RX RF gain too high or receive power level too high).
  "UE Baseband RX Power [dBFS]": f64  # The measured baseband receive power level in dB full scale.
  "UE RX Power Spectrum": T1  # Shows the power spectrum of the DL RX baseband signal received from RF. If synchronization is successful frequency offset compensation is applied.
  "PDSCH Constellation": c128[]  # Constellation of RX IQ samples allocated for PDSCH transmission after equalization. Only samples for the configured OFDM Symbol-Nr (PDSCH) are displayed.
  "PDCCH Constellation": c128[]  # Constellation of RX IQ samples allocated for PDCCH transmission after equalization.
  "DL throughput": f64[][]
  "UE Failure / Block Error Rate (BLER)": f64[][]  # Numerical and graphical display of error rates for synchronization detection, PDCCH and PDSCH decoding.
  "UE Frequency Offset [Hz]": f64  # The estimated and compensated frequency offset detected in the RX signal.
  "Sync Found": bool  # Indicates that the synchronization module has successfully detected and synchronized to a DL RX signal.
  "UE DDC Values Clipped": bool  # Indicates a numeric overflow at the output of the digital downconversion block (i.e. analog RX RF gain too high or input power level too high).
  "Packet Loss Out": bool  # Indicates that the system loses UDP data due to overload (i.e. data inflow from PDSCH is higher than UDP throughput).
  "channel estimation": f64[][]  # Graphical representation of the normalized channel amplitude and phase estimated on the cell specific reference signals.
  "Data Transfer Out": bool  # Indicates that the configured UDP stream is sending data to the configured Transmit IP Address using Transmit Port.
  "DL throughput (current)": f64  # Numerical and graphical indication of scheduled, successfully decodable and actually used channel capacity. PDSCH (overall): the total throughput scheduled by the eNodeB TX regardless of CRC result. PDSCH (CRC ok): the really achieved physical layer throughput, which could be decoded successfully. User data (to UDP): the higher layer throughput (from/to UDP stream) after removing the padding
  "UE Coerced Max RF TX Power [dBm]": f64  # Indicates the coerced value actually used as maximum RF transmit output power after applying the device’s capabilities (range and resolution limitations) to the configured UE Maximum RF TX Power [dBm].
  "UE TX Power Spectrum": T1  # Shows the power spectrum of the UL TX baseband signal transferred to the RF.
  "UE TX Active": bool  # Signals that all UE TX control configurations have been applied and the transmitter is running.
  "Subband SINR [dB]": f64[]  # The estimated SINR for each subband occupying 8 PRBs. Comparable to Reporting Mode 3-0 in 3GPP TS 36.213 §7.2.1. Usage of CRS or UERS for estimation depends on setting of Use UERS switch in UE RX System Parameters.
  "TX starting": bool
  "UE TX IFFT Output Clipped": bool  # Indicates a numeric overflow after the IFFT.
  "Wideband SINR [dB]": f64  # The estimated SINR over the full 20MHz band using cell specific reference signals.
  "BLER cluster": cluster{"PDSCH": f64, "PDCCH": f64, "sync": f64}
  "UE RF RX Power [dBm]": f64  # The measured time domain receive power at the RX RF port.
  "power calibration offset [dB]": f64
  "PDCCH Received DCI Message": T5[]  # Array of decoded and interpreted downlink control information messages received on PDCCH and applied to PDSCH decoding. Each element corresponds to a DL subframe.
  "Radio Frame Number": u16
  "UE RF TX Power [dBm]": f64  # Actual UE RF transmit power in dBm.
  "UE Baseband TX Power [dBFS]": f64  # Actual UE baseband transmit power level [baseband output power level] in dB full scale.
  "UE Applied Gain [dB]": f64
  "PHY Timing Indication Received": u32
  "TTI": u8
  "SFN": u16
  "L1-L2 Interface active": bool
  "MAC TX Total Delay": u32
  "DL RX Indication CRC OK": bool
  "Error Report": string
  "device bandwidth [MHz]": u16
  "External MAC Output": string
  "Received Confirmations": T13
  "Negatives": u64
  "Evaluation Errors": u32
  "MPDU Disassembly Failed": bool  # specific error cleared? indicates whether the error referenced by specific error code to clear has been cleared.
  "Status": string
  "Max Tim Ind in DMA": u32
  "Num Tim Ind Missed": u32
  "Tim Ind in DMA": u32
types:
  T1 = cluster{"f0": f64, "df": f64, "magnitude": f64[]}
  T2 = enum{"PDSCH (overall)", "PDSCH (CRC ok)", "User data (to UDP)"}
  T3 = cluster{"SRS Enabled": bool, "SRS Subframe Allocation": UFXP(10.0), "Transmission Comb": bool}
  T4 = enum{"MCS 0 (QPSK, rate ~0.12)", "MCS 1 (QPSK, rate ~0.15)", "MCS 2 (QPSK, rate ~0.19)", "MCS 3 (QPSK, rate ~0.25)", "MCS 4 (QPSK, rate ~0.30)", "MCS 5 (QPSK, rate ~0.37)", "MCS 6 (QPSK, rate ~0.44)", "MCS 7 (QPSK, rate ~0.51)", "MCS 8 (QPSK, rate ~0.59)", "MCS 9 (QPSK, rate ~0.66)", "MCS 10 (16-QAM, rate ~0.33)", "MCS 11 (16-QAM, rate ~0.37)", "MCS 12 (16-QAM, rate ~0.42)", "MCS 13 (16-QAM, rate ~0.48)", "MCS 14 (16-QAM, rate ~0.54)", "MCS 15 (16-QAM, rate ~0.60)", "MCS 16 (16-QAM, rate ~0.64)", "MCS 17 (64-QAM, rate ~0.43)", "MCS 18 (64-QAM, rate ~0.46)", "MCS 19 (64-QAM, rate ~0.50)", "MCS 20 (64-QAM, rate ~0.55)", "MCS 21 (64-QAM, rate ~0.60)", "MCS 22 (64-QAM, rate ~0.65)", "MCS 23 (64-QAM, rate ~0.70)", "MCS 24 (64-QAM, rate ~0.75)", "MCS 25 (64-QAM, rate ~0.80)", "MCS 26 (64-QAM, rate ~0.85)", "MCS 27 (64-QAM, rate ~0.89)", "MCS 28 (64-QAM, rate ~0.93)"}
  T5 = cluster{"Valid": bool, "MCS": T4, "Resource Block Allocation (4 PRB/bit)": UFXP(25.0)}
  T6 = cluster{"Active": bool, "MCS": T4, "Resource Block Allocation (4 PRB/bit)": UFXP(25.0)}
  "LTE Transport Session.gtype" = cluster{"FIFO pathname": string, "pipe reader": "Pipe Reader.gtype", "pipe writer": "Pipe Writer.gtype", "transport in RT FIFO": RTFifoRefnum<u8[]>, "transport out RT FIFO": RTFifoRefnum<u8[]>, "transport in timing source name": string, "transport in timing trigger ID": u8, "transport out timing source name": string, "transport out timing trigger ID": u8, "maximum API message size": u32}
  "niInstr Register Bus v0 Host.lvlib__Register Bus Session.gtype" = Queue<"niInstr Register Bus v0 Host.lvlib__Session Data.gtype">
  "Semaphore RefNum.gtype" = i32
  "niUsrpRio Config v1 Host.lvlib__DB Queue Reference.gtype" = Queue<"niUsrpRio Config v1 Host.lvlib__Daughterboard Data.gtype">
  "niUsrpRio Config v1 Host.lvlib__niUsrpRio Session.gtype" = cluster{"FPGA Interface": any, "RIO Interface Number": u32, "Data Clock Rate": u32, "FPGA Data Clock Rate": u32, "Global Settings Register Bus": "niInstr Register Bus v0 Host.lvlib__Register Bus Session.gtype", "Radio 0 Settings Register Bus": "niInstr Register Bus v0 Host.lvlib__Register Bus Session.gtype", "Radio 1 Settings Register Bus": "niInstr Register Bus v0 Host.lvlib__Register Bus Session.gtype", "Radio Settings Bus Semaphore": "Semaphore RefNum.gtype", "DB Queues": "niUsrpRio Config v1 Host.lvlib__DB Queue Reference.gtype"[], "Characterization Data Valid?": bool, "EEPROM Header": "niUsrpRio Config v1 Host.lvlib__EEPROM Header.gtype", "Device Data Header": "niUsrpRio Config v1 Host.lvlib__EEPROM Device Data Header.gtype", "EEPROM Characterization Header": "niUsrpRio Config v1 Host.lvlib__EEPROM Characterization Header.gtype", "Characterization Data": "niUsrpRio Config v1 Host.lvlib__Characterization Data.gtype"[], "FPGA Current Version": u32, "FPGA Oldest Compatible Version": u32, "Fixed Logic Current Version": u32, "Fixed Logic Oldest Compatible Version": u32, "FPGA Radio Settings Bus Current Version": u32, "FPGA Radio Settings Bus Oldest Compatible Version": u32, "FPGA Board Config Current Version": u32, "FPGA Board Config Oldest Compatible Version": u32, "Daughterboard Clock Rate": u32}
  T7 = cluster{"FPGA ref": any, "bus instance": u32, "instruction FIFO depth": u32, "executing on FPGA target": bool, "show error call chain": bool}
  T8 = cluster{"Actual Gain [dB]": f64, "Attenuation Table Index": i32}
  T9 = cluster{"Attenuation Table [dB]": f64[][], "Frequencies [Hz]": f64[], "IQ Imbalance Table": "niUsrpRio Config v1 Host.lvlib__IQ Imbalance.gtype"[], "Gain Table": T8[][]}
  T10 = cluster{"FlexRIO Register Bus": Queue<T7>, "RX Characterization Data": T9, "TX Characterization Data": T9, "FPGA Interface": any}
  T11 = cluster{"transport block size": u32, "CRC ok": bool, "user data": u32}
  "LTE Host Session.gtype" = cluster{"target": enum{"USRP", "FlexRIO"}, "real time mode": bool, "MAC Stub enabled": bool, "DMA FIFO read timeout": i32, "timed loop period": i64, "LTE Transport Sessions": "LTE Transport Session.gtype"[], "USRP session": "niUsrpRio Config v1 Host.lvlib__niUsrpRio Session.gtype", "FlexRIO session": T10, "UDP RX session": UdpNetworkConnectionRefnum, "UDP TX session": UdpNetworkConnectionRefnum, "sync found queue": Queue<bool>, "PDCCH CRC ok queue": Queue<bool>, "DL PDCCH status queue": Queue<cluster{"CRC ok": bool, "subframe number": u32}>, "DL PDSCH status queue": Queue<cluster{"CRC ok": bool, "subframe number": u32}>, "DL SINR queue": Queue<f64[]>, "PDSCH user data queue": Queue<u32>, "PDSCH user data UDP queue": Queue<T11>, "PDSCH user data throughput queue": Queue<T11>, "PUSCH user data queue": Queue<u32>, "PUSCH user data UDP queue": Queue<T11>, "PUSCH user data throughput queue": Queue<T11>, "UE feedback info FIFO": RTFifoRefnum<u8[]>, "Request information FIFO": RTFifoRefnum<"LTE Request Information.gtype">, "UDP TX outbound FIFO": RTFifoRefnum<u8[]>, "UDP RX inbound FIFO": RTFifoRefnum<u8[]>, "stop notifier": Notifier<string>, "DL RX scope": string, "UL RX scope": string, "external MAC log file": string, "external MAC process ID": u32}
  T12 = cluster{"RNTI": u16, "Use UERS": bool, "Antenna Port": UFXP(4.0), "CCE Offset": u8}
  "LTE Confirmation States.gtype" = enum{"Success", "Unknown Message", "Message not Supported", "Unknown Parameter (Set)", "Missing Parameter (Set)", "Parameter (Set) Repetition", "Range Violation", "State Violation", "Timeout", "Config Payload Mismatch", "Length Mismatch", "Input Buffer Full", "Internal Error", "Instance ID Mismatch"}
  T13 = cluster{"Element 1": "LTE Confirmation States.gtype"[], "Value": u64[]}
  "DTP Send Status.gtype" = cluster{"send packet counter": u32, "network too slow counter": u32}
  "DTP Pending Data.gtype" = cluster{"expected size": u32, "payload": u8[]}
diagram:
  sequence {
    frame 0 {
      # Set Controls to default values
      $"L1-L2 Interface active" <- FALSE
      $"UE Transmitter" <- FALSE
      $"UE Receiver" <- FALSE
      $"FPGA Ready" <- FALSE
      $"UE RX Active" <- FALSE
      $"UE TX Active" <- FALSE
      $"TX starting" <- FALSE
      $"Sync Found" <- FALSE
      $"PDSCH Constellation" <- c128[] []
      $"PDCCH Constellation" <- c128[] []
      Build Array(f64[] [], f64[] [], f64[] []) -> w1
      $"DL throughput" <- w1
      $"UE Failure / Block Error Rate (BLER)" <- w1
      $"channel estimation" <- w1
      $"UE RX Power Spectrum" <- T1 {all zero or empty}
      $"UE TX Power Spectrum" <- T1 {all zero or empty}
      $"UE Coerced Max RF TX Power [dBm]" <- 0
      $"UE Coerced Gain [dB]" <- 0
      $"Wideband SINR [dB]" <- 0
      $"DL throughput (current)" <- 0
      $"Subband SINR [dB]" <- f64[] []
      $"PDCCH Received DCI Message" <- T5[] []
      $"Error Report" <- ""
      $Status <- ""
    }
  }
  call "RT Startup Create Notifier.gvi"(Error In=no error) -> (Error Out=w2)
  # NI API CHANGE
  s1 = w2  # shift register
  while {
    Wait Until Next Multiple(multiple to wait=100)
    call "RT Startup Receive Notivication.gvi"(error in=s1) -> (error out=w3, notification=w4)
    $Status <- w4
    Is Equal(x=w4, y="System Init Complete!") -> w5
    next s1 = w3
    stop if w5
  }
  Array Index(array=$Arguments) -> (out0[$"Cfg Select"]=w6)
  call "LTE UE Host Initialization.gvi"(USRP device=$"RIO Device", session in=$session, error in=w2, reference clock source=$"Reference Clock Source", start externally=$"Start Extern", external MAC=$"External MAC", command=$Command, arguments=w6) -> (error out=w7, session out=w8, device bandwidth=w9)
  sequence {
    frame 0 {
      $session <- w8
      call "Display Error.gvi"(type of dialog="continue or stop message", error in=w7)
      $"L1-L2 Interface active" <- TRUE
    }
  }
  disable {
    frame TARGET_TYPE == "RT", Default {
      # Transport layer moves packets from L1 to MAC Stub implementation or external MAC
      call "LTE Transport.gvi"(session=w8, error in=w7) -> (error out=w11)
      call "LTE Get Transport Session.gvi"(Session=w8, Transport Session Select="Transport PHY Timing to MAC") -> (LTE Transport Session=w12, Session dup=w13)
      # NI API CHANGE
      call "RT Select CPU Core.gvi"(processor in=1, error in=w7) -> (processor out=w14, error out=w15)
      Property Node(instance in=w12) -> ("transport out timing source name"=w16)
      w17 = 100  # priority in
      timed loop {
        # MAC Stub: handle TX messages
        Left Execution System Border Node(priority_in=w17, processor_in=w14)
        Left Timing Source Border Node[AlarmName=L, DefaultTimingSourceName="1 MHz", DefaultTimingSourceType=2](mode_in="Process missed periods, ignore original phase", period_in=1, source_in=w16, structure_in="MAC Stub Tx")
        call "LTE Get Transport Session.gvi"(Session=w13, Transport Session Select="Transport PHY Timing to MAC") -> (LTE Transport Session=w18, Session dup=w19)
        Left Timing Error Border Node(error_in=w15) -> (error_out=w20)
        call "LTE Transport Read From Transport.gvi"(API transport session=w18, error in=w20, allow read fail=$"L1-L2 Interface active") -> (transport out=w21, transport read success=w22, error out=w23)
        case (w22) {
          frame False {
            w24 = w23
          }
          frame True {
            call "LTE PHY Receive Timing Indication.gvi"(api transport in=w21, error in=w23) -> (SFN=w25, TTI index=w26, error out=w27)
            call "LTE Check Subframe for Transmit.gvi"(frame structure=$"UE TX Frame Structure", subframe index=w26, UL TX=TRUE, error in=w27) -> (allow UL transmit=w28, error out=w29)
            case (w28) {
              frame False, Default {
                w24 = w29
              }
              frame True {
                call "LTE MAC Prepare UL Tx Config.gvi"(SFN=w25, TTI index=w26) -> (MAC TX Config=w30)
                call "LTE Receive Feedback Information.gvi"(session=w19, error in=w29) -> (feedback info=w31, error out=w32)
                Array Size(array=w31) -> (size(s)=w33)
                Is Greater Than 0(x=w33) -> w34
                case (w34) {
                  frame False, Default {
                    w24 = w32
                  }
                  frame True {
                    To Unsigned Long Integer(number=w33) -> w35
                    call "LTE PHY TX Request Confirm Abstraction.gvi"(MAC TX Config=w30, MAC PDU Size=w35, MAC PDU=w31, Device Location="UE", error in=w32) -> (api transport out=w36, error out=w37, requests=w38)
                    Property Node(instance in=w19) -> ("Request information FIFO"=w39, instance out=w40)
                    call "LTE MAC Enque Requests.gvi"(RT FIFO reference=w39, requests=w38, error in=w37) -> (error out=w41)
                    call "LTE Get Transport Session.gvi"(Session=w40, Transport Session Select="Transport MAC to PHY") -> (LTE Transport Session=w42)
                    call "LTE Transport Send To Transport.gvi"(API transport session=w42, transport in=w36, error in=w41) -> (error out=w24)
                  }
                }
              }
            }
          }
        }
        Right Timing Error Border Node(error_in=w24) -> (error_out=w43)
        Left Timing Statistics Border Node() -> (wakeupreason_out=w44)
        continue if $"L1-L2 Interface active"
      }
      call "LTE Remove Timed Loop Abort Error.gvi"(error in=w43, wake up reason=w44) -> (error out=w45)
      call "Stop On Error.gvi"(error in=w45, error source prefix="MAC Stub Tx") -> (error out=w46)
      call "LTE Get Transport Session.gvi"(Session=w8, Transport Session Select="Transport PHY to MAC") -> (LTE Transport Session=w47, Session dup=w48)
      # NI API CHANGE
      call "RT Select CPU Core.gvi"(processor in=2, error in=w7) -> (processor out=w49, error out=w50)
      Property Node(instance in=w47) -> ("transport out timing source name"=w51)
      w52 = 98  # priority in
      timed loop {
        # MAC Stub: handle RX messages
        Left Execution System Border Node(priority_in=w52, processor_in=w49)
        Left Timing Source Border Node[AlarmName=L, DefaultTimingSourceName="1 MHz", DefaultTimingSourceType=2](mode_in="Process missed periods, ignore original phase", period_in=1, source_in=w51, structure_in="MAC Stub Rx")
        call "LTE Get Transport Session.gvi"(Session=w48, Transport Session Select="Transport PHY to MAC") -> (LTE Transport Session=w53, Session dup=w54)
        Left Timing Error Border Node(error_in=w50) -> (error_out=w55)
        call "LTE Transport Read From Transport.gvi"(API transport session=w53, error in=w55, allow read fail=$"L1-L2 Interface active") -> (transport out=w56, transport read success=w57, error out=w58)
        case (w57) {
          frame False {
            w59 = w58
          }
          frame True {
            call "LTE Decode General Message Header.gvi"(message data in=w56, error in=w58) -> (decoded general message header=w60, error out=w61)
            Property Node(instance in=w60) -> ("message type ID"=w62)
            case (w62) {
              frame 0, Default {
                call "Build Error Cluster.gvi"(code=-1, description="MAC Stub Rx: unexpected API message", error in=w61) -> (error out=w59)
              }
              frame 16898 {
                # PHY_CNF
                Property Node(instance in=w54) -> ("Request information FIFO"=w63)
                Not(x=$"Stop on API Confirmation Errors") -> w64
                call "LTE Handle DL TX Confirm.gvi"(RT FIFO reference=w63, api transport in=w56, error in=w61, clear confirmation errors=w64) -> (error out=w59, confirm received counts=w65, confirmation evaluation error count=w66, negative confirm received count=w67)
                $"Received Confirmations" <- w65
                $Negatives <- w67
                $"Evaluation Errors" <- w66
              }
              frame 18433 {
                call "LTE PHY Receive RX Indication.gvi"(api transport in=w56, expected device location="UE", error in=w61) -> (MAC RX Config=w68, MAC PDU=w69, error out=w70)
                # PHY_DLSCH_RX_IND
                Property Node(instance in=w68) -> ("CRC Result"=w71)
                Is Greater Than 0(x=w71) -> w72
                case (w72) {
                  frame False, Default {
                    w59 = w70
                  }
                  frame True {
                    Property Node(instance in=w54) -> ("UDP RX inbound FIFO"=w73, instance out=w74)
                    call "LTE MAC PDU Disassembly.gvi"(MAC PDU=w69, error in=w70, FIFO in=w73) -> (bytes=w75, error out=w76)
                    call "Filter Error Code.gvi"(code to clear=-1, error in=w76) -> (error cleared?=w77, error out=w78)
                    case (w77) {
                      frame True {
                        w59 = w78
                      }
                      frame False {
                        Property Node(instance in=w74) -> ("PDSCH user data queue"=w79)
                        To Unsigned Long Integer(number=w75) -> w80
                        Scale By Power Of 2(n=3, x=w80) -> w81
                        Enqueue Element(element=w81, error in=w78, queue=w79, timeout in ms=0) -> (error out=w59)
                      }
                    }
                    $"MPDU Disassembly Failed" <- w77
                  }
                }
                $"DL RX Indication CRC OK" <- w72
              }
            }
          }
        }
        Right Timing Error Border Node(error_in=w59) -> (error_out=w82)
        Left Timing Statistics Border Node() -> (wakeupreason_out=w83)
        continue if $"L1-L2 Interface active"
      }
      call "LTE Remove Timed Loop Abort Error.gvi"(error in=w82, wake up reason=w83) -> (error out=w84)
      call "Stop On Error.gvi"(error in=w84, error source prefix="MAC Stub Rx") -> (error out=w85)
      # NI API CHANGE
      call "RT Select CPU Core.gvi"(processor in=1, error in=w7) -> (processor out=w86, error out=w87)
      w88 = 100  # priority in
      Property Node(instance in=w8) -> ("timed loop period"=w89, instance out=w90)
      timed loop {
        Left Execution System Border Node(priority_in=w88, processor_in=w86)
        # handle TTI timing indication every 1ms
        Left Timing Statistics Border Node()
        Left Timing Error Border Node(error_in=w87) -> (error_out=w91)
        call "LTE Receive Timing Indication RT.gvi"(session=w90, error in=w91, eNB TX Active=$"UE TX Active") -> (error out=w92, subframe index=w93, subframe index valid=w94, DMA max elements remaining=w95, Num Tim Ind Missed=w96, DMA elements remaining=w97)
        $"Num Tim Ind Missed" <- w96
        case (w94) {
          frame False {
            w98 = w92
            w99 = w94
            w100 = w90
          }
          frame True, Default {
            call "Get Time.gvi"(error in_2=w92) -> (tick count (us)=w101, error out_2=w102)
            call "LTE TTI Counter to SFN and TTI.gvi"(TTI counter=w93, error in=w102) -> (SFN=w103, TTI=w104, error out=w105)
            call "Counter U16 Dominant Increment.gvi"() -> (count out=w106)
            call "LTE Encode PHY SAP Timing Indication.gvi"(reference ID=w106, SFN=w103, TTI index=w104, error in=w105) -> (encoded PHY SAP Timing Indication=w107, error out=w108)
            call "LTE Get Transport Session.gvi"(Session=w90, Transport Session Select="Transport PHY Timing to MAC") -> (LTE Transport Session=w109, Session dup=w100)
            call "LTE Transport Send To Transport.gvi"(API transport session=w109, transport in=w107, error in=w108) -> (error out=w98)
            $SFN <- w103
            $TTI <- w104
            $"PHY Timing Indication Received" <- w101
            w99 = w94
          }
        }
        Logical And(w99, $"UE RX Active") -> w110
        case (w110) {
          frame False, Default {
            w111 = w98
          }
          frame True {
            call "LTE Send Dynamic DL RX Configuration.gvi"(session=w100, UE context=$"UE RX UE Context", error in=w98) -> (error out=w111)
          }
        }
        Right Timing Error Border Node(error_in=w111) -> (error_out=w112)
        Left Timing Source Border Node[AlarmName=L, DefaultTimingSourceName="1 MHz", DefaultTimingSourceType=2](mode_in="Discard missed periods, ignore original phase", period_in=w89, structure_in="PHY SAP Tim")
        $"Tim Ind in DMA" <- w97
        # NI API CHANGE
        $"Max Tim Ind in DMA" <- w95
        continue if $"L1-L2 Interface active"
      }
      call "Stop On Error.gvi"(error in=w112, error source prefix="PHY SAP Tim") -> (error out=w113)
      call "LTE Get Transport Session.gvi"(Session=w8, Transport Session Select="Transport MAC to PHY") -> (LTE Transport Session=w114, Session dup=w115)
      Property Node(instance in=w114) -> ("transport out timing source name"=w116)
      w117 = 99  # priority in
      # NI API CHANGE
      call "RT Select CPU Core.gvi"(processor in=1, error in=w7) -> (processor out=w118, error out=w119)
      timed loop {
        # handover Tx Req to FPGA
        Left Execution System Border Node(priority_in=w117, processor_in=w118)
        Left Timing Statistics Border Node()
        call "LTE Get Transport Session.gvi"(Session=w115, Transport Session Select="Transport MAC to PHY") -> (LTE Transport Session=w120, Session dup=w121)
        Left Timing Error Border Node(error_in=w119) -> (error_out=w122)
        call "LTE Transport Read From Transport.gvi"(API transport session=w120, error in=w122, allow read fail=$"L1-L2 Interface active") -> (transport out=w123, transport read success=w124, error out=w125)
        call "Get Time.gvi"(error in=w125) -> (error out=w126, tick count (us)=w127)
        Subtract(x=w127, y=$"PHY Timing Indication Received") -> w128
        # reserve time buffer to transmit TX data to FPGA
        w129 = 700  # maximal allowed TX processing time [us]
        Is Greater(x=w128, y=w129) -> w130
        case (w124) {
          frame True {
            call "LTE PHY TX Request Confirm Handler.gvi"(api transport in=w123, Expected SFN=$SFN, Expected TTI index=$TTI, Expected Device Location="UE", error in=w126, frame structure=$"UE TX Frame Structure", use UERS=FALSE, UE TX DCI=$"UE TX DCI", TX request too late=w130) -> (TX Data=w133, error out=w134, api transport out=w135, output valid=w136)
            Logical And(w136, $"UE TX Active") -> w132
            case (w132) {
              frame False, Default {
                w137 = w134
                w138 = w121
              }
              frame True {
                call "LTE Send Dynamic UL Configuration.gvi"(UE context=$"UE TX UE Context", DCI=$"UE TX DCI", scope="TX", session=w121, error in=w134) -> (error out=w139, session dup=w140)
                call "LTE Send Dynamic UL Tx Payload.gvi"(session in=w140, TX data=w133, error in=w139) -> (error out=w137, session out=w138)
              }
            }
            Property Node(instance in=w138) -> ("Request information FIFO"=w141, "MAC Stub enabled"=w142)
            Array Size(array=w135) -> (size(s)=w143)
            Is Greater Than 0(x=w143) -> w144
            Logical And(not w142, $"Show Received Confirmations with external MAC enabled") -> w145
            case (w144) {
              frame False, Default {
                call "Build Error Cluster.gvi"(code=-1, description="Confirmation message response is empty.", error in=w137) -> (error out=w131)
              }
              frame True {
                call "LTE Get Transport Session.gvi"(Session=w138, Transport Session Select="Transport PHY to MAC") -> (LTE Transport Session=w146)
                call "LTE Transport Send To Transport.gvi"(API transport session=w146, transport in=w135, error in=w137) -> (error out=w131)
                # NI API CHANGE
                case (w145) {
                  frame False { }
                  frame True {
                    call "LTE Handle DL TX Confirm.gvi"(RT FIFO reference=w141, api transport in=w135, clear confirmation errors=TRUE) -> (confirm received counts=w147, negative confirm received count=w148)
                    $"Received Confirmations" <- w147
                    $Negatives <- w148
                  }
                }
              }
            }
          }
          frame False {
            w131 = w126
            w132 = w124
          }
        }
        call "Get Time.gvi"(error in=w131) -> (error out=w149, tick count (us)=w150)
        Right Timing Error Border Node(error_in=w149) -> (error_out=w151)
        case (w132) {
          frame True {
            Subtract(x=w150, y=$"PHY Timing Indication Received") -> w152
            call "Get and Hold Maximum.gvi"(value=w152) -> (max value=w153)
            $"MAC TX Total Delay" <- w153
          }
          frame False { }
        }
        Left Timing Source Border Node[AlarmName=L, DefaultTimingSourceName="1 MHz", DefaultTimingSourceType=2](mode_in="Process missed periods, ignore original phase", period_in=1, source_in=w116, structure_in="PHY SAP Tx")
        continue if $"L1-L2 Interface active"
      }
      call "Stop On Error.gvi"(error in=w151, error source prefix="PHY SAP Tx") -> (error out=w154)
      # NI API CHANGE
      call "RT Select CPU Core.gvi"(processor in=2, error in=w7) -> (processor out=w155, error out=w156)
      Property Node(instance in=w8) -> ("timed loop period"=w157, instance out=w158)
      w159 = 98  # priority in
      timed loop {
        Left Execution System Border Node(priority_in=w159, processor_in=w155)
        Left Timing Statistics Border Node()
        Left Timing Error Border Node(error_in=w156) -> (error_out=w160)
        call "LTE Receice PDSCH Decoding Status.gvi"(session=w158, error in=w160) -> (PDSCH Decoding Status valid=w161, PDSCH Decoding Status=w162, error out=w163)
        case (w161) {
          frame False, Default {
            w164 = w163
          }
          frame True {
            Property Node(instance in=w158) -> ("DL PDSCH status queue"=w165, "PDSCH user data throughput queue"=w166, instance out=w167)
            Property Node(instance in=w167) -> ("MAC Stub enabled"=w168, instance out=w169)
            call "LTE Get Transport Session.gvi"(Session=w167, Transport Session Select="Transport PHY to MAC") -> (LTE Transport Session=w170)
            call "LTE PDSCH Channel Decoder Status from U32.gvi"(bit vector in=w162, valid in=TRUE) -> (PDSCH decoder status=w171)
            Property Node(instance in=w171) -> ("user data"=w172, "transport block size"=w173, "CRC ok"=w174)
            Enqueue Element(element=w171, error in=w163, queue=w166, timeout in ms=0) -> (error out=w175)
            Property Node(instance in=w171) -> ("CRC ok"=w176, "user data"=w177)
            w178 = cluster{"CRC ok": bool, "subframe number": u32} {all zero or empty}
            Property Node(instance in=w178, "CRC ok"=w176, "subframe number"=w177) -> (instance out=w179)
            Enqueue Element(element=w179, error in=w175, queue=w165, timeout in ms=0) -> (error out=w180)
            call "LTE Receive PDSCH MAC PDU.gvi"(session=w167, transport block size=w173, error in=w180) -> (MAC PDU=w181, error out=w182)
            Property Node(instance in=$"UE RX UE Context") -> ("RNTI"=w183)
            To Unsigned Byte Integer(number=w172) -> w184
            call "Counter U16 Dominant Increment.gvi"() -> (count out=w185)
            Boolean To Integer(Boolean=w174) -> (0, 1=w186)
            To Unsigned Byte Integer(number=w186) -> w187
            Array Size(array=w181) -> (size(s)=w188)
            To Unsigned Long Integer(number=w188) -> w189
            call "LTE Encode PHY SAP DL RX Indication.gvi"(reference ID=w185, SFN=0, TTI index=w184, MAC PDU=w181, MAC PDU Size=w189, RNTI=w183, CRC Result=w187) -> (encoded UL RX Indication=w190)
            call "LTE Transport Send To Transport.gvi"(API transport session=w170, transport in=w190, error in=w182) -> (error out=w191)
            case (w168) {
              frame False, Default {
                call "LTE Receive Feedback Information.gvi"(session=w169, error in=w191) -> (feedback info=w192, error out=w193, valid=w194)
                # external MAC
                # NI API Change
                case (w194) {
                  frame False, Default {
                    w164 = w193
                  }
                  frame True {
                    call "Counter U16 Dominant Increment.gvi"() -> (count out=w195)
                    call "LTE Interpret PUSCH Payload.gvi"(PUSCH payload=w192) -> (radioframe number=w196, subband SNR=w197, wideband SNR=w198)
                    call "LTE Encode PHY SAP Cell Measurement Indication.gvi"(reference ID=w195, SFN=w196, TTI index=0, subband SNR=w197, wideband SNR=w198, Cell ID=$"UE RX Cell ID") -> (encoded UL RX Indication=w199, message body length=w200)
                    call "LTE Transport Send To Transport.gvi"(API transport session=w170, transport in=w199, error in=w193) -> (error out=w164)
                  }
                }
              }
              frame True {
                # MAC Stub mode
                # - measurements handled completely in MAC Stub
                # - no API measage needed
                w164 = w191
              }
            }
          }
        }
        Right Timing Error Border Node(error_in=w164) -> (error_out=w201)
        Left Timing Source Border Node[AlarmName=L, DefaultTimingSourceName="1 MHz", DefaultTimingSourceType=2](mode_in="Discard missed periods, ignore original phase", period_in=w157, structure_in="PHY SAP Rx")
        continue if $"L1-L2 Interface active"
      }
      call "Stop On Error.gvi"(error in=w201, error source prefix="PHY SAP Rx") -> (error out=w202)
      s2 = w7  # shift register
      while {
        Wait(time to wait=1)
        Property Node(instance in=$session) -> ("UDP RX session"=w203, "UDP RX inbound FIFO"=w204)
        s3 = s2  # shift register
        while {
          RTFIFO Read(error in=s3, rt fifo=w204, timeout in ms=0) -> (element out=w207, empty?=w208, error out=w209)
          Array Size(array=w207) -> (size(s)=w210)
          case (w208) {
            frame True {
              w211 = w209
              w212 = default
            }
            frame False {
              Udp Write Binary(address=$"Transmit IP Address", connection ID=w203, data in=w207, error in=w209, port or service name=$"UDP Transmit Port", timeout ms=0) -> (error out=w213)
              w214 = 55  # UDP timeout
              call "Clear Errors.gvi"(specific error code to clear=w214, error in=w213) -> (specific error cleared?=w212, error out=w211)
            }
          }
          call "Is Error.gvi"(error in=w211) -> (is error?=w215)
          Logical Or(w215, w208) -> w216
          append w212 to w205
          append w210 to w206
          next s3 = w211
          stop if w216
        }
        Add Array Elements(numeric array=w206) -> (sum=w217)
        Scale By Power Of 2(n=3, x=w217) -> w218
        Is Greater Than 0(x=w218) -> w219
        $"Data Transfer Out" <- w219
        Or Array Elements(Boolean array=w205) -> (logical OR=w220)
        $"Packet Loss Out" <- w220
        call "Check Stop.gvi"(error in=s3) -> (error out=w221, stop=w222)
        next s2 = w221
        stop if w222
      }
      call "Stop On Error.gvi"(error in=s2) -> (error out=w223)
      Build Array[ConcatenateInputs=True](w46, w85, w11, w113, w154, w202, w223) -> w10
    }
    frame TARGET_TYPE != "RT" {
      s4 = w7  # shift register
      s5 = "DTP Send Status.gtype" {all zero or empty}  # shift register
      s6 = "DTP Pending Data.gtype" {all zero or empty}  # shift register
      while {
        # receive UDP data from network and send it to the FPGA as PDSCH payload data of the transmitter
        # read received PDSCH payload data from FPGA and send it to the specified UDP port
        Wait Until Next Multiple(multiple to wait=0)
        call "LTE Send UDP Data.gvi"(transmit port=$"UDP Transmit Port", transmit IP address=$"Transmit IP Address", session=$session, enable MAC RX=TRUE, error in=s4, pending data in=s6, UDP send status in=s5) -> (error out=w224, network too slow=w225, transferring data=w226, pending data out=w227, UDP send status out=w228)
        $"Data Transfer Out" <- w226
        # 5
        call "Check Stop.gvi"(error in=w224) -> (error out=w229, stop=w230)
        $"Packet Loss Out" <- w225
        next s4 = w229
        next s5 = w228
        next s6 = w227
        stop if w230
      }
      call "Stop On Error.gvi"(error in=s4) -> (error out=w231)
      s7 = w7  # shift register
      while {
        # send dynamic parameters to FPGA
        case ($"UE TX Active") {
          frame False, Default {
            Wait(time to wait=10)
            w232 = s7
            w233 = TRUE
          }
          frame True {
            call "LTE Receive Timing Indication.gvi"(session=$session, error in=s7) -> (session dup=w234, error out=w235, new timing indication=w233)
            case (w233) {
              frame False, Default {
                w232 = w235
              }
              frame True {
                call "LTE Send Dynamic UL Configuration.gvi"(UE context=$"UE TX UE Context", DCI=$"UE TX DCI", scope="TX", session=w234, error in=w235) -> (error out=w232)
              }
            }
          }
        }
        Logical And(w233, $"UE RX Active") -> w236
        case (w236) {
          frame False, Default {
            w237 = w232
          }
          frame True {
            call "LTE Send Dynamic DL RX Configuration.gvi"(session=$session, UE context=$"UE RX UE Context", error in=w232) -> (error out=w237)
          }
        }
        # 5
        call "Check Stop.gvi"(error in=w237) -> (error out=w238, stop=w239)
        next s7 = w238
        stop if w239
      }
      call "Stop On Error.gvi"(error in=s7) -> (error out=w240)
      Build Array(w231, w240) -> w10
    }
  }
  s8 = w7  # shift register
  while {
    Wait Until Next Multiple(multiple to wait=100)
    Feedback Node[DelayCount=3](input=w241) -> w242
    call "LTE Determine Configuration Trigger.gvi"(RX enabled=$"UE Receiver", TX enabled=$"UE Transmitter") -> (trigger RX configuration=w243, trigger TX configuration=w244)
    # configure UE RX/TX baseband and RF when enabled
    # 1
    case (w243) {
      frame False, Default {
        w245 = s8
      }
      frame True {
        case ($"UE Receiver") {
          frame False, Default {
            call "LTE Disable DL RX.gvi"(session=$session, error in=s8) -> (error out=w245)
            sequence {
              frame 0 {
                $"UE RX Active" <- FALSE
              }
            }
          }
          frame True {
            Property Node(instance in=$session) -> ("real time mode"=w246)
            call "LTE Setup DL RX Baseband.gvi"(frame structure=$"UE RX Frame Structure", session in=$session, error in=s8, cell ID=$"UE RX Cell ID", UE context=$"UE RX UE Context", real time mode=w246) -> (error out=w247, session dup=w248)
            call "LTE Setup RX.gvi"(session in=w248, RX port=$"UE RX RF Port (USRP)", error in=w247, RX frequency [Hz]=$"UE RX Frequency [Hz]", gain value [dB]=$"UE Coerced Gain [dB]", LTE scope="DL") -> (session out=w249, coerced gain [dB]=w250, error out=w251, coerced frequency [Hz]=w252)
            $session <- w249
            $"UE Coerced Gain [dB]" <- w250
            $"UE RX Frequency [Hz]" <- w252
            case (w251) {
              frame Error {
                $"UE Receiver" <- FALSE
                w245 = w251
              }
              frame No Error {
                $"UE RX Active" <- TRUE
                disable {
                  frame TARGET_TYPE == "RT", Default {
                    # For RT, TX triggers RX configuration
                    $"UE Transmitter" <- TRUE
                  }
                  frame TARGET_TYPE != "RT" { }
                }
                w245 = w251
              }
            }
          }
        }
      }
    }
    case (w244) {
      frame False, Default {
        w253 = s8
      }
      frame True {
        case ($"UE Transmitter") {
          frame False, Default {
            sequence {
              frame 0 {
                $"UE TX Active" <- FALSE
              }
              frame 1 {
                Wait(time to wait=10)
              }
            }
            call "LTE Disable UL TX.gvi"(session=$session, error in=s8) -> (error out=w254)
            disable {
              frame TARGET_TYPE == "RT", Default {
                # For RT, disable also RX configuration
                $"UE Receiver" <- FALSE
                w253 = w254
              }
              frame TARGET_TYPE != "RT" {
                w253 = w254
              }
            }
          }
          frame True {
            case (s8) {
              frame Error {
                w255 = s8
              }
              frame No Error {
                $"TX starting" <- TRUE
                w255 = s8
              }
            }
            Property Node(instance in=$session) -> ("real time mode"=w256)
            call "LTE Setup UL TX Baseband.gvi"(UL frequency [Hz]=$"UE TX Frequency [Hz]", session in=$session, frame structure=$"UE TX Frame Structure", cell ID=$"UE TX Cell ID", DCI=$"UE TX DCI", error in=w255, DL frequency [Hz]=$"UE RX Frequency [Hz]", UE Context=$"UE TX UE Context", real time mode=w256) -> (session dup=w257, error out=w258)
            call "LTE Setup TX.gvi"(session in=w257, TX frequency [Hz]=$"UE TX Frequency [Hz]", TX power level [dB]=$"UE Max RF TX Power [dBm]", TX port=$"UE TX RF Port (USRP)", error in=w258, LTE scope="UL", timing advance=$"Timing Advance [samples]") -> (coerced output power [dB]=w259, error out=w260, session dup=w261, coerced frequency [Hz]=w262, coerced power level setting [dB]=w263)
            $"UE Coerced Max RF TX Power [dBm]" <- w259
            case (w260) {
              frame No Error, Default {
                $"UE TX Active" <- TRUE
                $"TX starting" <- FALSE
                call "LTE Setup UL TX Set Active.gvi"(session in=w261, error in=w260) -> (error out=w253)
              }
              frame Error {
                $"UE Transmitter" <- FALSE
                $"TX starting" <- FALSE
                w253 = w260
              }
            }
            $"UE TX Frequency [Hz]" <- w262
            $"UE Max RF TX Power [dBm]" <- w263
          }
        }
      }
    }
    Merge Errors(w245, w253) -> (error out=w264)
    # synchronize the exit condition across all loops of the host application
    call "Create Stop.gvi"(error in=w264, stop in=$stop) -> (error out=w265)
    call "Check Stop.gvi"(error in=w265) -> (error out=w266, stop=w241)
    Not(x=w241) -> w267
    # Disable TX and RX to
    # ensure proper shutdown
    $"L1-L2 Interface active" <- w267
    case (s8) {
      frame Error { }
      frame No Error {
        $"FPGA Ready" <- TRUE
      }
    }
    case (w241) {
      frame False, Default { }
      frame True {
        $"UE Receiver" <- FALSE
        $"UE Transmitter" <- FALSE
      }
    }
    next s8 = w266
    stop if w242
  }
  call "Stop On Error.gvi"(error in=s8) -> (error out=w268)
  s9 = w7  # shift register
  while (iteration -> i1) {
    Wait Until Next Multiple(multiple to wait=50)
    disable {
      frame TARGET_TYPE == "RT", Default {
        w269 = $session
        w270 = s9
      }
      frame TARGET_TYPE != "RT" {
        call "LTE Read PDSCH Decoder Status.gvi"(session in=$session, error in=s9) -> (error out=w270, session dup=w269)
      }
    }
    call "LTE Get ADC and IFFT Status.gvi"(session in=w269, error in=w270) -> (ADC values clipped=w271, error out=w272, TX IFFT output clipped=w273, RX DDC values clipped=w274, session dup=w275)
    call "LTE Read DL BB Power and sync status.gvi"(error in=w272, session in=w275) -> (session dup=w276, error out=w277, RX baseband input power=w278, DL frequency offset [Hz]=w279, signal detected?=w280)
    call "LTE Read TX BB Power.gvi"(error in=w277, session in=w276, TX reference level [dBm]=$"UE Coerced Max RF TX Power [dBm]", LTE scope="UL") -> (session dup=w281, error out=w282, TX power [dBm]=w283, TX baseband power [dBFS]=w284)
    call "LTE Calculate Power Calibration Offset.gvi"(session in=w281, frequency [Hz]=$"UE RX Frequency [Hz]", error in=w282, LTE scope="DL") -> (session dup=w285, power calibration offset [dB]=w286, error out=w287)
    $"power calibration offset [dB]" <- w286
    Not(x=$"UE AGC") -> w288
    call "LTE Control Power Gain.gvi"(expected signal range lower bound=-17, use manual gain=w288, BB input power=w278, gain in=$"UE Coerced Gain [dB]", manual gain value [dB]=$"UE Manual Gain [dB]", expected signal range upper bound=-15, power calibration offset [dB]=w286) -> (RF input power [dBm]=w289, power [dBFS]=w290, gain out=w291)
    # read sync status and baseband power levels from FPGA and feed them into automatic gain control (AGC)
    # use manual gain value if AGC is disabled
    # configure frequency offset on FPGA
    # read PDSCH decoder status
    Logical And($"UE Receiver", $"UE RX Active", not $"TX starting") -> w292
    # 2
    case (w292) {
      frame False, Default {
        w293 = w287
      }
      frame True {
        call "LTE Apply AGC Output.gvi"(session=w285, LTE scope="DL", error in=w287, apply values=w292, AGC output=w291) -> (coerced gain [dB]=w294, error out=w293)
        $"UE Coerced Gain [dB]" <- w294
      }
    }
    call "Check Stop.gvi"(error in=w293) -> (error out=w295, stop=w296)
    $"UE RF TX Power [dBm]" <- w283
    $"UE Baseband TX Power [dBFS]" <- w284
    $"UE Baseband RX Power [dBFS]" <- w290
    $"UE RF RX Power [dBm]" <- w289
    $"UE Frequency Offset [Hz]" <- w279
    $"Sync Found" <- w280
    $"UE ADC Values Clipped" <- w271
    $"UE TX IFFT Output Clipped" <- w273
    To Unsigned Long Integer(number=i1) -> w297
    Quotient And Remainder(x=w297, y=10) -> (x-y*floor(x/y)=w298)
    Is Equal To 0(x=w298) -> w299
    Logical Or(w274, w299) -> w300
    Feedback Node(enable?=w300, input=w274) -> w301
    Feedback Node(enable?=w299, input=w301) -> w302
    $"UE DDC Values Clipped" <- w302
    next s9 = w295
    stop if w296
  }
  call "Stop On Error.gvi"(error in=s9) -> (error out=w303)
  s10 = w7  # shift register
  while (iteration -> i2) {
    Wait Until Next Multiple(multiple to wait=20)
    Quotient And Remainder(x=i2, y=5) -> (x-y*floor(x/y)=w304)
    # read RX/TX baseband data values and PDCCH/PDSCH constellation data from FPGA and draw corresponding diagrams
    # 3
    case (w304) {
      frame 0, Default {
        # NI API CHANGE
        case ($"External MAC") {
          frame True {
            w305 = s10
          }
          frame False {
            call "LTE Read TX Data.gvi"(session=$session, error in=s10) -> (error out=w306, TX baseband data=w307)
            call "LTE Calculate TX Power Spectrum.gvi"(TX data=w307, error in=w306, coerced gain [dB]=$"UE Coerced Max RF TX Power [dBm]") -> (TX power spectrum=w308, error out=w305)
            $"UE TX Power Spectrum" <- w308
          }
        }
      }
      frame 1 {
        # NI API CHANGE
        case ($"External MAC") {
          frame True {
            w305 = s10
          }
          frame False {
            call "LTE Read RX Data.gvi"(session=$session, error in=s10) -> (RX data=w309, error out=w310)
            call "LTE Calculate RX Power Spectrum.gvi"(RX data=w309, coerced gain [dB]=$"UE Coerced Gain [dB]", error in=w310, power calibration offset [dB]=$"power calibration offset [dB]") -> (RX power spectrum=w311, error out=w305)
            $"UE RX Power Spectrum" <- w311
          }
        }
      }
      frame 2 {
        case ($"External MAC") {
          frame False, Default {
            w312 = s10
          }
          frame True {
            call "LTE Read External MAC Output.gvi"(session=$session, error in=s10, full log=FALSE) -> (external MAC log output=w313, error out=w312)
            $"External MAC Output" <- w313
          }
        }
        case (TRUE) {
          frame False, Default {
            w314 = s10
          }
          frame True {
            call "LTE Read PDCCH Data.gvi"(session in=$session, error in=s10) -> (DCI messages=w315, error out=w314)
            $"PDCCH Received DCI Message" <- w315
          }
        }
        Merge Errors(w312, w314) -> (error out=w305)
      }
      frame 3 {
        # NI API CHANGE
        case ($"External MAC") {
          frame True {
            w305 = s10
          }
          frame False {
            call "LTE Read Constellation Data.gvi"(session=$session, error in=s10, symbol number for display=$"symbol number for PDSCH constellation", RX tab=$Tab) -> (constellation data=w316, display data out=w317, error out=w305, displayed constellation=w318)
            case (w317) {
              frame False, Default { }
              frame True {
                case (w318) {
                  frame "DL EQ Output", Default {
                    $"PDCCH Constellation" <- w316
                  }
                  frame "PDSCH Dec Input" {
                    $"PDSCH Constellation" <- w316
                  }
                }
              }
            }
          }
        }
      }
      frame 4 {
        call "LTE Read Channel Estimates.gvi"(session=$session, error in=s10, UE Context=$"UE RX UE Context") -> (channel estimation=w319, error out=w305, subband SNR [dB]=w320, wideband SNR [dB]=w321)
        $"channel estimation" <- w319
        $"Subband SINR [dB]" <- w320
        $"Wideband SINR [dB]" <- w321
      }
    }
    call "Check Stop.gvi"(error in=w305) -> (error out=w322, stop=w323)
    next s10 = w322
    stop if w323
  }
  sequence {
    frame 0 {
      call "LTE Read External MAC Output.gvi"(session=$session, error in=s10, full log=TRUE) -> (external MAC log output=w324, error out=w325)
      $"External MAC Output" <- w324
    }
  }
  call "Stop On Error.gvi"(error in=w325) -> (error out=w326)
  s11 = 0  # shift register
  s12 = w7  # shift register
  s13 = f64[] []  # shift register
  while {
    Wait Until Next Multiple(multiple to wait=1000)
    # compute throughput and block error rate and draw corresponding diagrams
    Tick Count() -> (timer value=w327)
    Subtract(x=w327, y=s11) -> w328
    call "LTE Calculate DL Throughput and BLER.gvi"(time difference=w328, session=$session, error in=s12, DL throughput previous=s13, throughput select=$"throughput select") -> (DL throughput (current)=w329, DL throughput averaged=w330, DL BLER=w331, BLER cluster=w332, error out=w333, DL throughput current=w334)
    # 4
    case ($"UE RX Active") {
      frame False, Default { }
      frame True {
        $"DL throughput (current)" <- w329
        $"DL throughput" <- w330
        $"UE Failure / Block Error Rate (BLER)" <- w331
      }
    }
    call "Check Stop.gvi"(error in=w333) -> (error out=w335, stop=w336)
    $"BLER cluster" <- w332
    next s11 = w327
    next s12 = w335
    next s13 = w334
    stop if w336
  }
  call "Stop On Error.gvi"(error in=s12) -> (error out=w337)
  s14 = w7  # shift register
  while (iteration -> i3) {
    Quotient And Remainder(x=i3, y=1024) -> (x-y*floor(x/y)=w338)
    To Unsigned Word Integer(number=w338) -> w339
    $"Radio Frame Number" <- w339
    Wait Until Next Multiple(multiple to wait=0)
    # compute feedback information and send it to the FPGA as PUSCH payload data of the transmitter
    call "LTE Compute Feedback Information.gvi"(radioframe number=w339, session=$session, error in=s14) -> (error out=w340, feedback info=w341, session dup=w342)
    call "LTE Send Feedback Information.gvi"(feedback info=w341, session=w342, error in=w340, UL TX active=$"UE TX Active") -> (error out=w343)
    call "Check Stop.gvi"(error in=w343) -> (error out=w344, stop=w345)
    next s14 = w344
    stop if w345
  }
  call "Stop On Error.gvi"(error in=s14) -> (error out=w346)
  Build Array[ConcatenateInputs=True](w268, w303, w326, w337, w346, w10) -> w347
  sequence (after w347) {
    frame 0 {
      # NI API CHANGE
      call "RT Startup Send Notification.gvi"(Error In=s1, Notification="System Stopped!") -> (Error Out=w348)
      call "RT Startup Destroy Notifier.gvi"(error in=w348)
    }
  }
  # NI API CHANGE
  call "LTE Read External MAC Output.gvi"(session=w8, full log=TRUE) -> (external MAC log output=w349)
  $"External MAC Output" <- w349
  sequence {
    frame 0 {
      call "LTE UE Host Cleanup.gvi"(session=$session, error in=no error) -> (error out=w350)
      Build Array[ConcatenateInputs=True](w347, w350) -> w351
      $"FPGA Ready" <- FALSE
    }
  }
  call "LTE Generate Error Report.gvi"(error in=w351) -> (error report=w352, error occured=w353)
  $"Error Report" <- w352
  case (w353) {
    frame False, Default { }
    frame True {
      # Switch to status tab
      # in case of error
      $Tab <- 2
    }
  }
  $"device bandwidth [MHz]" <- w9
