vi "LTE Host eNodeB.gvi"   [LabVIEW Communications System Design Suite 2.0.1]
panel controls:
  "RIO Device": string = "RIO0"  # The RIO address of the RF hardware device
  "eNB TX Frequency [Hz]": f64 = 2000000000  # DL TX center frequency, allowed range depends on used RF device
  "eNB Max RF TX Power [dBm]": f64 = 10  # Maximum RF transmit output power (upper bound - achievable for a full scale complex sine wave (CW) signal) Note: The actual time-domain RF transmit power depends on the configured resource allocation and is typically at least 15dB lower to allow for the OFDM PAPR backoff.
  "UDP Receive Port": u16 = 50001  # The UDP port the host monitors for incoming packets to be transferred to the FPGA PDSCH chain.
  "Reference Clock Source": string = "Internal"  # Configures the Reference Clock source used for the transceiver chain. Internal: Device internal clock REF IN / ClkIn: Clock input at the RF device (i.e. rear connector pane at USRP RIO, front connector pane for NI 579x) PXI_CLK: Backplane clock from the PXI Chassis (NI 579x only) GPS: GPS module (NI USRP RIO 295x only)
  "stop": bool
  "eNB TX RF Port (USRP)": enum{"TX1/RF0", "TX1/RF1"} = "TX1/RF0"  # Selects the HW RF port where the DL TX is transmitted (USRP RIO only).
  "eNB RX Frequency [Hz]": f64 = 1800000000  # UL RX center frequency, allowed range depends on used RF device
  "symbol number for PUSCH constellation": u8 = 4  # The OFDM symbol number used for displaying constellation data for PUSCH IQ samples.
  "eNB RX RF Port (USRP)": enum{"RX2/RF0", "RX2/RF1"} = "RX2/RF1"  # Selects the HW RF port the UL RX will be received from (USRP RIO only)
  "eNB Transmitter": bool  # Enables or disables the transmitter using the current configuration.
  "eNB Receiver": bool  # Enables or disables the receiver using the current configuration.
  "eNB Manual Gain [dB]": f64  # Controls the analog RX gain in case eNB AGC is switched off.
  "eNB AGC": bool = TRUE  # Enables or disables the automated gain control on the receiver side. If enabled the analog RX gain of the RF device will be automatically configured within its valid range to meet a target range for the baseband receive power.
  "Rate Adaption": bool  # If enabled, eNB TX MCS is automatically adapted to reported/measured Wideband SINR [dB] to handle with channel quality fluctuations. The adaptation is calibrated so that the applied MCS produces about 5% to 10% BLER under current MCS conditions. If that is not desired, SINR Offset [dB] needs to be modified.
  "SINR Offset [dB]": f64 = 3  # This value is effectively subtracted from the reported SINR before looking up the MCS in the adaptation table (i.e. if a positive offset is configured, a higher reported SINR is required to adapt to a certain MCS to avoid block errors).
  "eNB TX UE Context": T2 = {"RNTI"=1, "Use UERS"=FALSE, "Antenna Port"=7, "CCE Offset"=0}
    # UE specific parameters for DL transmission.
    # USE UERS: If enabled, the DL transmitter feeds UE-specific reference signals into the PDSCH data stream. The usage of UERS is closely related to Transmission Mode 9 defined in the LTE standard 3GPP TS 36.213 §7.1.
    # RNTI: The radio network temporary identifier used for PDSCH scrambling and PDCCH CRC mask generation.
    # Antenna Port: The antenna port used for generating UERS, Range: 7…14 according to 3GPP TS 36.213 §7.1.
    # CCE Offset: First control channel element to be used for PDCCH transmission. According to 3GPP TS 36.211 §6.8.1/.2.
  "eNB RX UE Context": cluster{"RNTI": u16, "SRS Configuration": T3} = {1, TRUE, "0x200", TRUE}
    # UE-specific parameters for UL reception.
    # RNTI: The radio network temporary identifier used for PUSCH scrambling.
    # SRS Configuration: The configuration used for receiving sounding reference signals.
    # SRS Enabled: If TRUE, SRS location is reserved as last symbol in each UL subframe (FDD, TDD) and last 2 symbols in each special subframe (TDD) (according to 3GPP TS 36.211 §5.5.3.3: FDD: srs-SubframeConfig = 0, TDD: srs-SubframeConfig = 7).
    # SRS Subframe Allocation: Bitmap determining the subframes actually used for SRS transmission. Periodicity of 10, leftmost bit represents subframe 0.
    # Transmission Comb: Parameter transmissionComb k_TC determining if even (0) or odd (1) subcarriers are used for SRS transmission/reception. See also 3GPP TS 36.211 §5.5.3.2.
  "eNB TX Frame Structure": enum{"FDD", "TDD 5 5"} = "FDD"  # Select between frequency division duplex (FDD) and time division duplex (TDD) using subframe configuration 5 and special subframe configuration 5 (3GPP TS 36.211 §4)
  "eNB RX Frame Structure": enum{"FDD", "TDD 5 5"} = "FDD"  # Select between FDD (frequency division duplex) and TDD (time division duplex) using subframe configuration 5 and special subframe configuration 5 (3GPP TS 36.211 §4).
  "eNB RX Cell ID": u16  # The physical Cell ID used for PUSCH scrambling
  "eNB TX Cell ID": u16  # Physical cell ID used for PSS, CRS, UERS sequence generation and PDCCH/PDSCH scrambling. [0…511].
  "eNB TX DCI": T5 = {"Active"=TRUE, "MCS"="MCS 17 (64-QAM, rate ~0.43)", "Resource Block Allocation (4 PRB/bit)"=8388607}  # Downlink control information for the PDCCH content and the PDSCH transmission. MCS: Modulation and coding scheme used for PDSCH transmission according to 3GPP TS 36.213 §7.1.7 Active: Enables or Disables the transmission of PDCCH and PDSCH. Resource Block Allocation: Resource allocation given as bitmap with each bit representing four physical resource blocks (DL resource allocation type 0, 3GPP TS 36.213 §7.1.6.1). The left-most bit represents lowest resource block index.
  "eNB RX DCI": T5 = {"Active"=TRUE, "MCS"="MCS 9 (QPSK, rate ~0.66)", "Resource Block Allocation (4 PRB/bit)"=33554431}  # Parameters for reception of PUSCH. MCS: Modulation and coding scheme used for PUSCH reception according to 3GPP TS 36.213 §7.1.7. Active: Enables or disabled the reception of the PUSCH. Resource Block Allocation: Resource allocation for PUSCH given as bitmap with each bit representing 4 physical resource blocks (DL resource allocation type 0, 3GPP TS 36.312 §7.1.6.1). Leftmost bit represents lowest resource block index.
  "eNB Timing Offset": i32  # Changes the eNodeB timing (start of radio frame). Given in 30.72MS/s.
  "session": "LTE Host Session.gtype"
  "Command": string = "ns3.26-ni-5g-lte-wifi-interworking-optimized"  # Command to execute for external MAC
  "External MAC": bool = TRUE  # When enabled a program is executed on the RT described by command line and arguments. This switch applies for RT only. When disabled an internal basic MAC will be executed.
  "Stop on API Confirmation Errors": bool
  "Start Extern": bool  # When enabled a program is executed on the RT described by command line and arguments. This switch applies for RT only. When disabled an internal basic MAC will be executed.
  "Show Received Confirmations with external MAC enabled": bool = TRUE
  "Arguments": string[] = ["--numPackets=1000000 --interval=500 --simTime=86400 --transmTime=20 --niApiDevMode=\"NIAPI_MBS\" --niApiWifiEnabled=\"true\" --niApiLteEnabled=\"true\" --niApiEnableLogging=\"true\" --niApiEnableTapBridge=\"false\" --lwaactivate=0 --lwipactivate=0 --dcactivate=0 --fdDeviceName=\"eth0\" --daliDualConnectivityEnabled=\"true\" --dualConnectivityLaunchTime=\"30\" --niRemoteControlEnable=\"false\"", "--numPackets=1000000 --interval=500 --simTime=86400 --transmTime=20 --niApiDevMode=\"NIAPI_MBS\" --niApiWifiEnabled=\"true\" --niApiLteEnabled=\"true\" --niApiEnableLogging=\"false\" --niApiEnableTapBridge=\"true\" --lwaactivate=0 --lwipactivate=0 --dcactivate=0 --fdDeviceName=\"eth0\" --daliDualConnectivityEnabled=\"true\" --dualConnectivityLaunchTime=\"1\" --niRemoteControlEnable=\"true\""]
  "Cfg Select": i32
panel indicators:
  "FPGA Ready": bool  # Signals that the FPGA bitfile has been downloaded and that the device has been initialized and is ready for configuration. (Initialization can take up to 20 seconds.).
  "eNB TX Active": bool  # Signals that all eNB TX control configurations have been applied and the transmitter is running.
  "eNB Coerced Max RF TX Power [dBm]": f64  # Indicates the coerced value actually used as maximum RF transmit output power level after applying the device’s capabilities (range and resolution limitations) to the configured eNB Maximum RF TX Power [dBm].
  "Data Transfer In": bool  # Indicates that the configured UDP stream is receiving data on the configured Receive Port.
  "Packet Loss In": bool  # Indicates that the system loses UDP data due to overload. Data inflow from UDP port is higher than configured PDSCH throughput.
  "eNB TX Power Spectrum": T1  # Shows the power spectrum of the DL TX baseband signal transferred to the RF.
  "eNB Coerced Gain [dB]": f64  # The actual used analog RX RF gain either set by AGC, if enabled, or by UE Manual Gain Value [dB]
  "eNB ADC Values Clipped": bool  # Indicates a numeric overflow at the ADC output. Overflows can be caused when the analog RX RF gain too high or the receive power level too high.
  "eNB Baseband RX Power [dBFS]": f64
  "eNB DDC Values Clipped": bool  # Indicates a numeric overflow at the output of the digital downconversion block Overflows can be caused when the analog RX RF gain too high or the receive power level too high.
  "eNB RX Power Spectrum": T1  # Shows the power spectrum of the UL RX baseband signal received from RF.
  "PUSCH Constellation": c128[]  # Constellation of RX IQ samples allocated for PUSCH transmission after equalization. Only samples for the configured OFDM Symbol-Nr (PUSCH) are displayed.
  "eNB Failure / Block Error Rate (BLER)": f64  # Graphical display of PUSCH reception block error rate.
  "eNB RX Active": bool  # Signals that all eNB RX control configurations have been applied and the receiver is running.
  "PUSCH Throughput [Mbps]": f64  # The achieved throughput on the PUSCH channel.
  "Radio Frame Number": u16  # The number of the latest successfully received report ranging from 0…1023.
  "Reported DL ACK/NACK": enum{"NACK", "ACK", "DTX"}[]  # Array showing the latest received DL ACK/NACK report from UE side.
  "Average DL error rate": f64
  "Reported DL Block Error Rate": f64  # Graphical and numerical representation of the DL receiver block error rate on the UE side reported back to the eNodeB.
  "TX starting": bool
  "eNB TX IFFT Output Clipped": bool  # Indicates a numeric overflow after the IFFT.
  "eNB RF RX Power [dBm]": f64
  "power calibration offset [dB]": f64
  "Reported Subband SINR [dB]": f64[]  # The reported SINR for each subband occupying 8 PRBs. Comparable to Reporting Mode 3-0 in 3GPP TS 36.213 §7.2.1. Usage of CRS or UERS for estimation depends on setting of Use UERS switch in UE RX System Parameters on the UE side
  "Reported WB SINR": f64  # The reported SINR over the full 20MHz band using cell specific reference signals.
  "eNB RF TX Power [dBm]": f64  # Actual eNB RF transmit power in dBm.
  "eNB Baseband TX Power [dBFS]": f64  # Actual eNB baseband transmit power level [baseband output power level] in dB full scale.
  "PUSCH BLER (current)": f64
  "eNB Applied Gain [dB]": f64
  "L1-L2 Interface active": bool
  "PHY Timing Indication Received": u32
  "TTI": u8
  "SFN": u16
  "Max MAC TX Delay": u32
  "Error Report": string
  "UL RX Indication CRC OK": bool
  "Evaluation Errors": u32
  "Negatives": u64
  "Tab": i32
  "device bandwidth [MHz]": u16
  "External MAC Output": string
  "IP Packets Size Exeeded Count": u32
  "Received Confirmations": T11
  "Status": string
  "Max Tim Ind in DMA": u32
  "Num Tim Ind Missed": u32
  "Tim Ind in DMA": u32
types:
  T1 = cluster{"f0": f64, "df": f64, "magnitude": f64[]}
  T2 = cluster{"RNTI": u16, "Use UERS": bool, "Antenna Port": UFXP(4.0), "CCE Offset": u8}
  T3 = cluster{"SRS Enabled": bool, "SRS Subframe Allocation": UFXP(10.0), "Transmission Comb": bool}
  T4 = enum{"MCS 0 (QPSK, rate ~0.12)", "MCS 1 (QPSK, rate ~0.15)", "MCS 2 (QPSK, rate ~0.19)", "MCS 3 (QPSK, rate ~0.25)", "MCS 4 (QPSK, rate ~0.30)", "MCS 5 (QPSK, rate ~0.37)", "MCS 6 (QPSK, rate ~0.44)", "MCS 7 (QPSK, rate ~0.51)", "MCS 8 (QPSK, rate ~0.59)", "MCS 9 (QPSK, rate ~0.66)", "MCS 10 (16-QAM, rate ~0.33)", "MCS 11 (16-QAM, rate ~0.37)", "MCS 12 (16-QAM, rate ~0.42)", "MCS 13 (16-QAM, rate ~0.48)", "MCS 14 (16-QAM, rate ~0.54)", "MCS 15 (16-QAM, rate ~0.60)", "MCS 16 (16-QAM, rate ~0.64)", "MCS 17 (64-QAM, rate ~0.43)", "MCS 18 (64-QAM, rate ~0.46)", "MCS 19 (64-QAM, rate ~0.50)", "MCS 20 (64-QAM, rate ~0.55)", "MCS 21 (64-QAM, rate ~0.60)", "MCS 22 (64-QAM, rate ~0.65)", "MCS 23 (64-QAM, rate ~0.70)", "MCS 24 (64-QAM, rate ~0.75)", "MCS 25 (64-QAM, rate ~0.80)", "MCS 26 (64-QAM, rate ~0.85)", "MCS 27 (64-QAM, rate ~0.89)", "MCS 28 (64-QAM, rate ~0.93)"}
  T5 = cluster{"Active": bool, "MCS": T4, "Resource Block Allocation (4 PRB/bit)": UFXP(25.0)}
  "LTE Transport Session.gtype" = cluster{"FIFO pathname": string, "pipe reader": "Pipe Reader.gtype", "pipe writer": "Pipe Writer.gtype", "transport in RT FIFO": RTFifoRefnum<u8[]>, "transport out RT FIFO": RTFifoRefnum<u8[]>, "transport in timing source name": string, "transport in timing trigger ID": u8, "transport out timing source name": string, "transport out timing trigger ID": u8, "maximum API message size": u32}
  "niInstr Register Bus v0 Host.lvlib__Register Bus Session.gtype" = Queue<"niInstr Register Bus v0 Host.lvlib__Session Data.gtype">
  "Semaphore RefNum.gtype" = i32
  "niUsrpRio Config v1 Host.lvlib__DB Queue Reference.gtype" = Queue<"niUsrpRio Config v1 Host.lvlib__Daughterboard Data.gtype">
  "niUsrpRio Config v1 Host.lvlib__niUsrpRio Session.gtype" = cluster{"FPGA Interface": any, "RIO Interface Number": u32, "Data Clock Rate": u32, "FPGA Data Clock Rate": u32, "Global Settings Register Bus": "niInstr Register Bus v0 Host.lvlib__Register Bus Session.gtype", "Radio 0 Settings Register Bus": "niInstr Register Bus v0 Host.lvlib__Register Bus Session.gtype", "Radio 1 Settings Register Bus": "niInstr Register Bus v0 Host.lvlib__Register Bus Session.gtype", "Radio Settings Bus Semaphore": "Semaphore RefNum.gtype", "DB Queues": "niUsrpRio Config v1 Host.lvlib__DB Queue Reference.gtype"[], "Characterization Data Valid?": bool, "EEPROM Header": "niUsrpRio Config v1 Host.lvlib__EEPROM Header.gtype", "Device Data Header": "niUsrpRio Config v1 Host.lvlib__EEPROM Device Data Header.gtype", "EEPROM Characterization Header": "niUsrpRio Config v1 Host.lvlib__EEPROM Characterization Header.gtype", "Characterization Data": "niUsrpRio Config v1 Host.lvlib__Characterization Data.gtype"[], "FPGA Current Version": u32, "FPGA Oldest Compatible Version": u32, "Fixed Logic Current Version": u32, "Fixed Logic Oldest Compatible Version": u32, "FPGA Radio Settings Bus Current Version": u32, "FPGA Radio Settings Bus Oldest Compatible Version": u32, "FPGA Board Config Current Version": u32, "FPGA Board Config Oldest Compatible Version": u32, "Daughterboard Clock Rate": u32}
  T6 = cluster{"FPGA ref": any, "bus instance": u32, "instruction FIFO depth": u32, "executing on FPGA target": bool, "show error call chain": bool}
  T7 = cluster{"Actual Gain [dB]": f64, "Attenuation Table Index": i32}
  T8 = cluster{"Attenuation Table [dB]": f64[][], "Frequencies [Hz]": f64[], "IQ Imbalance Table": "niUsrpRio Config v1 Host.lvlib__IQ Imbalance.gtype"[], "Gain Table": T7[][]}
  T9 = cluster{"FlexRIO Register Bus": Queue<T6>, "RX Characterization Data": T8, "TX Characterization Data": T8, "FPGA Interface": any}
  T10 = cluster{"transport block size": u32, "CRC ok": bool, "user data": u32}
  "LTE Host Session.gtype" = cluster{"target": enum{"USRP", "FlexRIO"}, "real time mode": bool, "MAC Stub enabled": bool, "DMA FIFO read timeout": i32, "timed loop period": i64, "LTE Transport Sessions": "LTE Transport Session.gtype"[], "USRP session": "niUsrpRio Config v1 Host.lvlib__niUsrpRio Session.gtype", "FlexRIO session": T9, "UDP RX session": UdpNetworkConnectionRefnum, "UDP TX session": UdpNetworkConnectionRefnum, "sync found queue": Queue<bool>, "PDCCH CRC ok queue": Queue<bool>, "DL PDCCH status queue": Queue<cluster{"CRC ok": bool, "subframe number": u32}>, "DL PDSCH status queue": Queue<cluster{"CRC ok": bool, "subframe number": u32}>, "DL SINR queue": Queue<f64[]>, "PDSCH user data queue": Queue<u32>, "PDSCH user data UDP queue": Queue<T10>, "PDSCH user data throughput queue": Queue<T10>, "PUSCH user data queue": Queue<u32>, "PUSCH user data UDP queue": Queue<T10>, "PUSCH user data throughput queue": Queue<T10>, "UE feedback info FIFO": RTFifoRefnum<u8[]>, "Request information FIFO": RTFifoRefnum<"LTE Request Information.gtype">, "UDP TX outbound FIFO": RTFifoRefnum<u8[]>, "UDP RX inbound FIFO": RTFifoRefnum<u8[]>, "stop notifier": Notifier<string>, "DL RX scope": string, "UL RX scope": string, "external MAC log file": string, "external MAC process ID": u32}
  "LTE Confirmation States.gtype" = enum{"Success", "Unknown Message", "Message not Supported", "Unknown Parameter (Set)", "Missing Parameter (Set)", "Parameter (Set) Repetition", "Range Violation", "State Violation", "Timeout", "Config Payload Mismatch", "Length Mismatch", "Input Buffer Full", "Internal Error", "Instance ID Mismatch"}
  T11 = cluster{"Element 1": "LTE Confirmation States.gtype"[], "Value": u64[]}
diagram:
  sequence {
    frame 0 {
      # Set Controls to default values
      $"L1-L2 Interface active" <- FALSE
      $"eNB Transmitter" <- FALSE
      $"eNB Receiver" <- FALSE
      $"FPGA Ready" <- FALSE
      $"eNB RX Active" <- FALSE
      $"eNB TX Active" <- FALSE
      $"TX starting" <- FALSE
      $"eNB TX Power Spectrum" <- T1 {all zero or empty}
      $"eNB RX Power Spectrum" <- T1 {all zero or empty}
      $"eNB Coerced Gain [dB]" <- 0
      $"eNB Coerced Max RF TX Power [dBm]" <- 0
      $"PUSCH Throughput [Mbps]" <- 0
      $"Reported WB SINR" <- 0
      $"Average DL error rate" <- 0
      $"eNB Failure / Block Error Rate (BLER)" <- 0
      $"Reported DL Block Error Rate" <- 0
      $"Reported Subband SINR [dB]" <- f64[] []
      $"PUSCH Constellation" <- c128[] []
      $"Radio Frame Number" <- 0
      $"Reported DL ACK/NACK" <- enum{"NACK", "ACK", "DTX"}[] []
      $"Error Report" <- ""
      $Status <- ""
    }
  }
  call "RT Startup Create Notifier.gvi"(Error In=no error) -> (Error Out=w1)
  # NI API CHANGE
  s1 = w1  # shift register
  while {
    Wait Until Next Multiple(multiple to wait=100)
    call "RT Startup Receive Notivication.gvi"(error in=s1) -> (error out=w2, notification=w3)
    $Status <- w3
    Is Equal(x=w3, y="System Init Complete!") -> w4
    next s1 = w2
    stop if w4
  }
  Array Index(array=$Arguments) -> (out0[$"Cfg Select"]=w5)
  call "LTE eNodeB Host Initialization.gvi"(USRP device=$"RIO Device", session in=$session, error in=w1, reference clock source=$"Reference Clock Source", start externally=$"Start Extern", external MAC=$"External MAC", command=$Command, arguments=w5) -> (error out=w6, session=w7, device bandwidth=w8)
  sequence {
    frame 0 {
      $session <- w7
      call "Display Error.gvi"(type of dialog="continue or stop message", error in=w6)
      $"L1-L2 Interface active" <- TRUE
    }
  }
  disable {
    frame TARGET_TYPE == "RT", Default {
      # Transport layer moves packets from L1 to MAC Stub implementation or external MAC
      call "LTE Transport.gvi"(session=w7, error in=w6) -> (error out=w10)
      call "LTE Get Transport Session.gvi"(Session=w7, Transport Session Select="Transport PHY Timing to MAC") -> (LTE Transport Session=w11, Session dup=w12)
      Property Node(instance in=w11) -> ("transport out timing source name"=w13)
      w14 = 100  # priority in
      # NI API CHANGE
      call "RT Select CPU Core.gvi"(processor in=1, error in=w6) -> (processor out=w15, error out=w16)
      timed loop {
        Left Execution System Border Node(priority_in=w14, processor_in=w15)
        Left Timing Statistics Border Node() -> (wakeupreason_out=w17)
        call "LTE Get Transport Session.gvi"(Session=w12, Transport Session Select="Transport PHY Timing to MAC") -> (LTE Transport Session=w18, Session dup=w19)
        Left Timing Error Border Node(error_in=w16) -> (error_out=w20)
        call "LTE Transport Read From Transport.gvi"(API transport session=w18, error in=w20, allow read fail=$"L1-L2 Interface active") -> (transport out=w21, transport read success=w22, error out=w23)
        case (w22) {
          frame False {
            w24 = w23
          }
          frame True {
            call "LTE PHY Receive Timing Indication.gvi"(api transport in=w21, error in=w23) -> (SFN=w25, TTI index=w26, error out=w27)
            call "LTE Check Subframe for Transmit.gvi"(frame structure=$"eNB TX Frame Structure", subframe index=w26, UL TX=FALSE, error in=w27) -> (allow DL transmit=w28, error out=w29)
            case (w28) {
              frame False, Default {
                w24 = w29
              }
              frame True {
                w30 = 200  # maximal execution time MPU assembly
                Property Node(instance in=w19) -> ("UDP TX outbound FIFO"=w31, instance out=w32)
                case ($"Rate Adaption") {
                  frame False, Default {
                    w33 = $"eNB TX DCI"
                    w34 = w29
                    w35 = $"eNB TX UE Context"
                    w36 = $"eNB TX Frame Structure"
                    w37 = w25
                    w38 = w26
                  }
                  frame True {
                    call "LTE MCS Regulation.gvi"(SNR offset [dB]=$"SINR Offset [dB]", wideband SNR=$"Reported WB SINR", DCI in=$"eNB TX DCI", UE context=$"eNB TX UE Context") -> (DCI out=w33)
                    $"eNB TX DCI" <- w33
                    w34 = w29
                    w35 = $"eNB TX UE Context"
                    w36 = $"eNB TX Frame Structure"
                    w37 = w25
                    w38 = w26
                  }
                }
                call "LTE MAC Prepare Tx Config.gvi"(SFN=w37, TTI index=w38, eNB TX UE Context=w35, eNB TX DCI=w33, frame structure=w36, error in=w34) -> (MAC TX Config=w39, error out=w40)
                call "LTE MAC PDU Assembly.gvi"(MAC TX config in=w39, error in=w40, data FIFO in=w31, maximal execution time=w30) -> (MAC PDU Size=w41, MAC PDU=w42, error out=w43, IP Packets size exceeded=w44, MAC TX config out=w45)
                Feedback Node(input=w46) -> w47
                Add(w44, w47) -> w46
                $"IP Packets Size Exeeded Count" <- w46
                call "LTE PHY TX Request Confirm Abstraction.gvi"(MAC TX Config=w45, MAC PDU Size=w41, MAC PDU=w42, Device Location="eNB", error in=w43) -> (api transport out=w48, error out=w49, requests=w50)
                Property Node(instance in=w32) -> ("Request information FIFO"=w51, instance out=w52)
                call "LTE MAC Enque Requests.gvi"(RT FIFO reference=w51, requests=w50, error in=w49) -> (error out=w53)
                call "LTE Get Transport Session.gvi"(Session=w52, Transport Session Select="Transport MAC to PHY") -> (LTE Transport Session=w54)
                call "LTE Transport Send To Transport.gvi"(API transport session=w54, transport in=w48, error in=w53) -> (error out=w24)
              }
            }
          }
        }
        Right Timing Error Border Node(error_in=w24) -> (error_out=w55)
        Left Timing Source Border Node[AlarmName=L, DefaultTimingSourceName="1 MHz", DefaultTimingSourceType=2](mode_in="Process missed periods, ignore original phase", period_in=1, source_in=w13, structure_in="MAC Stub Tx")
        continue if $"L1-L2 Interface active"
      }
      call "LTE Remove Timed Loop Abort Error.gvi"(error in=w55, wake up reason=w17) -> (error out=w56)
      call "Stop On Error.gvi"(error in=w56, error source prefix="MAC Stub Tx") -> (error out=w57)
      call "LTE Get Transport Session.gvi"(Session=w7, Transport Session Select="Transport PHY to MAC") -> (LTE Transport Session=w58, Session dup=w59)
      w60 = 98  # priority in
      Property Node(instance in=w58) -> ("transport out timing source name"=w61)
      # NI API CHANGE
      call "RT Select CPU Core.gvi"(processor in=2, error in=w6) -> (processor out=w62, error out=w63)
      timed loop {
        Left Execution System Border Node(priority_in=w60, processor_in=w62)
        Left Timing Statistics Border Node() -> (wakeupreason_out=w64)
        call "LTE Get Transport Session.gvi"(Session=w59, Transport Session Select="Transport PHY to MAC") -> (LTE Transport Session=w65, Session dup=w66)
        Left Timing Error Border Node(error_in=w63) -> (error_out=w67)
        call "LTE Transport Read From Transport.gvi"(API transport session=w65, error in=w67, allow read fail=$"L1-L2 Interface active") -> (transport out=w68, transport read success=w69, error out=w70)
        case (w69) {
          frame False {
            w71 = w70
          }
          frame True {
            call "LTE Decode General Message Header.gvi"(message data in=w68, error in=w70) -> (decoded general message header=w72, error out=w73)
            Property Node(instance in=w72) -> ("message type ID"=w74)
            case (w74) {
              frame 0, Default {
                call "Build Error Cluster.gvi"(code=-1, description="MAC Stub Rx: unexpected API message", error in=w73) -> (error out=w71)
              }
              frame 16898 {
                # PHY_CNF
                Property Node(instance in=w66) -> ("Request information FIFO"=w75)
                Not(x=$"Stop on API Confirmation Errors") -> w76
                call "LTE Handle DL TX Confirm.gvi"(RT FIFO reference=w75, api transport in=w68, error in=w73, clear confirmation errors=w76) -> (error out=w71, confirm received counts=w77, confirmation evaluation error count=w78, negative confirm received count=w79)
                $"Received Confirmations" <- w77
                $Negatives <- w79
                $"Evaluation Errors" <- w78
              }
              frame 17409 {
                call "LTE PHY Receive RX Indication.gvi"(api transport in=w68, expected device location="eNB", error in=w73) -> (MAC RX Config=w80, MAC PDU=w81, error out=w82)
                # PHY_ULSCH_RX_IND
                Property Node(instance in=w80) -> ("CRC Result"=w83)
                Is Greater Than 0(x=w83) -> w84
                case (w84) {
                  frame False, Default {
                    w71 = w82
                  }
                  frame True {
                    call "LTE Extract Payload.gvi"(transport block=w81) -> (payload=w85)
                    Feedback Node(initial value=u8[] [], input=w86) -> w87
                    Build Array[ConcatenateInputs=True](w87, w85) -> w88
                    call "LTE Align Feedback Data.gvi"(data in=w88) -> (remaining portion=w86, feedback payload=w89)
                    Is Empty Array(array=w89) -> w90
                    Not(x=w90) -> w91
                    case (w91) {
                      frame False, Default {
                        w71 = w82
                      }
                      frame True {
                        call "LTE Interpret PUSCH Payload.gvi"(PUSCH payload=w89) -> (radioframe number=w92, ACK/NACK=w93, subband SNR=w94, wideband SNR=w95)
                        $"Radio Frame Number" <- w92
                        $"Reported DL ACK/NACK" <- w93
                        To Double Precision Float(number=w94) -> w96
                        $"Reported Subband SINR [dB]" <- w96
                        To Double Precision Float(number=w95) -> w97
                        $"Reported WB SINR" <- w97
                        call "LTE Calculate Average Error Rate.gvi"(ACK/NACK=w93) -> (error rate=w98)
                        $"Average DL error rate" <- w98
                        Tick Count() -> (timer value=w99)
                        Feedback Node(input=w100) -> w101
                        Is Greater Or Equal(x=w99, y=w101) -> w102
                        case (w102) {
                          frame False, Default {
                            w100 = w101
                          }
                          frame True {
                            $"Reported DL Block Error Rate" <- w98
                            Add(w99, 1000) -> w100
                          }
                        }
                        w71 = w82
                      }
                    }
                  }
                }
                $"UL RX Indication CRC OK" <- w84
              }
            }
          }
        }
        Right Timing Error Border Node(error_in=w71) -> (error_out=w103)
        Left Timing Source Border Node[AlarmName=L, DefaultTimingSourceName="1 MHz", DefaultTimingSourceType=2](mode_in="Process missed periods, ignore original phase", period_in=1, source_in=w61, structure_in="MAC Stub Rx")
        continue if $"L1-L2 Interface active"
      }
      call "LTE Remove Timed Loop Abort Error.gvi"(error in=w103, wake up reason=w64) -> (error out=w104)
      call "Stop On Error.gvi"(error in=w104, error source prefix="MAC Stub Rx") -> (error out=w105)
      Property Node(instance in=w7) -> ("timed loop period"=w106, instance out=w107)
      # NI API CHANGE
      call "RT Select CPU Core.gvi"(processor in=1, error in=w6) -> (processor out=w108, error out=w109)
      w110 = 100  # priority in
      timed loop {
        # receive PHY TTI timing indication (one per ms)
        Left Execution System Border Node(priority_in=w110, processor_in=w108)
        Left Timing Statistics Border Node()
        Left Timing Error Border Node(error_in=w109) -> (error_out=w111)
        call "LTE Receive Timing Indication RT.gvi"(session=w107, error in=w111, eNB TX Active=$"eNB TX Active") -> (error out=w112, subframe index=w113, subframe index valid=w114, DMA max elements remaining=w115, Num Tim Ind Missed=w116, DMA elements remaining=w117)
        $"Num Tim Ind Missed" <- w116
        case (w114) {
          frame False {
            w118 = w112
            w119 = w114
            w120 = w107
          }
          frame True, Default {
            call "Get Time.gvi"(error in_2=w112) -> (tick count (us)=w121, error out_2=w122)
            call "LTE TTI Counter to SFN and TTI.gvi"(TTI counter=w113, error in=w122) -> (SFN=w123, TTI=w124, error out=w125)
            call "Counter U16 Dominant Increment.gvi"() -> (count out=w126)
            call "LTE Encode PHY SAP Timing Indication.gvi"(reference ID=w126, SFN=w123, TTI index=w124, error in=w125) -> (encoded PHY SAP Timing Indication=w127, error out=w128)
            call "LTE Get Transport Session.gvi"(Session=w107, Transport Session Select="Transport PHY Timing to MAC") -> (LTE Transport Session=w129, Session dup=w120)
            call "LTE Transport Send To Transport.gvi"(API transport session=w129, transport in=w127, error in=w128) -> (error out=w118)
            $SFN <- w123
            $TTI <- w124
            $"PHY Timing Indication Received" <- w121
            w119 = w114
          }
        }
        Logical And(w119, $"eNB RX Active") -> w130
        case (w130) {
          frame False, Default {
            w131 = w118
          }
          frame True {
            call "LTE Send Dynamic UL Configuration.gvi"(UE context=$"eNB RX UE Context", DCI=$"eNB RX DCI", scope="RX", session=w120, error in=w118) -> (error out=w131)
          }
        }
        Right Timing Error Border Node(error_in=w131) -> (error_out=w132)
        $"Tim Ind in DMA" <- w117
        Left Timing Source Border Node[AlarmName=L, DefaultTimingSourceName="1 MHz", DefaultTimingSourceType=2](mode_in="Discard missed periods, ignore original phase", period_in=w106, structure_in="PHY SAP Tim")
        # NI API CHANGE
        $"Max Tim Ind in DMA" <- w115
        continue if $"L1-L2 Interface active"
      }
      call "Stop On Error.gvi"(error in=w132, error source prefix="PHY SAP Tim") -> (error out=w133)
      call "LTE Get Transport Session.gvi"(Session=w7, Transport Session Select="Transport MAC to PHY") -> (LTE Transport Session=w134, Session dup=w135)
      w136 = 99  # priority in
      call "RT Select CPU Core.gvi"(processor in=1, error in=w6) -> (processor out=w137, error out=w138)
      Property Node(instance in=w134) -> ("transport out timing source name"=w139)
      # NI API CHANGE
      timed loop {
        Left Execution System Border Node(priority_in=w136, processor_in=w137)
        # handover TX request to PHY FPGA
        Left Timing Statistics Border Node()
        call "LTE Get Transport Session.gvi"(Session=w135, Transport Session Select="Transport MAC to PHY") -> (LTE Transport Session=w140, Session dup=w141)
        Left Timing Error Border Node(error_in=w138) -> (error_out=w142)
        call "LTE Transport Read From Transport.gvi"(API transport session=w140, error in=w142, allow read fail=$"L1-L2 Interface active") -> (transport out=w143, transport read success=w144, error out=w145)
        call "Get Time.gvi"(error in=w145) -> (error out=w146, tick count (us)=w147)
        Subtract(x=w147, y=$"PHY Timing Indication Received") -> w148
        # reserve time buffer to transmit TX data to FPGA
        w149 = 700  # maximal allowed TX processing time [us]
        Is Greater(x=w148, y=w149) -> w150
        case (w144) {
          frame True {
            Property Node(instance in=$"eNB TX UE Context") -> ("Use UERS"=w153)
            call "LTE PHY TX Request Confirm Handler.gvi"(api transport in=w143, Expected SFN=$SFN, Expected TTI index=$TTI, Expected Device Location="eNB", error in=w146, frame structure=$"eNB TX Frame Structure", use UERS=w153, TX request too late=w150) -> (TX UE Context=w154, TX DCI=w155, TX Data=w156, error out=w157, api transport out=w158, output valid=w159)
            Logical And(w159, $"eNB TX Active") -> w152
            Property Node(instance in=w141) -> ("MAC Stub enabled"=w160, instance out=w161)
            case (w152) {
              frame False, Default {
                w162 = w157
                w163 = w161
              }
              frame True {
                call "LTE Send Dynamic DL TX Configuration.gvi"(DCI in=w155, UE context=w154, session=w161, error in=w157) -> (error out=w164, session dup=w165)
                call "LTE Send Dynamic DL Tx Payload.gvi"(session in=w165, TX data=w156, error in=w164) -> (error out=w162, session out=w163)
                case (w160) {
                  frame True { }
                  frame False {
                    # NI API CHANGE
                    $"eNB TX DCI" <- w155
                  }
                }
              }
            }
            Property Node(instance in=w163) -> ("Request information FIFO"=w166, "MAC Stub enabled"=w167)
            Array Size(array=w158) -> (size(s)=w168)
            Is Greater Than 0(x=w168) -> w169
            Logical And(not w167, $"Show Received Confirmations with external MAC enabled") -> w170
            case (w169) {
              frame False, Default {
                call "Build Error Cluster.gvi"(code=-1, description="Confirmation message response is empty.", error in=w162) -> (error out=w151)
              }
              frame True {
                call "LTE Get Transport Session.gvi"(Session=w163, Transport Session Select="Transport PHY to MAC") -> (LTE Transport Session=w171)
                call "LTE Transport Send To Transport.gvi"(API transport session=w171, transport in=w158, error in=w162) -> (error out=w151)
                case (w170) {
                  frame False { }
                  frame True {
                    # NI API CHANGE
                    call "LTE Handle DL TX Confirm.gvi"(RT FIFO reference=w166, api transport in=w158, clear confirmation errors=TRUE) -> (confirm received counts=w172, negative confirm received count=w173)
                    $"Received Confirmations" <- w172
                    $Negatives <- w173
                  }
                }
              }
            }
          }
          frame False {
            w151 = w146
            w152 = w144
          }
        }
        call "Get Time.gvi"(error in=w151) -> (error out=w174, tick count (us)=w175)
        Right Timing Error Border Node(error_in=w174) -> (error_out=w176)
        case (w152) {
          frame True {
            Subtract(x=w175, y=$"PHY Timing Indication Received") -> w177
            call "Get and Hold Maximum.gvi"(value=w177) -> (max value=w178)
            $"Max MAC TX Delay" <- w178
          }
          frame False { }
        }
        Left Timing Source Border Node[AlarmName=L, DefaultTimingSourceName="1 MHz", DefaultTimingSourceType=2](mode_in="Process missed periods, ignore original phase", period_in=1, source_in=w139, structure_in="PHY SAP Tx")
        continue if $"L1-L2 Interface active"
      }
      call "Stop On Error.gvi"(error in=w176, error source prefix="PHY SAP Tx") -> (error out=w179)
      # NI API CHANGE
      call "RT Select CPU Core.gvi"(processor in=2, error in=w6) -> (processor out=w180, error out=w181)
      w182 = 98  # priority in
      Property Node(instance in=w7) -> ("timed loop period"=w183, instance out=w184)
      timed loop {
        Left Execution System Border Node(priority_in=w182, processor_in=w180)
        Left Timing Statistics Border Node()
        Left Timing Error Border Node(error_in=w181) -> (error_out=w185)
        call "LTE Receice PUSCH Decoding Status.gvi"(session=w184, error in=w185) -> (PUSCH Decoding Status valid=w186, PUSCH Decoding Status=w187, error out=w188)
        case (w186) {
          frame False, Default {
            w189 = w188
          }
          frame True {
            Property Node(instance in=w184) -> ("PUSCH user data throughput queue"=w190, instance out=w191)
            call "LTE PDSCH Channel Decoder Status from U32.gvi"(bit vector in=w187, valid in=TRUE) -> (PDSCH decoder status=w192)
            Property Node(instance in=w192) -> ("user data"=w193, "transport block size"=w194, "CRC ok"=w195, instance out=w196)
            Enqueue Element(element=w196, error in=w188, queue=w190, timeout in ms=0) -> (error out=w197)
            call "LTE Receive PUSCH MAC PDU.gvi"(session=w191, transport block size=w194, error in=w197) -> (MAC PDU=w198, error out=w199)
            call "LTE Get Transport Session.gvi"(Session=w191, Transport Session Select="Transport PHY to MAC") -> (LTE Transport Session=w200)
            Boolean To Integer(Boolean=w195) -> (0, 1=w201)
            To Unsigned Byte Integer(number=w201) -> w202
            Array Size(array=w198) -> (size(s)=w203)
            To Unsigned Long Integer(number=w203) -> w204
            To Unsigned Byte Integer(number=w193) -> w205
            call "Counter U16 Dominant Increment.gvi"() -> (count out=w206)
            Property Node(instance in=$"eNB RX UE Context") -> ("RNTI"=w207)
            call "LTE Encode PHY SAP UL RX Indication.gvi"(reference ID=w206, SFN=0, TTI index=w205, MAC PDU=w198, MAC PDU Size=w204, RNTI=w207, CRC Result=w202) -> (encoded UL RX Indication=w208)
            call "LTE Transport Send To Transport.gvi"(API transport session=w200, transport in=w208, error in=w199) -> (error out=w189)
          }
        }
        Right Timing Error Border Node(error_in=w189) -> (error_out=w209)
        Left Timing Source Border Node[AlarmName=L, DefaultTimingSourceName="1 MHz", DefaultTimingSourceType=2](mode_in="Discard missed periods, ignore original phase", period_in=w183, structure_in="PHY SAP Rx")
        continue if $"L1-L2 Interface active"
      }
      call "Stop On Error.gvi"(error in=w209, error source prefix="PHY SAP Rx") -> (error out=w210)
      s2 = w6  # shift register
      while {
        Wait(time to wait=1)
        Property Node(instance in=$session) -> ("UDP TX outbound FIFO"=w211, "UDP TX session"=w212)
        s3 = s2  # shift register
        while {
          Udp Read I Pv 6 Binary(connection ID=w212, error in=s3, max size=10240, timeout ms=0) -> (data out=w215, error out=w216)
          call "Filter Error Codes.gvi"(codes to clear=[1, 113, 66, 56], error in=w216) -> (codes cleared=w217, error cleared?=w218, error out=w219)
          Search 1D Array(1D array=w217, element=113) -> (index of element=w220)
          Is Greater Or Equal To 0(x=w220) -> w221
          Search 1D Array(1D array=w217, element=56) -> (index of element=w222)
          Is Greater Or Equal To 0(x=w222) -> w223
          Not(x=w223) -> w224
          Is Empty Array(array=w215) -> w225
          Not(x=w225) -> w226
          Logical And(w224, w226) -> w227
          case (w218) {
            frame True {
              w228 = w219
            }
            frame False {
              RTFIFO Write(element=w215, error in=w219, overwrite on timeout=TRUE, rt fifo=w211, timeout in ms=0) -> (error out=w228)
            }
          }
          call "Is Error.gvi"(error in=w228) -> (is error?=w229)
          Logical Or(w229, w218, w225) -> w230
          append w221 to w213
          append w227 to w214
          next s3 = w228
          stop if w230
        }
        Or Array Elements(Boolean array=w213) -> (logical OR=w231)
        $"Packet Loss In" <- w231
        Or Array Elements(Boolean array=w214) -> (logical OR=w232)
        $"Data Transfer In" <- w232
        call "Check Stop.gvi"(error in=s3) -> (error out=w233, stop=w234)
        next s2 = w233
        stop if w234
      }
      call "Stop On Error.gvi"(error in=s2) -> (error out=w235)
      Build Array[ConcatenateInputs=True](w57, w105, w10, w133, w179, w210, w235) -> w9
    }
    frame TARGET_TYPE != "RT" {
      s4 = w6  # shift register
      s5 = 0  # shift register
      while {
        Wait Until Next Multiple(multiple to wait=100)
        call "LTE Read UL Data.gvi"(session=$session, error in=s4) -> (error out=w236, radioframe number=w237, output valid=w238, DL ACK/NACK=w239, subband SNR=w240, wideband SNR=w241)
        # read and decode PUSCH feedback information
        # use feedback information to apply correct MCS
        # 5
        case (w238) {
          frame False, Default {
            w242 = s5
            w243 = w236
          }
          frame True {
            $"Radio Frame Number" <- w237
            $"Reported DL ACK/NACK" <- w239
            To Double Precision Float(number=w240) -> w244
            $"Reported Subband SINR [dB]" <- w244
            To Double Precision Float(number=w241) -> w245
            $"Reported WB SINR" <- w245
            call "LTE Calculate Average Error Rate.gvi"(ACK/NACK=w239) -> (error rate=w246)
            $"Average DL error rate" <- w246
            Increment(x=s5) -> w242
            Quotient And Remainder(x=w242, y=10) -> (x-y*floor(x/y)=w247)
            Is Equal To 0(x=w247) -> w248
            case (w248) {
              frame False, Default { }
              frame True {
                $"Reported DL Block Error Rate" <- w246
              }
            }
            w243 = w236
          }
        }
        call "Check Stop.gvi"(error in=w243) -> (error out=w249, stop=w250)
        next s4 = w249
        next s5 = w242
        stop if w250
      }
      call "Stop On Error.gvi"(error in=s4) -> (error out=w251)
      s6 = w6  # shift register
      while {
        # use SINR information to apply correct MCS
        case ($"eNB TX Active") {
          frame False, Default {
            Wait(time to wait=10)
            w252 = s6
            w253 = TRUE
          }
          frame True {
            call "LTE Receive Timing Indication.gvi"(session=$session, error in=s6) -> (session dup=w254, error out=w255, new timing indication=w253)
            case (w253) {
              frame False, Default {
                w252 = w255
              }
              frame True {
                case ($"Rate Adaption") {
                  frame False, Default {
                    w256 = $"eNB TX DCI"
                    w257 = w255
                  }
                  frame True {
                    call "LTE MCS Regulation.gvi"(SNR offset [dB]=$"SINR Offset [dB]", wideband SNR=$"Reported WB SINR", DCI in=$"eNB TX DCI", UE context=$"eNB TX UE Context") -> (DCI out=w256)
                    w257 = w255
                  }
                }
                call "LTE Send Dynamic DL TX Configuration.gvi"(DCI in=w256, UE context=$"eNB TX UE Context", session=w254, error in=w257) -> (error out=w252, coerced DCI=w258, DCI modified=w259)
                case (w259) {
                  frame False, Default { }
                  frame True {
                    $"eNB TX DCI" <- w258
                  }
                }
              }
            }
          }
        }
        Logical And(w253, $"eNB RX Active") -> w260
        # 5
        case (w260) {
          frame False, Default {
            w261 = w252
          }
          frame True {
            call "LTE Send Dynamic UL Configuration.gvi"(UE context=$"eNB RX UE Context", DCI=$"eNB RX DCI", scope="RX", session=$session, error in=w252) -> (error out=w261)
          }
        }
        call "Check Stop.gvi"(error in=w261) -> (error out=w262, stop=w263)
        next s6 = w262
        stop if w263
      }
      call "Stop On Error.gvi"(error in=s6) -> (error out=w264)
      s7 = w6  # shift register
      s8 = 0  # shift register
      while {
        # receive UDP data from network and send it to the FPGA as PDSCH payload data of the transmitter
        # read received PDSCH payload data from FPGA and send it to the specified UDP port
        Wait Until Next Multiple(multiple to wait=0)
        call "LTE Receive UDP Data.gvi"(session=$session, eNB TX active=$"eNB TX Active", UDP packet counter in=s8, error in=s7) -> (FIFO full=w265, data transfer=w266, UDP packet counter out=w267, error out=w268)
        $"Packet Loss In" <- w265
        $"Data Transfer In" <- w266
        # 6
        call "Check Stop.gvi"(error in=w268) -> (error out=w269, stop=w270)
        next s7 = w269
        next s8 = w267
        stop if w270
      }
      call "Stop On Error.gvi"(error in=s7) -> (error out=w271)
      Build Array(w251, w264, w271) -> w9
    }
  }
  s9 = w6  # shift register
  while {
    Wait Until Next Multiple(multiple to wait=100)
    Feedback Node[DelayCount=3](input=w272) -> w273
    call "LTE Determine Configuration Trigger.gvi"(RX enabled=$"eNB Receiver", TX enabled=$"eNB Transmitter") -> (trigger RX configuration=w274, trigger TX configuration=w275)
    # configure eNB RX/TX baseband and RF when enabled
    case (w274) {
      frame False, Default {
        w276 = s9
      }
      frame True {
        case ($"eNB Receiver") {
          frame False, Default {
            call "LTE Disable UL RX.gvi"(session=$session, error in=s9) -> (error out=w276)
            sequence {
              frame 0 {
                $"eNB RX Active" <- FALSE
              }
            }
          }
          frame True {
            Property Node(instance in=$session) -> ("real time mode"=w277)
            call "LTE Setup UL RX Baseband.gvi"(frame structure=$"eNB RX Frame Structure", session in=$session, error in=s9, cell ID=$"eNB RX Cell ID", RF timing offset=$"eNB Timing Offset", UE Context=$"eNB RX UE Context", DCI=$"eNB RX DCI", real time mode=w277) -> (error out=w278, session dup=w279)
            call "LTE Setup RX.gvi"(session in=w279, RX port=$"eNB RX RF Port (USRP)", error in=w278, RX frequency [Hz]=$"eNB RX Frequency [Hz]", gain value [dB]=$"eNB Coerced Gain [dB]", LTE scope="UL") -> (session out=w280, coerced gain [dB]=w281, error out=w282, coerced frequency [Hz]=w283)
            $session <- w280
            $"eNB Coerced Gain [dB]" <- w281
            $"eNB RX Frequency [Hz]" <- w283
            case (w282) {
              frame Error {
                $"eNB Receiver" <- FALSE
                w276 = w282
              }
              frame No Error {
                $"eNB RX Active" <- TRUE
                w276 = w282
              }
            }
          }
        }
      }
    }
    # 1
    case (w275) {
      frame False, Default {
        w284 = s9
      }
      frame True {
        case ($"eNB Transmitter") {
          frame False, Default {
            sequence {
              frame 0 {
                $"eNB TX Active" <- FALSE
              }
              frame 1 {
                Wait(time to wait=10)
              }
            }
            call "LTE Disable DL TX.gvi"(session=$session, error in=s9) -> (error out=w284)
          }
          frame True {
            case (s9) {
              frame Error {
                w285 = s9
              }
              frame No Error {
                $"TX starting" <- TRUE
                w285 = s9
              }
            }
            Property Node(instance in=$session) -> ("real time mode"=w286)
            call "LTE Setup DL TX Baseband.gvi"(session in=$session, UDP receive port=$"UDP Receive Port", frame structure=$"eNB TX Frame Structure", cell ID=$"eNB TX Cell ID", UE context=$"eNB TX UE Context", error in=w285, DCI=$"eNB TX DCI", real time mode=w286) -> (session out=w287, error out=w288)
            call "LTE Setup TX.gvi"(session in=w287, TX frequency [Hz]=$"eNB TX Frequency [Hz]", TX power level [dB]=$"eNB Max RF TX Power [dBm]", TX port=$"eNB TX RF Port (USRP)", error in=w288, LTE scope="DL", timing advance=0) -> (coerced output power [dB]=w289, error out=w290, session dup=w291, coerced frequency [Hz]=w292, coerced power level setting [dB]=w293)
            $session <- w291
            $"eNB Coerced Max RF TX Power [dBm]" <- w289
            case (w290) {
              frame No Error, Default {
                $"eNB TX Active" <- TRUE
                $"TX starting" <- FALSE
                call "LTE Setup DL TX Set Active.gvi"(session in=w291, error in=w290) -> (error out=w284)
              }
              frame Error {
                $"eNB Transmitter" <- FALSE
                $"TX starting" <- FALSE
                call "LTE Check UDP Port In Use.gvi"(error in=w290) -> (error out=w284)
              }
            }
            $"eNB TX Frequency [Hz]" <- w292
            $"eNB Max RF TX Power [dBm]" <- w293
          }
        }
      }
    }
    Merge Errors(w276, w284) -> (error out=w294)
    # synchronize the exit condition across all loops of the host application
    call "Create Stop.gvi"(error in=w294, stop in=$stop) -> (error out=w295)
    call "Check Stop.gvi"(error in=w295) -> (error out=w296, stop=w272)
    # Disable TX and RX to
    # ensure proper shutdown
    Not(x=w272) -> w297
    $"L1-L2 Interface active" <- w297
    case (w272) {
      frame False, Default { }
      frame True {
        $"eNB Receiver" <- FALSE
        $"eNB Transmitter" <- FALSE
      }
    }
    case (s9) {
      frame Error { }
      frame No Error {
        $"FPGA Ready" <- TRUE
      }
    }
    next s9 = w296
    stop if w273
  }
  call "Stop On Error.gvi"(error in=s9) -> (error out=w298)
  s10 = w6  # shift register
  while (iteration -> i1) {
    Wait Until Next Multiple(multiple to wait=50)
    disable {
      frame TARGET_TYPE == "RT", Default {
        w299 = $session
        w300 = s10
      }
      frame TARGET_TYPE != "RT" {
        call "LTE Read PUSCH Decoder Status.gvi"(session in=$session, error in=s10) -> (error out=w300, session dup=w299)
      }
    }
    call "LTE Get ADC and IFFT Status.gvi"(session in=w299, error in=w300) -> (ADC values clipped=w301, error out=w302, TX IFFT output clipped=w303, RX DDC values clipped=w304, session dup=w305)
    call "LTE Read UL BB Power.gvi"(error in=w302, session in=w305) -> (session dup=w306, error out=w307, RX baseband input power=w308)
    call "LTE Read TX BB Power.gvi"(error in=w307, session in=w306, TX reference level [dBm]=$"eNB Coerced Max RF TX Power [dBm]", LTE scope="DL") -> (session dup=w309, error out=w310, TX power [dBm]=w311, TX baseband power [dBFS]=w312)
    call "LTE Calculate Power Calibration Offset.gvi"(session in=w309, frequency [Hz]=$"eNB RX Frequency [Hz]", error in=w310, LTE scope="UL") -> (session dup=w313, power calibration offset [dB]=w314, error out=w315)
    $"power calibration offset [dB]" <- w314
    Not(x=$"eNB AGC") -> w316
    call "LTE Control Power Gain.gvi"(expected signal range lower bound=-17, use manual gain=w316, BB input power=w308, gain in=$"eNB Coerced Gain [dB]", manual gain value [dB]=$"eNB Manual Gain [dB]", expected signal range upper bound=-15, power calibration offset [dB]=w314) -> (RF input power [dBm]=w317, power [dBFS]=w318, gain out=w319)
    # read sync status and baseband power levels from FPGA and feed them into automatic gain control (AGC)
    # use manual gain value if AGC is disabled
    # configure frequency offset on FPGA
    # read PUSCH decoder status
    Logical And(not $"TX starting", $"eNB Receiver", $"eNB RX Active") -> w320
    # 2
    case (w320) {
      frame False, Default {
        w321 = w315
      }
      frame True {
        call "LTE Apply AGC Output.gvi"(session=w313, LTE scope="UL", error in=w315, apply values=w320, AGC output=w319) -> (coerced gain [dB]=w322, error out=w321)
        $"eNB Coerced Gain [dB]" <- w322
      }
    }
    call "Check Stop.gvi"(error in=w321) -> (error out=w323, stop=w324)
    $"eNB RF TX Power [dBm]" <- w311
    $"eNB Baseband TX Power [dBFS]" <- w312
    $"eNB Baseband RX Power [dBFS]" <- w318
    $"eNB RF RX Power [dBm]" <- w317
    $"eNB Applied Gain [dB]" <- $"eNB Coerced Gain [dB]"
    $"eNB ADC Values Clipped" <- w301
    $"eNB TX IFFT Output Clipped" <- w303
    To Unsigned Long Integer(number=i1) -> w325
    Quotient And Remainder(x=w325, y=10) -> (x-y*floor(x/y)=w326)
    Is Equal To 0(x=w326) -> w327
    Logical Or(w304, w327) -> w328
    Feedback Node(enable?=w328, input=w304) -> w329
    Feedback Node(enable?=w327, input=w329) -> w330
    $"eNB DDC Values Clipped" <- w330
    next s10 = w323
    stop if w324
  }
  call "Stop On Error.gvi"(error in=s10) -> (error out=w331)
  s11 = w6  # shift register
  while (iteration -> i2) {
    Wait Until Next Multiple(multiple to wait=20)
    # NI API CHANGE
    Quotient And Remainder(x=i2, y=5) -> (x-y*floor(x/y)=w332)
    Select(s=$"External MAC", t=3, f=w332) -> w333
    # read RX/TX baseband data values and PDCCH/PDSCH constellation data from FPGA and draw corresponding diagrams
    # 3
    case (w333) {
      frame 0, Default {
        call "LTE Read TX Data.gvi"(session=$session, error in=s11) -> (error out=w335, TX baseband data=w336)
        call "LTE Calculate TX Power Spectrum.gvi"(TX data=w336, error in=w335, coerced gain [dB]=$"eNB Coerced Max RF TX Power [dBm]") -> (TX power spectrum=w337, error out=w334)
        $"eNB TX Power Spectrum" <- w337
      }
      frame 1 {
        call "LTE Read RX Data.gvi"(session=$session, error in=s11) -> (RX data=w338, error out=w339)
        call "LTE Calculate RX Power Spectrum.gvi"(RX data=w338, coerced gain [dB]=$"eNB Coerced Gain [dB]", error in=w339, power calibration offset [dB]=$"power calibration offset [dB]") -> (RX power spectrum=w340, error out=w334)
        $"eNB RX Power Spectrum" <- w340
      }
      frame 2 {
        call "LTE Read Constellation Data.gvi"(session=$session, error in=s11, symbol number for display=$"symbol number for PUSCH constellation", RX tab=-1) -> (constellation data=w341, display data out=w342, error out=w334)
        case (w342) {
          frame False, Default { }
          frame True {
            $"PUSCH Constellation" <- w341
          }
        }
      }
      frame 3 {
        case ($"External MAC") {
          frame False, Default {
            w334 = s11
          }
          frame True {
            call "LTE Read External MAC Output.gvi"(session=$session, error in=s11, full log=FALSE) -> (external MAC log output=w343, error out=w334)
            $"External MAC Output" <- w343
          }
        }
      }
      frame 4 {
        w334 = s11
      }
    }
    call "Check Stop.gvi"(error in=w334) -> (error out=w344, stop=w345)
    next s11 = w344
    stop if w345
  }
  sequence {
    frame 0 {
      # NI API CHANGE
      call "LTE Read External MAC Output.gvi"(session=$session, error in=s11, full log=TRUE) -> (external MAC log output=w346, error out=w347)
      $"External MAC Output" <- w346
    }
  }
  call "Stop On Error.gvi"(error in=w347) -> (error out=w348)
  s12 = 0  # shift register
  s13 = w6  # shift register
  while {
    Wait Until Next Multiple(multiple to wait=1000)
    # compute throughput and block error rate and draw corresponding diagrams
    Tick Count() -> (timer value=w349)
    Subtract(x=w349, y=s12) -> w350
    call "LTE Calculate UL Throughput and BLER.gvi"(time difference=w350, session=$session, error in=s13) -> (UL throughput (current)=w351, error out=w352, UL BLER=w353)
    # 4
    case ($"eNB RX Active") {
      frame False, Default { }
      frame True {
        $"PUSCH Throughput [Mbps]" <- w351
        $"eNB Failure / Block Error Rate (BLER)" <- w353
        $"PUSCH BLER (current)" <- w353
      }
    }
    call "Check Stop.gvi"(error in=w352) -> (error out=w354, stop=w355)
    next s12 = w349
    next s13 = w354
    stop if w355
  }
  call "Stop On Error.gvi"(error in=s13) -> (error out=w356)
  Build Array[ConcatenateInputs=True](w298, w331, w348, w356, w9) -> w357
  sequence (after w357) {
    frame 0 {
      # NI API CHANGE
      call "RT Startup Send Notification.gvi"(Error In=s1, Notification="System Stopped!") -> (Error Out=w358)
      call "RT Startup Destroy Notifier.gvi"(error in=w358)
    }
  }
  # NI API CHANGE
  call "LTE Read External MAC Output.gvi"(session=w7, full log=TRUE) -> (external MAC log output=w359)
  $"External MAC Output" <- w359
  sequence {
    frame 0 {
      call "LTE eNodeB Host Cleanup.gvi"(session=$session, error in=no error) -> (error out=w360)
      Build Array[ConcatenateInputs=True](w357, w360) -> w361
      $"FPGA Ready" <- FALSE
    }
  }
  call "LTE Generate Error Report.gvi"(error in=w361) -> (error report=w362, error occured=w363)
  $"Error Report" <- w362
  case (w363) {
    frame False, Default { }
    frame True {
      # Switch to status tab
      # in case of error
      $Tab <- 2
    }
  }
  $"device bandwidth [MHz]" <- w8
