vi "LTE Setup RT Parameters.gvi"   [LabVIEW Communications System Design Suite 2.0.1]
inputs:
  "error in": error
  "MAC Stub enabled?": bool
  "command line": string
  "arguments": string
  "start externally": bool
outputs:
  "error out": error
  "DMA FIFO read timeout (ms)": i32
  "real time mode": bool
  "timed loop period": i64
  "LTE Transport Sessions": "LTE Transport Session.gtype"[]
  "process ID": u32
  "log file": string
types:
  "Pipe Reader.gtype" = cluster{"file name": string, "pipe file descriptor": i32, "timer file descriptor": i32, "epoll file descriptor": i32}
  "Pipe Writer.gtype" = cluster{"file name": string, "pipe file descriptor": i32}
  "LTE Transport Session.gtype" = cluster{"FIFO pathname": string, "pipe reader": "Pipe Reader.gtype", "pipe writer": "Pipe Writer.gtype", "transport in RT FIFO": RTFifoRefnum<u8[]>, "transport out RT FIFO": RTFifoRefnum<u8[]>, "transport in timing source name": string, "transport in timing trigger ID": u8, "transport out timing source name": string, "transport out timing trigger ID": u8, "maximum API message size": u32}
diagram:
  # NI API CHANGE
  call "Get System Model Name.gvi"(error in=$"error in") -> (model name=w1, error out=w2)
  disable {
    frame TARGET_TYPE != "RT", Default {
      w3 = w2
      w4 = FALSE
      w5 = 5000
      w6 = -1
      w7 = default
      w8 = default
      w9 = 0
    }
    frame TARGET_TYPE == "RT" {
      case (w1) {
        frame Default {
          # poll DMA FIFO
          w5 = 0
          w6 = 75
        }
        frame "NI USRP-2974" {
          # read blocking from DMA FIFO
          w5 = 2
          w6 = 1
        }
      }
      call "RT Get Number of CPUs.gvi"(error in=w2) -> (# of CPUs=w10, error out=w11)
      To Long Integer(number=w10) -> w12
      Initialize Array(element="Timed Structures", size=w12) -> w13
      Replace Array Subset(inArray=w13, index=0, new="System") -> w14
      call "RT Set CPU Pool Assignments.gvi"(CPU pools=w14, error in=w11) -> (error out=w15)
      call "LTE Transport Init.gvi"(error in=w15, MAC Stub enabled?=$"MAC Stub enabled?", command=$"command line", arguments=$arguments, start externally=$"start externally") -> (Error out=w3, LTE Transport Sessions=w7, process ID=w9, log file=w8)
      w4 = TRUE
    }
  }
  $"DMA FIFO read timeout (ms)" <- w5
  $"timed loop period" <- w6
  $"real time mode" <- w4
  $"LTE Transport Sessions" <- w7
  $"process ID" <- w9
  $"log file" <- w8
  $"error out" <- w3
