vi "LTE Encode PHY SAP Cell Measurement Indication.gvi"   [LabVIEW Communications System Design Suite 2.0.1]
# Creates a DX RX indication message.
inputs:
  "reference ID": u16
  "SFN": u16
  "TTI index": u8
  "subband SNR": FXP(6.2)[]  # Array of signal-to-noise ratio (SNR) values for the reported radio frame, in dB, for all 13 sub-bands of 8 physical resource blocks. The last sub-band contains only 4 resource blocks.
  "wideband SNR": FXP(6.2)  # Scalar wideband SNR for the reported radio frame, in dB.
  "Cell ID": u16 = 8
outputs:
  "encoded UL RX Indication": u8[]
  "message body length": u32
panel controls:
  "Numeric Constant": FXP(6.2) = -3.75
panel indicators:
  "sum": f64
types:
  "LTE SAP Sub Header.gtype" = cluster{"SFN": u16, "TTI index": u8, "number of submessages": u8, "confirmation mode": u8, "Reserved": u32}
  "LTE Message Type ID Defined.gtype" = u16
  "LTE General Message Header.gtype" = cluster{"message type ID": "LTE Message Type ID Defined.gtype", "reference ID": u16, "instance ID": u8}
diagram:
  Split Number(x=$"Cell ID") -> (high(x)=w1, low(x)=w2)
  # number of SB SINR
  Type Cast(type=u8 0, x=$"wideband SNR") -> w3
  Reinterpret Number[RestrictToSameWordLength=True](data in=$"subband SNR", type=u8 0) -> (data out=w4)
  Array Size(array=$"subband SNR") -> (size(s)=w5)
  To Unsigned Byte Integer(number=w5) -> w6
  Build Array[ConcatenateInputs=True](w1, w2, w3, w6, w4) -> w7
  w8 = 0  # confirmation mode
  w9 = 0  # Reserved
  Property Node(instance in="LTE SAP Sub Header.gtype" {all zero or empty}, "SFN"=$SFN, "TTI index"=$"TTI index", "confirmation mode"=w8, "number of submessages"=1, "Reserved"=w9) -> (instance out=w10)
  call "LTE Encode SAP Sub Header.gvi"(SAP sub header=w10) -> (encoded SAP sub header=w11)
  Array Size(array=w7) -> (size(s)=w12)
  To Unsigned Long Integer(number=w12) -> w13
  call "LTE Encode Sub Message Header.gvi"(sub message type=0, sub message body length=w13) -> (encoded sub message header=w14)
  Build Array[ConcatenateInputs=True](w11, w14, w7) -> w15
  w16 = 0  # instance ID
  Property Node(instance in="LTE General Message Header.gtype" {all zero or empty}, "message type ID"="PHY_CELL_MEASUREMENT_IND"(18435), "instance ID"=w16, "reference ID"=$"reference ID") -> (instance out=w17)
  Array Size(array=w15) -> (size(s)=w18)
  To Unsigned Long Integer(number=w18) -> w19
  call "LTE Encode General Message Header.gvi"(general message header=w17, message body length=w19) -> (encoded general message header=w20)
  Build Array[ConcatenateInputs=True](w20, w15) -> w21
  $"encoded UL RX Indication" <- w21
  $"message body length" <- w19
  disable {
    frame Enabled { }
    frame Disabled {
      Reinterpret Number[RestrictToSameWordLength=True](data in=$"Numeric Constant", type=u8 0) -> (data out=w22)
      Logical And(3, w22) -> w23
      To Double Precision Float(number=w23) -> w24
      Divide(x=1, y=4) -> w25
      Multiply(w25, w24) -> w26
      # reference for C fxp to double conversion function
      Logical Shift(x=w22, y=-2) -> w27
      Logical And(w22, 128) -> w28
      Is Greater Than 0(x=w28) -> w29
      Logical Or(192, w27) -> w30
      Select(s=w29, t=w30, f=w27) -> w31
      Type Cast(type=i8 0, x=w31) -> w32
      To Double Precision Float(number=w32) -> w33
      Add(w33, w26) -> w34
      $sum <- w34
    }
  }
