vi "LTE Transport Init.gvi"   [LabVIEW Communications System Design Suite 2.0.1]
inputs:
  "error in": error
  "MAC Stub enabled?": bool
  "command": string
  "arguments": string
  "start externally": bool
outputs:
  "Error out": error
  "LTE Transport Sessions": "LTE Transport Session.gtype"[]
  "process ID": u32
  "log file": string
panel indicators:
  "done": bool
types:
  "Pipe Reader.gtype" = cluster{"file name": string, "pipe file descriptor": i32, "timer file descriptor": i32, "epoll file descriptor": i32}
  "Pipe Writer.gtype" = cluster{"file name": string, "pipe file descriptor": i32}
  "LTE Transport Session.gtype" = cluster{"FIFO pathname": string, "pipe reader": "Pipe Reader.gtype", "pipe writer": "Pipe Writer.gtype", "transport in RT FIFO": RTFifoRefnum<u8[]>, "transport out RT FIFO": RTFifoRefnum<u8[]>, "transport in timing source name": string, "transport in timing trigger ID": u8, "transport out timing source name": string, "transport out timing trigger ID": u8, "maximum API message size": u32}
diagram:
  # NI API CHANGE
  call "RT Startup Send Notification.gvi"(Error In=$"error in", Notification="Setup Pipe Readers...")
  # NI API CHANGE
  # NI API CHANGE
  Select(s=$"start externally", t=TRUE, f=$"MAC Stub enabled?") -> w1
  Type Cast(type=i32 0, x="Transport Number of Sessions") -> w2
  Initialize Array(element=FALSE, size=w2) -> w3
  # $"MAC Stub enabled?": If the native MAC Stub is disabled,
  # run the external MAC application.
  case ($"MAC Stub enabled?") {
    frame True {
      w6 = [TRUE, TRUE, TRUE]  # enabled
      Replace Array Subset(inArray=w3, index=0, new=w6) -> w4
      w5 = w4
    }
    frame False {
      # Counterparts are opened
      # by external application.
      w7 = [FALSE, TRUE, FALSE]  # enabled
      Replace Array Subset(inArray=w3, index=0, new=w7) -> w4
      Not(x=w4) -> w5
    }
  }
  call "LTE Transport Create Sessions.gvi"(num pipes=w2, Error in=$"error in") -> (LTE Transport sessions=w8, Error out=w9)
  call "LTE Transport Open Readers.gvi"(LTE Transport sessions in=w8, Error in=w9, readers enabled=w4) -> (LTE Transport sessions out=w10, Error out=w11)
  case (w1) {
    frame True {
      w12 = w11
      w13 = default
      w14 = default
    }
    frame False {
      # 0..N-1	manual -2	automatic
      w15 = -2  # CPU core assignment
      # NI API CHANGE
      w16 = 28  # process priority
      # priority for MAC must be higher than 100, PHY SAP used priorities below 100
      # We use a timed loop to specify process priority and CPU core for the external MAC application
      timed loop {
        Left Execution System Border Node(priority_in=w16, processor_in=w15)
        Left Timing Statistics Border Node()
        Left Timing Source Border Node[AlarmName=L, DefaultTimingSourceName="1 kHz", DefaultTimingSourceType=1](structure_in="MAC External")
        # NI API CHANGE
        # NI API CHANGE
        Concatenate Strings("PATH=/usr/local/bin:/usr/bin:/bin:/usr/local/natinst/bin", Space, $command, Space, $arguments) -> w17
        Left Timing Error Border Node(error_in=w11) -> (error_out=w18)
        Format Into String(formatString="pidof %s", errIn=w18, $command) -> (outString=w19, errOut=w20)
        call "System Exec.gvi"(command line=w19, error in=w20) -> (standard output=w21, error out=w22)
        Is Empty String Or Path(string/path=w21) -> w23
        # We cannot check return code of command for successful program start as we do not wait for completion. Instead we check whether we can find the command in the process list. It is therefore important that the executable is not running on target yet to prevent ambiguity.
        case (w23) {
          frame False, Default {
            w25 = "External MAC already running on RT target. Cannot start before running process is stopped"
            call "Build Error Cluster.gvi"(code=-1, description=w25, error in=w22) -> (error out=w24)
            w14 = default
            w13 = default
          }
          frame True {
            call "System Exec.gvi"(command line="mktemp", error in=w22) -> (standard output=w26, error out=w27)
            # create log file
            call "Trim String.gvi"(text=w26) -> (trimmed text=w14)
            # Start external MAC
            Format Into String(formatString="%s 2>&1 | tee %s", errIn=w27, w17, w14) -> (outString=w28, errOut=w29)
            call "System Exec.gvi"(command line=w28, error in=w29, wait until completion?=FALSE) -> (error out=w30)
            # check pid
            call "System Exec.gvi"(command line=w19, error in=w30) -> (standard output=w31, error out=w32)
            Decimal String To Number(string=w31) -> (number=w33)
            To Unsigned Long Integer(number=w33) -> w13
            Is Empty String Or Path(string/path=w31) -> w34
            case (w34) {
              frame False, Default {
                w24 = w32
              }
              frame True {
                Format Into String(formatString="Failed to start: \"%s\".", errIn=w32, w17) -> (outString=w35, errOut=w36)
                call "Build Error Cluster.gvi"(code=-1, description=w35, error in=w36) -> (error out=w24)
              }
            }
            call "Trim String.gvi"()
          }
        }
        Right Timing Error Border Node(error_in=w24) -> (error_out=w12)
        stop if TRUE
      }
    }
  }
  sequence {
    frame 0 {
      $done <- FALSE
    }
  }
  # NI API CHANGE
  Select(s=$"MAC Stub enabled?", t="Waiting for MAC Stub...", f="Waiting for external MAC...") -> w37
  call "RT Startup Send Notification.gvi"(Error In=w12, Notification=w37)
  timed loop {
    Left Execution System Border Node()
    Left Timing Statistics Border Node()
    Left Timing Error Border Node(error_in=w12) -> (error_out=w38)
    call "LTE Transport Open Writers.gvi"(LTE Transport sessions in=w10, Error in=w38, writers enabled=w5) -> (LTE Transport sessions out=w39, Error out=w40)
    Right Timing Error Border Node(error_in=w40) -> (error_out=w41)
    Left Timing Source Border Node[AlarmName=L, DefaultTimingSourceName="1 kHz", DefaultTimingSourceType=1](structure_in="TP Open Writers")
    stop if TRUE
  }
  Select(s=$"MAC Stub enabled?", t="Connected to MAC Stub!", f="Connected to external MAC!") -> w42
  call "RT Startup Send Notification.gvi"(Error In=w41, Notification=w42)
  $"LTE Transport Sessions" <- w39
  sequence {
    frame 0 {
      $done <- TRUE
    }
  }
  case ($"start externally") {
    frame True {
      # NI API CHANGE
      s1 = w12  # shift register
      while {
        Wait Until Next Multiple(multiple to wait=100)
        call "Check Stop.gvi"(error in=s1) -> (error out=w45, stop=w46)
        Logical Or(w46, $done) -> w47
        next s1 = w45
        stop if w47
      }
      Not(x=w46) -> w44
      w43 = s1
    }
    frame False {
      sequence {
        frame 0 {
          # wait for writers to open
          Wait(time to wait=1000)
        }
        frame 1 {
          w48 = $done
        }
      }
      w43 = w12
      w44 = w48
    }
  }
  case (w44) {
    frame True {
      w49 = w43
    }
    frame False {
      w50 = "Could not open pipe writers. (Please check if pipe readers are opened properly!)"
      # kill opening of blocking writers after timeout
      call "Stop Timed Structure.gvi"(name="TP Open Writers", error in=w43) -> (error out=w51)
      call "Build Error Cluster.gvi"(code=-1, description=w50, error in=w51) -> (error out=w49)
    }
  }
  Merge Errors(w49, w41) -> (error out=w52)
  $"Error out" <- w52
  $"process ID" <- w13
  $"log file" <- w14
