vi "LTE Receive Timing Indication RT.gvi"   [LabVIEW Communications System Design Suite 2.0.1]
# Reads timing indication from DMA FIFO. This routine supports blocking as well as polling read. The read method is configured via session.
# The VI assumes it is invoked such that it reads no more than one indication. If there are more indications in the DMA an error is raised which assuming the VI was called too late to receive all indications in time.
inputs:
  "session": "LTE Host Session.gtype"
  "error in": error
  "eNB TX Active": bool = TRUE
outputs:
  "error out": error
  "subframe index": u32  # Subframe index read from timing indication.
  "subframe index valid": bool  # Timing indication was read successful and subframe index is valid.
  "DMA max elements remaining": u32
  "Num Tim Ind Missed": u32
  "DMA elements remaining": u32
types:
  "LTE Transport Session.gtype" = cluster{"FIFO pathname": string, "pipe reader": "Pipe Reader.gtype", "pipe writer": "Pipe Writer.gtype", "transport in RT FIFO": RTFifoRefnum<u8[]>, "transport out RT FIFO": RTFifoRefnum<u8[]>, "transport in timing source name": string, "transport in timing trigger ID": u8, "transport out timing source name": string, "transport out timing trigger ID": u8, "maximum API message size": u32}
  "niInstr Register Bus v0 Host.lvlib__Register Bus Session.gtype" = Queue<"niInstr Register Bus v0 Host.lvlib__Session Data.gtype">
  "Semaphore RefNum.gtype" = i32
  "niUsrpRio Config v1 Host.lvlib__DB Queue Reference.gtype" = Queue<"niUsrpRio Config v1 Host.lvlib__Daughterboard Data.gtype">
  "niUsrpRio Config v1 Host.lvlib__niUsrpRio Session.gtype" = cluster{"FPGA Interface": any, "RIO Interface Number": u32, "Data Clock Rate": u32, "FPGA Data Clock Rate": u32, "Global Settings Register Bus": "niInstr Register Bus v0 Host.lvlib__Register Bus Session.gtype", "Radio 0 Settings Register Bus": "niInstr Register Bus v0 Host.lvlib__Register Bus Session.gtype", "Radio 1 Settings Register Bus": "niInstr Register Bus v0 Host.lvlib__Register Bus Session.gtype", "Radio Settings Bus Semaphore": "Semaphore RefNum.gtype", "DB Queues": "niUsrpRio Config v1 Host.lvlib__DB Queue Reference.gtype"[], "Characterization Data Valid?": bool, "EEPROM Header": "niUsrpRio Config v1 Host.lvlib__EEPROM Header.gtype", "Device Data Header": "niUsrpRio Config v1 Host.lvlib__EEPROM Device Data Header.gtype", "EEPROM Characterization Header": "niUsrpRio Config v1 Host.lvlib__EEPROM Characterization Header.gtype", "Characterization Data": "niUsrpRio Config v1 Host.lvlib__Characterization Data.gtype"[], "FPGA Current Version": u32, "FPGA Oldest Compatible Version": u32, "Fixed Logic Current Version": u32, "Fixed Logic Oldest Compatible Version": u32, "FPGA Radio Settings Bus Current Version": u32, "FPGA Radio Settings Bus Oldest Compatible Version": u32, "FPGA Board Config Current Version": u32, "FPGA Board Config Oldest Compatible Version": u32, "Daughterboard Clock Rate": u32}
  T1 = cluster{"FPGA ref": any, "bus instance": u32, "instruction FIFO depth": u32, "executing on FPGA target": bool, "show error call chain": bool}
  T2 = cluster{"Actual Gain [dB]": f64, "Attenuation Table Index": i32}
  T3 = cluster{"Attenuation Table [dB]": f64[][], "Frequencies [Hz]": f64[], "IQ Imbalance Table": "niUsrpRio Config v1 Host.lvlib__IQ Imbalance.gtype"[], "Gain Table": T2[][]}
  T4 = cluster{"FlexRIO Register Bus": Queue<T1>, "RX Characterization Data": T3, "TX Characterization Data": T3, "FPGA Interface": any}
  T5 = cluster{"transport block size": u32, "CRC ok": bool, "user data": u32}
  "LTE Host Session.gtype" = cluster{"target": enum{"USRP", "FlexRIO"}, "real time mode": bool, "MAC Stub enabled": bool, "DMA FIFO read timeout": i32, "timed loop period": i64, "LTE Transport Sessions": "LTE Transport Session.gtype"[], "USRP session": "niUsrpRio Config v1 Host.lvlib__niUsrpRio Session.gtype", "FlexRIO session": T4, "UDP RX session": UdpNetworkConnectionRefnum, "UDP TX session": UdpNetworkConnectionRefnum, "sync found queue": Queue<bool>, "PDCCH CRC ok queue": Queue<bool>, "DL PDCCH status queue": Queue<cluster{"CRC ok": bool, "subframe number": u32}>, "DL PDSCH status queue": Queue<cluster{"CRC ok": bool, "subframe number": u32}>, "DL SINR queue": Queue<f64[]>, "PDSCH user data queue": Queue<u32>, "PDSCH user data UDP queue": Queue<T5>, "PDSCH user data throughput queue": Queue<T5>, "PUSCH user data queue": Queue<u32>, "PUSCH user data UDP queue": Queue<T5>, "PUSCH user data throughput queue": Queue<T5>, "UE feedback info FIFO": RTFifoRefnum<u8[]>, "Request information FIFO": RTFifoRefnum<"LTE Request Information.gtype">, "UDP TX outbound FIFO": RTFifoRefnum<u8[]>, "UDP RX inbound FIFO": RTFifoRefnum<u8[]>, "stop notifier": Notifier<string>, "DL RX scope": string, "UL RX scope": string, "external MAC log file": string, "external MAC process ID": u32}
diagram:
  Feedback Node(input=$"eNB TX Active") -> w1
  Logical And($"eNB TX Active", not w1) -> w2
  Property Node(instance in=$session) -> ("DMA FIFO read timeout"=w3)
  call "LTE Unbundle Session.gvi"(session=$session) -> (FPGA Interface=w4)
  Type Cast(type=any constant, x=w4) -> w5
  case (w2) {
    frame True {
      # empty Timing Indication FIFO on initial read
      Host Fifo Read Node[FifoName="LTE AFW Resources.grsc\\T2H Timing Indication"](error in=$"error in", number of elements=0, reference in=w5, timeout (ms)=w3) -> (elements remaining=w9, error out=w10, reference out=w11)
      Host Fifo Read Node[FifoName="LTE AFW Resources.grsc\\T2H Timing Indication"](error in=w10, number of elements=w9, reference in=w11, timeout (ms)=0) -> (data=w6, elements remaining=w8, error out=w7)
    }
    frame False {
      # read Timing Indication every TTI from FPGA
      Host Fifo Read Node[FifoName="LTE AFW Resources.grsc\\T2H Timing Indication"](error in=$"error in", number of elements=1, reference in=w5, timeout (ms)=w3) -> (data=w6, elements remaining=w8, error out=w7)
    }
  }
  Array Size(array=w6) -> (size(s)=w12)
  Is Greater Than 0(x=w12) -> w13
  case (w13) {
    frame False {
      w17 = -50400  # timeout error
      call "Filter Error Code.gvi"(code to clear=w17, error in=w7) -> (error out=w14)
      w15 = FALSE
      w16 = 255
    }
    frame True {
      Decrement(x=w12) -> w18
      Array Index(array=w6) -> (out0[w18]=w16)
      Is Equal To 0(x=w8) -> w19
      case (w19) {
        frame False, Default {
          # NI API CHANGE
          # dirty Hack
          call "Build Error Cluster.gvi"(code=-1, description="Timing Indication missed", error in=w7, make warning=TRUE) -> (error out=w14)
          Feedback Node(initial value=0, input=w20) -> w21
          Add(1, w21) -> w20
          # NI API CHANGE
          $"Num Tim Ind Missed" <- w21
          w15 = TRUE
        }
        frame True {
          w14 = w7
          w15 = TRUE
        }
      }
    }
  }
  $"subframe index" <- w16
  $"subframe index valid" <- w15
  $"error out" <- w14
  Feedback Node(initial value=0, input=w22) -> w23
  Max And Min(x=w8, y=w23) -> (max(x,y)=w22: u32)
  # NI API CHANGE
  $"DMA max elements remaining" <- w23
  # NI API CHANGE
  $"DMA elements remaining" <- w8
