vi "RT Startup Create Notifier.gvi"   [LabVIEW Communications System Design Suite 2.0.1]
inputs:
  "Error In": error
outputs:
  "Error Out": error
diagram:
  Call Chain() -> (callchain=w1)
  Delete From Array(inArray=w1) -> (deleted=w2)
  Format Into String(formatString="%s:RT startup notifier", errIn=$"Error In", w2) -> (outString=w3, errOut=w4)
  Obtain Notifier(create if not found?=TRUE, element data type=string "", error in=w4, name=w3) -> (error out=w5)
  $"Error Out" <- w5
