vi "RT Startup Send Notification.gvi"   [LabVIEW Communications System Design Suite 2.0.1]
inputs:
  "Error In": error
  "Notification": string = "done"
outputs:
  "Error Out": error
diagram:
  Call Chain() -> (callchain=w1)
  Delete From Array(inArray=w1) -> (deleted=w2)
  Format Into String(formatString="%s:RT startup notifier", errIn=$"Error In", w2) -> (outString=w3, errOut=w4)
  Obtain Notifier(create if not found?=FALSE, element data type=string "", error in=w4, name=w3) -> (error out=w5, notifier out=w6)
  Send Notification(error in (no error)=w5, notification=$Notification, notifier=w6) -> (error out=w7, notifier out=w8)
  Release Notifier(error in (no error)=w7, notifier=w8) -> (error out=w9)
  $"Error Out" <- w9
