vi "LTE UE Host Initialization.gvi"   [LabVIEW Communications System Design Suite 2.0.1]
# Opens a session to a specific USRP RIO device, downloads the FPGA bitfile, runs the FPGA, and starts all the target to host and host to target DMA transfers.
# Necessary UDP connections are opened and all the queues used in the UE host application are obtained. The session cluster is initialized with queue references and the USRP session.
inputs:
  "USRP device": string = "RIO0"  # Specific USRP RIO device to open a session to.
  "session in": "LTE Host Session.gtype"  # Contains session information such as used target, FlexRIO and USRP sessions, FPGA reference, and queue references.
  "error in": error
  "reference clock source": string = "Internal"  # The used reference clock input. Valid values are Internal, REF IN / ClkIn, PXI_CLK, and GPS.
  "start externally": bool
  "external MAC": bool
  "command": string
  "arguments": string
outputs:
  "error out": error
  "session out": "LTE Host Session.gtype"  # Contains session information such as used target, FlexRIO and USRP sessions, FPGA reference, and queue references.
  "device bandwidth": u16  # Detected instantaneous device bandwidth
types:
  "LTE Transport Session.gtype" = cluster{"FIFO pathname": string, "pipe reader": "Pipe Reader.gtype", "pipe writer": "Pipe Writer.gtype", "transport in RT FIFO": RTFifoRefnum<u8[]>, "transport out RT FIFO": RTFifoRefnum<u8[]>, "transport in timing source name": string, "transport in timing trigger ID": u8, "transport out timing source name": string, "transport out timing trigger ID": u8, "maximum API message size": u32}
  "niInstr Register Bus v0 Host.lvlib__Register Bus Session.gtype" = Queue<"niInstr Register Bus v0 Host.lvlib__Session Data.gtype">
  "Semaphore RefNum.gtype" = i32
  "niUsrpRio Config v1 Host.lvlib__DB Queue Reference.gtype" = Queue<"niUsrpRio Config v1 Host.lvlib__Daughterboard Data.gtype">
  "niUsrpRio Config v1 Host.lvlib__niUsrpRio Session.gtype" = cluster{"FPGA Interface": any, "RIO Interface Number": u32, "Data Clock Rate": u32, "FPGA Data Clock Rate": u32, "Global Settings Register Bus": "niInstr Register Bus v0 Host.lvlib__Register Bus Session.gtype", "Radio 0 Settings Register Bus": "niInstr Register Bus v0 Host.lvlib__Register Bus Session.gtype", "Radio 1 Settings Register Bus": "niInstr Register Bus v0 Host.lvlib__Register Bus Session.gtype", "Radio Settings Bus Semaphore": "Semaphore RefNum.gtype", "DB Queues": "niUsrpRio Config v1 Host.lvlib__DB Queue Reference.gtype"[], "Characterization Data Valid?": bool, "EEPROM Header": "niUsrpRio Config v1 Host.lvlib__EEPROM Header.gtype", "Device Data Header": "niUsrpRio Config v1 Host.lvlib__EEPROM Device Data Header.gtype", "EEPROM Characterization Header": "niUsrpRio Config v1 Host.lvlib__EEPROM Characterization Header.gtype", "Characterization Data": "niUsrpRio Config v1 Host.lvlib__Characterization Data.gtype"[], "FPGA Current Version": u32, "FPGA Oldest Compatible Version": u32, "Fixed Logic Current Version": u32, "Fixed Logic Oldest Compatible Version": u32, "FPGA Radio Settings Bus Current Version": u32, "FPGA Radio Settings Bus Oldest Compatible Version": u32, "FPGA Board Config Current Version": u32, "FPGA Board Config Oldest Compatible Version": u32, "Daughterboard Clock Rate": u32}
  T1 = cluster{"FPGA ref": any, "bus instance": u32, "instruction FIFO depth": u32, "executing on FPGA target": bool, "show error call chain": bool}
  T2 = cluster{"Actual Gain [dB]": f64, "Attenuation Table Index": i32}
  T3 = cluster{"Attenuation Table [dB]": f64[][], "Frequencies [Hz]": f64[], "IQ Imbalance Table": "niUsrpRio Config v1 Host.lvlib__IQ Imbalance.gtype"[], "Gain Table": T2[][]}
  T4 = cluster{"FlexRIO Register Bus": Queue<T1>, "RX Characterization Data": T3, "TX Characterization Data": T3, "FPGA Interface": any}
  T5 = cluster{"transport block size": u32, "CRC ok": bool, "user data": u32}
  "LTE Host Session.gtype" = cluster{"target": enum{"USRP", "FlexRIO"}, "real time mode": bool, "MAC Stub enabled": bool, "DMA FIFO read timeout": i32, "timed loop period": i64, "LTE Transport Sessions": "LTE Transport Session.gtype"[], "USRP session": "niUsrpRio Config v1 Host.lvlib__niUsrpRio Session.gtype", "FlexRIO session": T4, "UDP RX session": UdpNetworkConnectionRefnum, "UDP TX session": UdpNetworkConnectionRefnum, "sync found queue": Queue<bool>, "PDCCH CRC ok queue": Queue<bool>, "DL PDCCH status queue": Queue<cluster{"CRC ok": bool, "subframe number": u32}>, "DL PDSCH status queue": Queue<cluster{"CRC ok": bool, "subframe number": u32}>, "DL SINR queue": Queue<f64[]>, "PDSCH user data queue": Queue<u32>, "PDSCH user data UDP queue": Queue<T5>, "PDSCH user data throughput queue": Queue<T5>, "PUSCH user data queue": Queue<u32>, "PUSCH user data UDP queue": Queue<T5>, "PUSCH user data throughput queue": Queue<T5>, "UE feedback info FIFO": RTFifoRefnum<u8[]>, "Request information FIFO": RTFifoRefnum<"LTE Request Information.gtype">, "UDP TX outbound FIFO": RTFifoRefnum<u8[]>, "UDP RX inbound FIFO": RTFifoRefnum<u8[]>, "stop notifier": Notifier<string>, "DL RX scope": string, "UL RX scope": string, "external MAC log file": string, "external MAC process ID": u32}
  T6 = cluster{"read mode": enum{"polling", "blocking"}, "write mode": enum{"polling", "blocking"}}
  "LTE Message Type ID Defined.gtype" = u16
  "LTE General Message Header.gtype" = cluster{"message type ID": "LTE Message Type ID Defined.gtype", "reference ID": u16, "instance ID": u8}
  "LTE SAP Sub Header.gtype" = cluster{"SFN": u16, "TTI index": u8, "number of submessages": u8, "confirmation mode": u8, "Reserved": u32}
  "LTE Request Information.gtype" = cluster{"message header": "LTE General Message Header.gtype", "SAP sub header": "LTE SAP Sub Header.gtype"}
diagram:
  # NI API CHANGE
  call "RT Startup Send Notification.gvi"(Error In=$"error in", Notification="Initialize System...")
  # NI API CHANGE
  Not(x=$"external MAC") -> w1
  w2 = cluster{"CRC ok": bool, "subframe number": u32} {all zero or empty}
  w3 = 0xFFFF  # level SOL_SOCKET
  w4 = 1024000  # buffer size in bytes
  w5 = 0x1001  # optname SO_SNDBUF
  case ($"reference clock source") {
    frame "Internal" {
      w6 = $"reference clock source"
      w7 = default
    }
    frame "REF IN / ClkIn" {
      w6 = "REF IN"
      w7 = default
    }
    frame "GPS" {
      w6 = $"reference clock source"
      w7 = default
    }
    frame "PXI_CLK", Default {
      w8 = error {"status"=TRUE, "code"=1, "source"="PXI_CLK reference clock not supported for USRP target"}
      w6 = "Internal"
      w7 = w8
    }
  }
  FPGA Open Node[ProjectItem=":NullTarget:LTE\\ FPGA\\ USRP\\ RIO\\ 160\\ MHz\\ BW\\ UE\\.lvbitx"](RIO address=$"USRP device", error in=$"error in", run?=FALSE) -> (error out=w9, reference out=w10)
  call "Read Device Bandwidth.gvi"(FPGA reference in=w10, error in=w9) -> (error out=w11, bandwidth=w12, FPGA reference out=w13)
  case (w12) {
    frame "40 MHz" {
      FPGA Close Node(error in=w11, reference in=w13) -> (error out=w16)
      FPGA Open Node[ProjectItem=":NullTarget:LTE\\ FPGA\\ USRP\\ RIO\\ 40\\ MHz\\ BW\\ UE\\.lvbitx"](RIO address=$"USRP device", error in=w16, run?=FALSE) -> (error out=w15, reference out=w14)
    }
    frame "120 MHz" {
      FPGA Close Node(error in=w11, reference in=w13) -> (error out=w17)
      FPGA Open Node[ProjectItem=":NullTarget:LTE\\ FPGA\\ USRP\\ RIO\\ 120\\ MHz\\ BW\\ UE\\.lvbitx"](RIO address=$"USRP device", error in=w17, run?=FALSE) -> (error out=w15, reference out=w14)
    }
    frame "160 MHz", Default {
      w14 = w13
      w15 = w11
    }
  }
  FPGA Download Node(error in=w15, reference in=w14) -> (error out=w18, reference out=w19)
  FPGA Run Node(error in=w18, reference in=w19) -> (error out=w20, reference out=w21)
  Merge Errors(w20, w7) -> (error out=w22)
  call "niUsrpRio Config v1 Host.lvlib__Open 2.gvi"(fpga ref=w21, error in=w22, reference frequency source=w6, gpsdo power enable=TRUE, timeout=1, scope="") -> (niusrprio session out=w23, error out=w24)
  call "niUsrpRio Config v1 Host.lvlib__Enable Front End.gvi"(niusrprio session in=w23, enable=FALSE, error in=w24, scope="rx") -> (niusrprio session out=w25, error out=w26)
  call "niUsrpRio Config v1 Host.lvlib__Enable Front End.gvi"(niusrprio session in=w25, enable=FALSE, error in=w26, scope="tx") -> (niusrprio session out=w27, error out=w28)
  call "Check USRP Data Clock Rate and Bandwidth.gvi"(niusrprio session in=w27, error in=w28) -> (niusrprio session out=w29, error out=w30)
  Udp Open(error in=w30, net address=0, port=0, service name="", timeout ms=25000) -> (connection ID=w31, error out=w32)
  call "Set Socket Option.gvi"(connection in=w31, level=w3, option name=w5, value=w4, error in=w32) -> (error out=w33, connection out=w34)
  Obtain Queue(create if not found?=TRUE, element data type=bool FALSE, error in=w33, max queue size=-1, name="") -> (error out=w35, queue out=w36)
  Obtain Queue(create if not found?=TRUE, element data type=bool FALSE, error in=w35, max queue size=-1, name="") -> (error out=w37, queue out=w38)
  Obtain Queue(create if not found?=TRUE, element data type=w2, error in=w37, max queue size=-1, name="") -> (error out=w39, queue out=w40)
  Obtain Queue(create if not found?=TRUE, element data type=w2, error in=w39, max queue size=-1, name="") -> (error out=w41, queue out=w42)
  Obtain Queue(create if not found?=TRUE, element data type=f64[] [], error in=w41, max queue size=-1, name="") -> (error out=w43, queue out=w44)
  Obtain Queue(create if not found?=TRUE, element data type=u32 0, error in=w43, max queue size=-1, name="") -> (error out=w45, queue out=w46)
  Obtain Queue(create if not found?=TRUE, element data type=T5 {all zero or empty}, error in=w45, max queue size=-1, name="") -> (error out=w47, queue out=w48)
  Obtain Queue(create if not found?=TRUE, element data type=T5 {all zero or empty}, error in=w47, max queue size=-1, name="") -> (error out=w49, queue out=w50)
  call "Create Stop Notifier.gvi"(error in=w49) -> (error out=w51, stop notifier=w52)
  call "LTE Setup RT Parameters.gvi"(error in=w51, MAC Stub enabled?=w1, command line=$command, arguments=$arguments, start externally=$"start externally") -> (error out=w53, DMA FIFO read timeout (ms)=w54, real time mode=w55, timed loop period=w56, LTE Transport Sessions=w57, process ID=w58, log file=w59)
  RTFIFO Create(elements in array=24, error in=w53, name="UE feedback info FIFO", r/w modes=T6 {"read mode"="blocking", "write mode"="blocking"}, size=10, type=u8[] []) -> (error out=w60, rt fifo=w61)
  RTFIFO Create(error in=w60, name="Request information FIFO", r/w modes=T6 {"read mode"="blocking", "write mode"="blocking"}, size=10, type="LTE Request Information.gtype" {all zero or empty}) -> (error out=w62, rt fifo=w63)
  RTFIFO Create(elements in array=65535, error in=w62, name="UDP RX inbound FIFO", r/w modes=T6 {"read mode"="blocking", "write mode"="blocking"}, size=100, type=u8[] []) -> (error out=w64, rt fifo=w65)
  Property Node(instance in=$"session in", "USRP session"=w29, "UDP RX session"=w34, "sync found queue"=w36, "PDCCH CRC ok queue"=w38, "DL PDCCH status queue"=w40, "DL PDSCH status queue"=w42, "DL SINR queue"=w44, "PDSCH user data queue"=w46, "PDSCH user data UDP queue"=w48, "PDSCH user data throughput queue"=w50, "stop notifier"=w52, "real time mode"=w55, "DMA FIFO read timeout"=w54, "timed loop period"=w56, "MAC Stub enabled"=w1, "LTE Transport Sessions"=w57, "UE feedback info FIFO"=w61, "Request information FIFO"=w63, "UDP RX inbound FIFO"=w65, "external MAC log file"=w59, "external MAC process ID"=w58) -> (instance out=w66)
  call "LTE DL RX FIFO Initialization.gvi"(session=w66, error in=w64) -> (error out=w67)
  call "LTE UL TX FIFO Initialization.gvi"(session=w66, error in=w64) -> (error out=w68)
  Merge Errors(w67, w68) -> (error out=w69)
  # NI API CHANGE
  call "RT Startup Send Notification.gvi"(Error In=w69, Notification="System Init Complete!")
  $"session out" <- w66
  $"error out" <- w69
  Scan Value(default (0 dbl)=0, format string="%d", string=w12) -> (value=w70)
  $"device bandwidth" <- w70
