vi "LTE eNodeB Host Initialization.gvi"   [LabVIEW Communications System Design Suite 2.0.1]
# Opens a session to a specific USRP RIO device, downloads the FPGA bitfile, runs the FPGA, and starts all the target to host and host to target DMA transfers.
# All the queues used in the eNodeB host application are obtained and the session cluster is initialized with queue references and the USRP session.
inputs:
  "USRP device": string = "RIO0"  # Specific USRP RIO device to open a session to.
  "session in": "LTE Host Session.gtype"  # Contains session information such as used target, FlexRIO and USRP sessions, FPGA reference, and queue references.
  "error in": error
  "reference clock source": string = "Internal"  # The used reference clock input. Valid values are Internal, REF IN / ClkIn, PXI_CLK, and GPS.
  "start externally": bool
  "external MAC": bool
  "command": string
  "arguments": string
outputs:
  "error out": error
  "session": "LTE Host Session.gtype"
  "device bandwidth": u16  # Detected instantaneous device bandwidth
types:
  "LTE Transport Session.gtype" = cluster{"FIFO pathname": string, "pipe reader": "Pipe Reader.gtype", "pipe writer": "Pipe Writer.gtype", "transport in RT FIFO": RTFifoRefnum<u8[]>, "transport out RT FIFO": RTFifoRefnum<u8[]>, "transport in timing source name": string, "transport in timing trigger ID": u8, "transport out timing source name": string, "transport out timing trigger ID": u8, "maximum API message size": u32}
  "niInstr Register Bus v0 Host.lvlib__Register Bus Session.gtype" = Queue<"niInstr Register Bus v0 Host.lvlib__Session Data.gtype">
  "Semaphore RefNum.gtype" = i32
  "niUsrpRio Config v1 Host.lvlib__DB Queue Reference.gtype" = Queue<"niUsrpRio Config v1 Host.lvlib__Daughterboard Data.gtype">
  "niUsrpRio Config v1 Host.lvlib__niUsrpRio Session.gtype" = cluster{"FPGA Interface": any, "RIO Interface Number": u32, "Data Clock Rate": u32, "FPGA Data Clock Rate": u32, "Global Settings Register Bus": "niInstr Register Bus v0 Host.lvlib__Register Bus Session.gtype", "Radio 0 Settings Register Bus": "niInstr Register Bus v0 Host.lvlib__Register Bus Session.gtype", "Radio 1 Settings Register Bus": "niInstr Register Bus v0 Host.lvlib__Register Bus Session.gtype", "Radio Settings Bus Semaphore": "Semaphore RefNum.gtype", "DB Queues": "niUsrpRio Config v1 Host.lvlib__DB Queue Reference.gtype"[], "Characterization Data Valid?": bool, "EEPROM Header": "niUsrpRio Config v1 Host.lvlib__EEPROM Header.gtype", "Device Data Header": "niUsrpRio Config v1 Host.lvlib__EEPROM Device Data Header.gtype", "EEPROM Characterization Header": "niUsrpRio Config v1 Host.lvlib__EEPROM Characterization Header.gtype", "Characterization Data": "niUsrpRio Config v1 Host.lvlib__Characterization Data.gtype"[], "FPGA Current Version": u32, "FPGA Oldest Compatible Version": u32, "Fixed Logic Current Version": u32, "Fixed Logic Oldest Compatible Version": u32, "FPGA Radio Settings Bus Current Version": u32, "FPGA Radio Settings Bus Oldest Compatible Version": u32, "FPGA Board Config Current Version": u32, "FPGA Board Config Oldest Compatible Version": u32, "Daughterboard Clock Rate": u32}
  T1 = cluster{"FPGA ref": any, "bus instance": u32, "instruction FIFO depth": u32, "executing on FPGA target": bool, "show error call chain": bool}
  T2 = cluster{"Actual Gain [dB]": f64, "Attenuation Table Index": i32}
  T3 = cluster{"Attenuation Table [dB]": f64[][], "Frequencies [Hz]": f64[], "IQ Imbalance Table": "niUsrpRio Config v1 Host.lvlib__IQ Imbalance.gtype"[], "Gain Table": T2[][]}
  T4 = cluster{"FlexRIO Register Bus": Queue<T1>, "RX Characterization Data": T3, "TX Characterization Data": T3, "FPGA Interface": any}
  T5 = cluster{"transport block size": u32, "CRC ok": bool, "user data": u32}
  "LTE Host Session.gtype" = cluster{"target": enum{"USRP", "FlexRIO"}, "real time mode": bool, "MAC Stub enabled": bool, "DMA FIFO read timeout": i32, "timed loop period": i64, "LTE Transport Sessions": "LTE Transport Session.gtype"[], "USRP session": "niUsrpRio Config v1 Host.lvlib__niUsrpRio Session.gtype", "FlexRIO session": T4, "UDP RX session": UdpNetworkConnectionRefnum, "UDP TX session": UdpNetworkConnectionRefnum, "sync found queue": Queue<bool>, "PDCCH CRC ok queue": Queue<bool>, "DL PDCCH status queue": Queue<cluster{"CRC ok": bool, "subframe number": u32}>, "DL PDSCH status queue": Queue<cluster{"CRC ok": bool, "subframe number": u32}>, "DL SINR queue": Queue<f64[]>, "PDSCH user data queue": Queue<u32>, "PDSCH user data UDP queue": Queue<T5>, "PDSCH user data throughput queue": Queue<T5>, "PUSCH user data queue": Queue<u32>, "PUSCH user data UDP queue": Queue<T5>, "PUSCH user data throughput queue": Queue<T5>, "UE feedback info FIFO": RTFifoRefnum<u8[]>, "Request information FIFO": RTFifoRefnum<"LTE Request Information.gtype">, "UDP TX outbound FIFO": RTFifoRefnum<u8[]>, "UDP RX inbound FIFO": RTFifoRefnum<u8[]>, "stop notifier": Notifier<string>, "DL RX scope": string, "UL RX scope": string, "external MAC log file": string, "external MAC process ID": u32}
  "LTE Message Type ID Defined.gtype" = u16
  "LTE General Message Header.gtype" = cluster{"message type ID": "LTE Message Type ID Defined.gtype", "reference ID": u16, "instance ID": u8}
  "LTE SAP Sub Header.gtype" = cluster{"SFN": u16, "TTI index": u8, "number of submessages": u8, "confirmation mode": u8, "Reserved": u32}
  "LTE Request Information.gtype" = cluster{"message header": "LTE General Message Header.gtype", "SAP sub header": "LTE SAP Sub Header.gtype"}
  T6 = cluster{"read mode": enum{"polling", "blocking"}, "write mode": enum{"polling", "blocking"}}
diagram:
  # NI API CHANGE
  call "RT Startup Send Notification.gvi"(Error In=$"error in", Notification="Initialize System...")
  case ($"reference clock source") {
    frame "Internal" {
      w1 = $"reference clock source"
      w2 = default
    }
    frame "REF IN / ClkIn" {
      w1 = "REF IN"
      w2 = default
    }
    frame "GPS" {
      w1 = $"reference clock source"
      w2 = default
    }
    frame "PXI_CLK", Default {
      w3 = error {"status"=TRUE, "code"=1, "source"="PXI_CLK reference clock not supported for USRP target"}
      w1 = "Internal"
      w2 = w3
    }
  }
  FPGA Open Node[ProjectItem=":NullTarget:LTE\\ FPGA\\ USRP\\ RIO\\ 160\\ MHz\\ BW\\ eNodeB\\.lvbitx"](RIO address=$"USRP device", error in=$"error in", run?=FALSE) -> (error out=w4, reference out=w5)
  call "Read Device Bandwidth.gvi"(FPGA reference in=w5, error in=w4) -> (error out=w6, bandwidth=w7, FPGA reference out=w8)
  case (w7) {
    frame "40 MHz" {
      FPGA Close Node(error in=w6, reference in=w8) -> (error out=w11)
      FPGA Open Node[ProjectItem=":NullTarget:LTE\\ FPGA\\ USRP\\ RIO\\ 40\\ MHz\\ BW\\ eNodeB\\.lvbitx"](RIO address=$"USRP device", error in=w11, run?=FALSE) -> (error out=w10, reference out=w9)
    }
    frame "120 MHz" {
      FPGA Close Node(error in=w6, reference in=w8) -> (error out=w12)
      FPGA Open Node[ProjectItem=":NullTarget:LTE\\ FPGA\\ USRP\\ RIO\\ 120\\ MHz\\ BW\\ eNodeB\\.lvbitx"](RIO address=$"USRP device", error in=w12, run?=FALSE) -> (error out=w10, reference out=w9)
    }
    frame "160 MHz", Default {
      w9 = w8
      w10 = w6
    }
  }
  FPGA Download Node(error in=w10, reference in=w9) -> (error out=w13, reference out=w14)
  FPGA Run Node(error in=w13, reference in=w14) -> (error out=w15, reference out=w16)
  Merge Errors(w15, w2) -> (error out=w17)
  call "niUsrpRio Config v1 Host.lvlib__Open 2.gvi"(fpga ref=w16, error in=w17, reference frequency source=w1, gpsdo power enable=TRUE, timeout=1, scope="") -> (niusrprio session out=w18, error out=w19)
  call "niUsrpRio Config v1 Host.lvlib__Enable Front End.gvi"(niusrprio session in=w18, enable=FALSE, error in=w19, scope="rx") -> (niusrprio session out=w20, error out=w21)
  call "niUsrpRio Config v1 Host.lvlib__Enable Front End.gvi"(niusrprio session in=w20, enable=FALSE, error in=w21, scope="tx") -> (niusrprio session out=w22, error out=w23)
  call "Check USRP Data Clock Rate and Bandwidth.gvi"(niusrprio session in=w22, error in=w23) -> (niusrprio session out=w24, error out=w25)
  Obtain Queue(create if not found?=TRUE, element data type=u32 0, error in=w25, max queue size=-1, name="") -> (error out=w26, queue out=w27)
  Obtain Queue(create if not found?=TRUE, element data type=T5 {all zero or empty}, error in=w26, max queue size=-1, name="") -> (error out=w28, queue out=w29)
  Obtain Queue(create if not found?=TRUE, element data type=T5 {all zero or empty}, error in=w28, max queue size=-1, name="") -> (error out=w30, queue out=w31)
  call "Create Stop Notifier.gvi"(error in=w30) -> (error out=w32, stop notifier=w33)
  # NI API CHANGE
  Not(x=$"external MAC") -> w34
  call "LTE Setup RT Parameters.gvi"(error in=w32, MAC Stub enabled?=w34, command line=$command, arguments=$arguments, start externally=$"start externally") -> (error out=w35, DMA FIFO read timeout (ms)=w36, real time mode=w37, timed loop period=w38, LTE Transport Sessions=w39, process ID=w40, log file=w41)
  RTFIFO Create(error in=w35, name="Request information FIFO", r/w modes=T6 {"read mode"="blocking", "write mode"="blocking"}, size=10, type="LTE Request Information.gtype" {all zero or empty}) -> (error out=w42, rt fifo=w43)
  RTFIFO Create(elements in array=65535, error in=w42, name="UDP TX outbound FIFO", r/w modes=T6 {"read mode"="blocking", "write mode"="blocking"}, size=100, type=u8[] []) -> (error out=w44, rt fifo=w45)
  Property Node(instance in=$"session in", "USRP session"=w24, "PUSCH user data queue"=w27, "PUSCH user data UDP queue"=w29, "PUSCH user data throughput queue"=w31, "stop notifier"=w33, "real time mode"=w37, "DMA FIFO read timeout"=w36, "timed loop period"=w38, "MAC Stub enabled"=w34, "LTE Transport Sessions"=w39, "Request information FIFO"=w43, "UDP TX outbound FIFO"=w45, "external MAC log file"=w41, "external MAC process ID"=w40) -> (instance out=w46)
  call "LTE UL RX FIFO Initialization.gvi"(session=w46, error in=w44) -> (error out=w47)
  call "LTE DL TX FIFO Initialization.gvi"(session=w46, error in=w44) -> (error out=w48)
  Merge Errors(w47, w48) -> (error out=w49)
  call "RT Startup Send Notification.gvi"(Error In=w49, Notification="System Init Complete!")
  $session <- w46
  $"error out" <- w49
  Scan Value(default (0 dbl)=0, format string="%d", string=w7) -> (value=w50)
  $"device bandwidth" <- w50
